# Grasshopper definition MASTER__ADVANCED__extracting$fromStr_004.gh (Grasshopper 1.0.7)
# Copyright: © 2017-2018 Pierre Cuvilliers, Caitlin Mueller, Massachusetts Institute of Technology
# plug-ins: Bifocals

# ----
# Branch
# Managment
# Script
number_slider = Slider(7, range=0..10)
# Focus on undervalued technique
# to be more efficient with textual data
# by using regular expressions
# Shows you 10 different ways to use them
# to solve roblems with less energy, time and energy
# Take you time and study well!
number_slider_2 = Slider(6, range=0..10)
# ghPython oneLiners__Advanced REGULAR EXPRESSIONS
number_slider_3 = Slider(5, range=0..10)
oneliners_intadvanced_branchmanagment_00 = OneLiners_intAdvanced_branchManagment_001(
    numPaths=number_slider_3,
    startBranch=Slider(3, range=0..10),
    stopBranch=number_slider,
    stepBranch=Slider(3, range=0..10),
    numItems=number_slider_2)  # -> out, nest, paths, a, b; inputs numPaths: Int32, startBranch: Int32, stopBranch: Int32, numItems: Int32
# ---------- oneliners_intadvanced_branchmanagment_00: Python ----------
##################################################
import random
import Grasshopper.Kernel.Data.GH_Path as ghpath
import Grasshopper.DataTree as datatree 
import System
import ghpythonlib.components as ghc
import rhinoscriptsyntax as rs
import Rhino.Geometry as rg
##################################################

nest = datatree[System.Object]() #the tree
paths = datatree[System.Object]()
for Alpha_path in range(numPaths): # numPaths Alpha paths
    for Beta_branch in range(random.randrange(startBranch,stopBranch,stepBranch)): #each gets random number of beta branchs
        paths.Add( (ghpath(Alpha_path,Beta_branch)),ghpath(Alpha_path))#add full_path name to Alph path
        for item in range(numItems):# each path has (numItems) numbers
            nest.Add(item, ghpath(Alpha_path,Beta_branch)) # assign number to given path

#how to call all Beta Branchs from Alpha path (zero) ??
for path in paths.Branch(0):
    print path
    print nest.Branch(ghpath(path))

a = nest
b = paths
# ---------- end oneliners_intadvanced_branchmanagment_00 ----------
panel = Panel(oneliners_intadvanced_branchmanagment_00.out)
panel_2 = Panel(oneliners_intadvanced_branchmanagment_00.paths)
viewer = ParamViewer(oneliners_intadvanced_branchmanagment_00.nest)

# ----
# the Dot Regex
# the . character for matching an arbitrary character
# including whitespace
# Use it to indicate that you don't care which
# character matches, as long as exactly one matches
# 001
oneliners_dotregex_001 = OneLiners_dotRegex_001()  # -> out, a
# ---------- oneliners_dotregex_001: Python ----------
__author__ = "Sculpture"
__version__ = "2021.05.30"

import rhinoscriptsyntax as rs

#import and do all this JAZZ!
import rhinoscriptsyntax as rs
import scriptcontext as sc
import ghpythonremote

re = sc.sticky['re']

text = """the quick brown fox jumps over the lazy brown dog."
"""

print(re.findall('b...n', text))
# ---------- end oneliners_dotregex_001 ----------
# If you are good with swapping data types with dtype()  and astype() functions these script could be great for numerical data as well
panel_3 = Panel(oneliners_dotregex_001.out)

# ----
# the zero-or-one Regex
# ? to match zero or one char
# see example code
# __________
# *? can also be used to allow for
# nongreedy pattern matching
# searches for the minimal with the ? attached
# see example
# Regular Expressions:
# Uses the re module and important re.findall() function
# the Basics:
# regex for shot, describes a serach pattern
# to match sections of text
# "strings" for starters
# learn the basics to create more powerful
# and complex regular expressions
# Let's look at three most important regex commands...
oneliners_zero_or_oneregex_003 = OneLiners_zeroOrOneRegex_003()  # -> out, a
# ---------- oneliners_zero_or_oneregex_003: Python ----------
__author__ = "Sculpture"
__version__ = "2021.05.30"

import rhinoscriptsyntax as rs

#import and do all this JAZZ!
import rhinoscriptsyntax as rs
import scriptcontext as sc
import ghpythonremote

re = sc.sticky['re']

text = "the jump brown fox jumps over these lazy brown dog."

print(re.findall('jumps?', text))
# ---------- end oneliners_zero_or_oneregex_003 ----------
panel_4 = Panel(oneliners_zero_or_oneregex_003.out)

# ----
# the Asterisk Regex
# * is for an arbitrary amount of characters inbetween
# but * can't stand on it's own, it modifys the meaning
# of another regex
# note 1: the dot operator doesn't match newline char
# * works in compination with any other regex
# i.e. abc* for 'ab', 'bc', 'ac', 'abccdc'
oneliners_asteriskregex_002 = OneLiners_asteriskRegex_002()  # -> out, a
# ---------- oneliners_asteriskregex_002: Python ----------
__author__ = "Sculpture"
__version__ = "2021.05.30"

import rhinoscriptsyntax as rs

#import and do all this JAZZ!
import rhinoscriptsyntax as rs
import scriptcontext as sc
import ghpythonremote

re = sc.sticky['re']

text = """the quick brown fox jumps over the lazy brown dog."
"""

print(re.findall('e.*f', text))

text = """12323435564577687
"""

print(re.findall('2.*7', text))
# ---------- end oneliners_asteriskregex_002 ----------
panel_5 = Panel(oneliners_asteriskregex_002.out)

# ----
# GH Python Remote Node Setup
panel_6 = Panel("C:\Users\Sculpture\.conda\envs\rhinoremote")
gh_python_remote = GHPythonRemote(location=panel_6, run=Toggle(True), modules="re")  # -> out, linked_modules, rpy, import_statements
panel_7 = Panel(gh_python_remote.import_statements)
panel_8 = Panel(gh_python_remote.linked_modules)

# ----
# The Code
# Input is a str
# see example
# for text processing and speech
# recognition
# or machine translation
# search engines, social networks
# and video platforms
# How it Works:
# Non Greedy and Greedy examples
oneliners_greedynongreedyexception_005 = OneLiners_greedyNonGreedyEXCEPTION_005()  # -> out, a
# ---------- oneliners_greedynongreedyexception_005: Python ----------
__author__ = "Sculpture"
__version__ = "2021.05.30"

import rhinoscriptsyntax as rs

#import and do all this JAZZ!
import rhinoscriptsyntax as rs
import scriptcontext as sc
import ghpythonremote

re = sc.sticky['re']

text = 'peter piper picked a peck of pickled peppers'

print(re.findall('p.*?e.*?r', text)) #nonGreedy
print(re.findall('p.*e.*r', text)) #greedy
# ---------- end oneliners_greedynongreedyexception_005 ----------
panel_9 = Panel(oneliners_greedynongreedyexception_005.out)

oneliners_nongreedyexception_004 = OneLiners_nongreedyException_004()  # -> out, a
# ---------- oneliners_nongreedyexception_004: Python ----------
__author__ = "Sculpture"
__version__ = "2021.05.30"

import rhinoscriptsyntax as rs

#import and do all this JAZZ!
import rhinoscriptsyntax as rs
import scriptcontext as sc
import ghpythonremote

re = sc.sticky['re']

text = '<div>hello world</div>'

print(re.findall('<.*>', text))
print(re.findall('<.*?>', text))
# ---------- end oneliners_nongreedyexception_004 ----------

# ----
# nongreedy special note
panel_10 = Panel(oneliners_nongreedyexception_004.out)

# ---- group: All that JAZZ
# Base Script
# Jazz
ghpython_script = GhPythonScript()  # -> out, a
# ---------- ghpython_script: Python ----------
__author__ = "Sculpture"
__version__ = "2021.05.30"

import rhinoscriptsyntax as rs

#import and do all this JAZZ!
import rhinoscriptsyntax as rs
import scriptcontext as sc
import ghpythonremote

re = sc.sticky['re']
# ---------- end ghpython_script ----------

# ----
# 002
# Web Scraper
# the Basics:
# the methon urlopen() from the module urlib.request
# pulls the HTML source code from the
# specified URL
# decode() method converts type to str
# find() returns position of first occurence
# need to fix it though
# code the beginning and the end of what you want
# see example
# The Code
# searches for two str variables and checks if the query
# matches them
# How it Works:
# import re
# compile crypto(.{1,30})coin)
# () matches regex inside
# . matches an arbitrary char
# {1,30} matches between 1 and 30 regex occurances
# (.{1,30}) matches between 1 to 30 char
# crypto(.{1,30})coin matches three parts
# The pattern is compiled because python creates
# a pattern object that can be reused multiple times
# call match()
# see example
oneliners_webscraper_006 = OneLiners_webScraper_006()  # -> out, a
# ---------- oneliners_webscraper_006: Python ----------
__author__ = "Sculpture"
__version__ = "2021.05.30"

import rhinoscriptsyntax as rs

#import and do all this JAZZ!
import rhinoscriptsyntax as rs
import scriptcontext as sc
import ghpythonremote

re = sc.sticky['re']

"""     DO HOT RUN THIS SCRIPT UNLESS YOU IMPORT urllib.request 
        THRU THE ghpython remote node EXAMPLE ONLY
import urllib.request
search_phrase = 'crypto'
with urllib.request.urlopen('https://www.wired.com/' as response:
    html = response.read().decode("utf8") # convert to str
    first_pos = html.find(search_phrase)
    print(html[first_pos-10:first_pos+10])
"""

text_1 = "cryptographic skdjflsdj Bitcoin skdj sdfsdg sdfsdf sdfsdf sdfdfdsfsdffkjsd"
text_2 = "cryptographic skdjflsdj  skdfkj sdkfjkj sdkfjkj sd fkskdjfk sdfdsfsdfjsd"

#oneLiner
pattern = re.compile("crypto(.{1,30})coin")

print(pattern.match(text_1)) #doesn't look pretty in the output
print(pattern.match(text_2))
# ---------- end oneliners_webscraper_006 ----------
panel_11 = Panel(oneliners_webscraper_006.out)

# ----
# The Code
# HTML hyperlinks are enclosed in a <a></a> tag
# given a str, find the solution
# the Hyperlink is defined as the value of
# the href attribute
# set up the code example
# How It Works:
# HTML web pages stores as multiple strings
# re.findall
# nongreedily
# | either pattern
# nongreedily
# tuple is proudced, not str
# now let's look at matching groups
oneliners_analyzehyperlinkshtmldoc_008 = OneLiners_analyzeHyperlinksHTMLDoc_008()  # -> out, a
# ---------- oneliners_analyzehyperlinkshtmldoc_008: Python ----------
__author__ = "Sculpture"
__version__ = "2021.05.30"

import rhinoscriptsyntax as rs

#import and do all this JAZZ!
import rhinoscriptsyntax as rs
import scriptcontext as sc
import ghpythonremote

re = sc.sticky['re']

#data
page = '''
<!DOCTYPE html>
<html>
<body>

<h1>My Programming Links</h1>
<a href="https://app.finxter.com/">test your Python skills</a>
<a href="https://blog.finxter.com/recursion/">Learn recursion</a>
<a href="https://nostratch.com/">Great books from NoStartchPress</a>
<a href="https://finxter.com/">Solve more Python puzzles</a>

</body>
</html>
'''

#oneLiner
practice_tests = re.findall("(<a.*?finxter.*?(test|puzzle).*?>)", page)

#result
print(practice_tests)
# ---------- end oneliners_analyzehyperlinkshtmldoc_008 ----------
panel_12 = Panel(oneliners_analyzehyperlinkshtmldoc_008.out)

# ----
# Analyzing Hyperlinks of HTML Documents
# the Basics:
# We will look at many more regex
# dot regex
# asterisk regex <pattern> including zero match
# at-least-one regex <pattern>+
# zero-or-one regex <pattern>
# nongreedy asterisk regex *? matches the fewest
# regex <pattern>{m} exactly m copies
# regex <pattern>{m,n} match between m and n copies
# regex <pattern_1>|<pattern_2> matches patterns
# regex<pattern_1><pattern_2> matches _1 then _2
# regex (<pattern>) matches <pattern>
# () work like order of operations
# Three most important at:
# re.match(), re.search(), and re.findall()
# le's look more carefully...
oneliners_analyzehyperlinkshtmldoc_007 = OneLiners_analyzeHyperlinksHTMLDoc_007()  # -> out, a
# ---------- oneliners_analyzehyperlinkshtmldoc_007: Python ----------
__author__ = "Sculpture"
__version__ = "2021.05.30"

import rhinoscriptsyntax as rs

#import and do all this JAZZ!
import rhinoscriptsyntax as rs
import scriptcontext as sc
import ghpythonremote

re = sc.sticky['re']

text = '''
"One can never have enough socks", said Dumbledore.
"Another Christmas has come and gone and I didn't
get a single pair.  People will insist on giving me books."
Christmas Quote
'''

regex = 'Christ.*'

print(re.match(regex, text))

print(re.search(regex, text))

print(re.findall(regex, text))
# ---------- end oneliners_analyzehyperlinkshtmldoc_007 ----------
# 003
panel_13 = Panel(oneliners_analyzehyperlinkshtmldoc_007.out)

# ----
# The Code
# Find the $$$ signs
# How It Works:
# design the regex (\$[0-9]+(.[0-9]*)?)
# that matches the $ with escape
# matches the arbitrary digits between 0-9
# but atleast 1 digit
# Match the arbitrary # of digits after the "." char
# Then list comprehension to extract the 1st tuple value
# x[0] means you are only interested in the 1st item in the tuple
oneliners_extracting_fromstr_010b = OneLiners_extractingFromStr_010b()  # -> out, a
# ---------- oneliners_extracting_fromstr_010b: Python ----------
__author__ = "Sculpture"
__version__ = "2021.05.30"

import rhinoscriptsyntax as rs

#import and do all this JAZZ!
import rhinoscriptsyntax as rs
import scriptcontext as sc
import ghpythonremote

re = sc.sticky['re']

#data
report = '''
If you invested $1 in the year 1801, you would have $18087791.41 today.
This is a 7.967% return on investment.
But if you invested only $0.25 in 1801, you would end up with $4521947.8525.
'''

#oneLiner
dollars = [x[0] for x in re.findall('(\$[0-9]+(\.[0-9]*)?)', report)]

print(dollars)
#check it with this
print(('(\$[0-9]+(\.[0-9]*)?)', report))
# ---------- end oneliners_extracting_fromstr_010b ----------
oneliners_extracting_fromstr_010 = OneLiners_extractingFromStr_010()  # -> out, a
# ---------- oneliners_extracting_fromstr_010: Python ----------
__author__ = "Sculpture"
__version__ = "2021.05.30"

import rhinoscriptsyntax as rs

#import and do all this JAZZ!
import rhinoscriptsyntax as rs
import scriptcontext as sc
import ghpythonremote

re = sc.sticky['re']

#data
report = '''
If you invested $1 in the year 1801, you would have $18087791.41 today.
This is a 7.967% return on investment.
But if you invested only $0.25 in 1801, you would end up with $4521947.8525.
'''

#oneLiner
dollars = [x[0] for x in re.findall('(\$[0-9]+(\.[0-9]*)?)', report)]

print(dollars)
# ---------- end oneliners_extracting_fromstr_010 ----------
# 009
# Detecting Word Repetitions
# 010
# Modifying Regex patterns in a Multiline String
# SUMMARY:
# learned about regex
# matching patters in a str
# functions re.compile(), re.match(), re.search(), re.findall(), re.sub()
# high percentage use cases
# combining regex together
# whitespaces, escaped char, greedy/nongreedy operators
# character sets, neg char sets
# grouping and names groups
# learn to work with writing emails, blog articles, books, and code
# negative loady for next Chapter: Algorithms
panel_14 = Panel(oneliners_extracting_fromstr_010b.out)

# ----
# Extracting Dollars form a String
# the Basics:
# remember the prefix / to escape
# i.e. /( this way '(' loses it special meaning
# range [ ]  is used
# [0-9] for char "0", "1",... "9"
# [a - e] for char "a", "b", ... "e"
# (<pattern>) indicates group
# re.findall()
# hello(world) is different form (hello(world))
# first finds "helloworld" the
# second finds tuple ("helloworld", "world")
# 004
oneliners_extracting_fromstr_009 = OneLiners_extractingFromStr_009()  # -> out, a
# ---------- oneliners_extracting_fromstr_009: Python ----------
__author__ = "Sculpture"
__version__ = "2021.05.30"

import rhinoscriptsyntax as rs

#import and do all this JAZZ!
import rhinoscriptsyntax as rs
import scriptcontext as sc
import ghpythonremote

re = sc.sticky['re']

string = 'helloworld'

regex_1 = 'hello(world)'
regex_2 = '(hello(world))'

res_1 = re.findall(regex_1, string)
res_2 = re.findall(regex_2, string)

print(res_1)

print(res_2)
# ---------- end oneliners_extracting_fromstr_009 ----------
# 005
# Finding Nonsecure HTTP URLs
# 006
# Validating the Time Format of User Input, Part 1
# 007
# Validating the Time Format of User Input, Part 2
# 008
# Duplicating Detection in Strings
panel_15 = Panel(oneliners_extracting_fromstr_009.out)

# ==== cluster GHPythonRemote: Connects the Grasshopper Python component to an external Python instance.
python = PythonScript()  # -> gh_parent_doc_dir
# ---------- python: Python ----------
from os import path

gh_parent_doc_dir = path.abspath(path.dirname(ghenv.Component.OnPingDocument().Owner.OnPingDocument().FilePath))
# ---------- end python ----------
# GH to python remote example.
# Pierre Cuvilliers, 2017-2018
# Released under the MIT license
# github.com/pilcru/ghpythonremote
# Runs and connects to an external python engine, and
# assigns imported modules to scriptcontext.sticky variables.
# 
# Arguments:
#       code (str): Path to the GH_to_python_sticky.py code file.
#       location (str): Path to a python executable, or to a folder
#             containing `python.exe`, or the name of a conda-created
#             virtual environment prefixed by `conda://` (`conda://env_name`).
#             If empty, finds python from your windows %PATH%.
#       run (boolean): Creates the connection, and imports new
#             modules, when turned to True. Kills the connection,
#             and deletes the references to the imports, when turned
#             to False.
#       modules (str list): List of module names to import in the
#             remote python. They will be added to the
#             scriptcontext.sticky dictionary, allowing them to be
#             reused from other python components in the same
#             Grasshopper document. Submodules (for example
#             `numpy.linalg` have to be added explicitly to this list
#             to be available later.
#       log_level (str from ['NOTSET', 'DEBUG', 'INFO', 'WARNING', 'ERROR', 'CRITICAL']):
#             Logging level to use for the local IronPython and the
#             remote python instance.
#       working_dir (str): Working directory for the remote python
#             instance.
# 
# Returns:
#       out (str): Console output with DEBUG information.
#       linked_modules (str list): list of imported module names.
#       rpy (rpyc connection object): The object representing the
#             remote Python interpreter.
location = ClusterInput()  # location (str): Path to a python executable, or to a folder containing `python.exe`, or the name of a conda-created virtual environment prefixed by `conda://` (`conda://env_name`). If empty, finds python from your windows %PATH%.
run = ClusterInput()  # run (boolean): Creates the connection, and imports new modules, when turned to True. Kills the connection,and deletes the references to the imports, when turned to False.
modules = ClusterInput()  # modules (str list): List of module names to import in the remote python. They will be added to the scriptcontext.sticky dictionary, allowing them to be reused from other python components in the same Grasshopper document. Submodules (for example `numpy.linalg` have to be added explicitly to this list to be available later.
list = ValueList({"CRITICAL", "ERROR", "WARNING", "INFO", "DEBUG", "NOTSET"}, selected="DEBUG")
panel = Panel(python)
ghpythonremote = GHPythonRemote(location=location, run=run, modules=modules, log_level=list, working_dir=panel)  # -> out, linked_modules, rpy; inputs run: Boolean, modules: list
# ---------- ghpythonremote: Python ----------
import inspect
import logging
from os import path
import sys
from time import sleep

import scriptcontext

import ghpythonremote
from ghpythonremote.connectors import GrasshopperToPythonRemote

local_log_level = getattr(logging, log_level, logging.WARNING)
logger = logging.getLogger("ghpythonremote")
logger.setLevel(local_log_level)
ch = logging.StreamHandler()
ch.setLevel(local_log_level)
formatter = logging.Formatter("%(levelname)s: %(name)s:\n%(message)s")
ch.setFormatter(formatter)
logger.handlers = []
logger.addHandler(ch)
logger = logging.getLogger("ghpythonremote.GH_to_python")

ROOT = path.abspath(path.dirname(inspect.getfile(ghpythonremote)))
rpyc_server_py = path.join(ROOT, "pythonservice.py")

# Set connection to CLOSED if this is the first run
# and initialize set of linked modules
try:
    remote_python_status
except NameError:
    remote_python_status = "CLOSED"
    lkd_modules = set()

# Wait for connection to connect or terminate
timer = 0
while remote_python_status == "CONNECTING" or remote_python_status == "CLOSING":
    sleep(1)
    timer += 1
    if timer == 10:
        try:
            gh2py_manager.__exit__(*sys.exc_info())
        except Exception:
            pass
        remote_python_status = "CLOSED"
        lkd_modules = set()
        raise RuntimeError(
            "Connection left in an inconsistent state and not returning. Reset "
            "everything."
        )

if run:
    if not remote_python_status == "OPEN":
        remote_python_status = "CONNECTING"
        gh2py_manager = GrasshopperToPythonRemote(
            rpyc_server_py,
            location=location,
            timeout=10,
            port=None,
            log_level=log_level,
            working_dir=working_dir,
        )
        gh2py = gh2py_manager.__enter__()
        remote_python_status = "OPEN"

    # Stuff that we can reach
    rpymod = gh2py.py_remote_modules  # A getter function for a named python module
    rpy = gh2py.connection  # Represents the remote instance root object
    scriptcontext.sticky["rpy"] = rpy
    # Add modules
    for mod in modules:
        try:
            scriptcontext.sticky[mod] = rpymod(mod)
            lkd_modules.add(mod)
        except ImportError:
            gh2py_manager.__exit__(*sys.exc_info())
            raise

elif not remote_python_status == "CLOSED":
    remote_python_status = "CLOSING"
    # Remove linked modules
    for mod in lkd_modules:
        del scriptcontext.sticky[mod]
    del scriptcontext.sticky["rpy"]
    gh2py_manager.__exit__(*sys.exc_info())
    lkd_modules = set()
    remote_python_status = "CLOSED"

# Change variable name because ghpython resets outputs to None before each run
linked_modules = lkd_modules

logger.info("GH to python connection is {}".format(remote_python_status))
# ---------- end ghpythonremote ----------
out = ClusterOutput(ghpythonremote.out)  # Console output.
linked_modules = ClusterOutput(ghpythonremote.linked_modules)  # Names of modules that were successfully added to the scriptcontext.sticky dictionary.
rpy = ClusterOutput(ghpythonremote.rpy)  # The object representing the remote python instance
python_2 = PythonScript(module_names=ghpythonremote.linked_modules)  # -> import_statements; inputs module_names: list
# ---------- python_2: Python ----------
import_statements = ["import scriptcontext as sc"]
for module_name in module_names:
    import_statements.append("{0} = sc.sticky['{0}']".format(module_name))

if len(module_names) == 0:
    import_statements = []
# ---------- end python_2 ----------
import_statements = ClusterOutput(python_2)  # Useful import statements to use the imported modules in your scripts.
