# Grasshopper definition ADVANCED__ALGORITHMS_palindromes_002.gh (Grasshopper 1.0.7)
# plug-ins: Bifocals

# ----
# Branch
# Managment
# Script
number_slider = Slider(7, range=0..10)
# ALGORITHMS:
# is a set of instructions
# The Growing Ubiquity of Algorithms in Society:
# Implications, Impacts, and Innovations
# Note: Introduction to Algorithms by Thomas Cormen et al.
# MIT Press, 2009
number_slider_2 = Slider(6, range=0..10)
# ghPython oneLiners__Advanced ALGORITHMS
number_slider_3 = Slider(5, range=0..10)
oneliners_intadvanced_branchmanagment_00 = OneLiners_intAdvanced_branchManagment_001(
    numPaths=number_slider_3,
    startBranch=Slider(3, range=0..10),
    stopBranch=number_slider,
    stepBranch=Slider(3, range=0..10),
    numItems=number_slider_2)  # -> out, nest, paths, a, b; inputs numPaths: Int32, startBranch: Int32, stopBranch: Int32, numItems: Int32
# ---------- oneliners_intadvanced_branchmanagment_00: Python ----------
##################################################
import random
import Grasshopper.Kernel.Data.GH_Path as ghpath
import Grasshopper.DataTree as datatree 
import System
import ghpythonlib.components as ghc
import rhinoscriptsyntax as rs
import Rhino.Geometry as rg
##################################################

nest = datatree[System.Object]() #the tree
paths = datatree[System.Object]()
for Alpha_path in range(numPaths): # numPaths Alpha paths
    for Beta_branch in range(random.randrange(startBranch,stopBranch,stepBranch)): #each gets random number of beta branchs
        paths.Add( (ghpath(Alpha_path,Beta_branch)),ghpath(Alpha_path))#add full_path name to Alph path
        for item in range(numItems):# each path has (numItems) numbers
            nest.Add(item, ghpath(Alpha_path,Beta_branch)) # assign number to given path

#how to call all Beta Branchs from Alpha path (zero) ??
for path in paths.Branch(0):
    print path
    print nest.Branch(ghpath(path))

a = nest
b = paths
# ---------- end oneliners_intadvanced_branchmanagment_00 ----------
panel = Panel(oneliners_intadvanced_branchmanagment_00.out)
panel_2 = Panel(oneliners_intadvanced_branchmanagment_00.paths)
viewer = ParamViewer(oneliners_intadvanced_branchmanagment_00.nest)

# ----
# 001
# Finding Anagrams with Lambda() and Sorting
# The Basics:
# listen -> silent
# funeral -> real fun
# elvis -> lives
# asymptomatically grows like the function
# n log(n)
# check out histogramming
oneliners_findinganagramswithlambda_ands = OneLiners_findingAnagramsWithLambdaAndSort_001()  # -> out, a
# ---------- oneliners_findinganagramswithlambda_ands: Python ----------
__author__ = "Sculpture"
__version__ = "2021.06.14"

import rhinoscriptsyntax as rs

#oneLiner
is_anagram = lambda x1, x2: sorted(x1) == sorted(x2)

print(is_anagram("elvis", "lives"))

print(sorted("elvis"))
print(sorted("lives"))
# ---------- end oneliners_findinganagramswithlambda_ands ----------
panel_3 = Panel(oneliners_findinganagramswithlambda_ands.out)

# ----
# Finding Palindromes with Lambda() and Neg Slicing
# The Basics:
# 002
oneliners_findinganagramswithlambda_ands_2 = OneLiners_findingAnagramsWithLambdaAndSort_001()  # -> out, a
# ---------- oneliners_findinganagramswithlambda_ands_2: Python ----------
__author__ = "Sculpture"
__version__ = "2021.06.14"

import rhinoscriptsyntax as rs

#oneLiner
#is_anagram = lambda x1, x2: sorted(x1) == sorted(x2)
# ---------- end oneliners_findinganagramswithlambda_ands_2 ----------
panel_4 = Panel(oneliners_findinganagramswithlambda_ands_2.out)
