# Grasshopper definition ADVANCED__recursiveBinarySearchAlgorithm_009.gh (Grasshopper 1.0.7)
# plug-ins: Bifocals

# ----
# Branch
# Managment
# Script
number_slider = Slider(7, range=0..10)
# ALGORITHMS:
# is a set of instructions
# The Growing Ubiquity of Algorithms in Society:
# Implications, Impacts, and Innovations
# Note: Introduction to Algorithms by Thomas Cormen et al.
# MIT Press, 2009
number_slider_2 = Slider(6, range=0..10)
# ghPython oneLiners__Advanced ALGORITHMS
number_slider_3 = Slider(5, range=0..10)
oneliners_intadvanced_branchmanagment_00 = OneLiners_intAdvanced_branchManagment_001(
    numPaths=number_slider_3,
    startBranch=Slider(3, range=0..10),
    stopBranch=number_slider,
    stepBranch=Slider(3, range=0..10),
    numItems=number_slider_2)  # -> out, nest, paths, a, b; inputs numPaths: Int32, startBranch: Int32, stopBranch: Int32, numItems: Int32
# ---------- oneliners_intadvanced_branchmanagment_00: Python ----------
##################################################
import random
import Grasshopper.Kernel.Data.GH_Path as ghpath
import Grasshopper.DataTree as datatree 
import System
import ghpythonlib.components as ghc
import rhinoscriptsyntax as rs
import Rhino.Geometry as rg
##################################################

nest = datatree[System.Object]() #the tree
paths = datatree[System.Object]()
for Alpha_path in range(numPaths): # numPaths Alpha paths
    for Beta_branch in range(random.randrange(startBranch,stopBranch,stepBranch)): #each gets random number of beta branchs
        paths.Add( (ghpath(Alpha_path,Beta_branch)),ghpath(Alpha_path))#add full_path name to Alph path
        for item in range(numItems):# each path has (numItems) numbers
            nest.Add(item, ghpath(Alpha_path,Beta_branch)) # assign number to given path

#how to call all Beta Branchs from Alpha path (zero) ??
for path in paths.Branch(0):
    print path
    print nest.Branch(ghpath(path))

a = nest
b = paths
# ---------- end oneliners_intadvanced_branchmanagment_00 ----------
panel = Panel(oneliners_intadvanced_branchmanagment_00.out)
panel_2 = Panel(oneliners_intadvanced_branchmanagment_00.paths)
viewer = ParamViewer(oneliners_intadvanced_branchmanagment_00.nest)

# ----
# 001
# Finding Anagrams with Lambda() and Sorting
# The Basics:
# listen -> silent
# funeral -> real fun
# elvis -> lives
# asymptomatically grows like the function
# n log(n)
# check out histogramming
oneliners_findinganagramswithlambda_ands = OneLiners_findingAnagramsWithLambdaAndSort_001()  # -> out, a
# ---------- oneliners_findinganagramswithlambda_ands: Python ----------
__author__ = "Sculpture"
__version__ = "2021.06.14"

import rhinoscriptsyntax as rs

#oneLiner
is_anagram = lambda x1, x2: sorted(x1) == sorted(x2)

print(is_anagram("elvis", "lives"))

print(sorted("elvis"))
print(sorted("lives"))
# ---------- end oneliners_findinganagramswithlambda_ands ----------
panel_3 = Panel(oneliners_findinganagramswithlambda_ands.out)

# ----
# Finding Palindromes with Lambda() and Neg Slicing
# The Basics:
# slicing
# [start:stop:step]
# 002
oneliners_findingpalindromeswithlambda_n = OneLiners_findingPalindromesWithLambdaNegSlicing_002()  # -> out, a
# ---------- oneliners_findingpalindromeswithlambda_n: Python ----------
__author__ = "Sculpture"
__version__ = "2021.06.14"

import rhinoscriptsyntax as rs

#oneLiner
is_palindrome = lambda phrase: phrase == phrase[::-1]

print(is_palindrome("anna"))
# ---------- end oneliners_findingpalindromeswithlambda_n ----------
panel_4 = Panel(oneliners_findingpalindromeswithlambda_n.out)

# ----
# 003
# Counting Permutations with Recursive Factorial Functions
# The Basics:
# factorial n!
# recursive definition
# How it Works:
# it works by recursion function
# try writing it without it nor external libraries
number_slider_4 = Slider(5, range=0..10)
oneliners_countingpermutationswithrecurs = OneLiners_countingPermutationsWithRecursiveFactorial_003(n=number_slider_4)  # -> out, a; inputs n: Int32
# ---------- oneliners_countingpermutationswithrecurs: Python ----------
__author__ = "Sculpture"
__version__ = "2021.06.14"

import rhinoscriptsyntax as rs

#data
#n = 5

#oneLiner
factorial = lambda n: n * factorial(n-1) if n > 1 else 1

#result
print(factorial(n))
# ---------- end oneliners_countingpermutationswithrecurs ----------
panel_5 = Panel(oneliners_countingpermutationswithrecurs.out)

# ----
# Finding the Levenshtein Distance
# The Basics:
# 004
oneliners_findinglevenshteindistance_004 = OneLiners_findingLevenshteinDistance_004()  # -> out, a
# ---------- oneliners_findinglevenshteindistance_004: Python ----------
__author__ = "Sculpture"
__version__ = "2021.06.14"

import rhinoscriptsyntax as rs

#data
a = "cat"
b = "chello"
c = "chess"

#oneLiner
ls = lambda a, b: len(b) if not a else len(a) if not b else min(ls(a[1:], b[1:])+(a[0] != b[0]),ls(a[1:], b)+1,ls(a, b[1:])+1)

#results
print(ls(a,b))
print(ls(a,c))
print(ls(b,c))
# ---------- end oneliners_findinglevenshteindistance_004 ----------
# 005
panel_6 = Panel(oneliners_findinglevenshteindistance_004.out)

# ----
# Calculating the Powerset by Using
# Functional Programming
# The Basics:
# THE SET OF ALL SUBSETS
oneliners_calculatingpowerset_005 = OneLiners_calculatingPowerset_005()  # -> out, a
# ---------- oneliners_calculatingpowerset_005: Python ----------
__author__ = "Sculpture"
__version__ = "2021.06.14"

import rhinoscriptsyntax as rs
from functools import reduce

#data
s = {1, 2, 3}

#oneLiner
ps = lambda s: reduce(lambda P, x: P + [subset | {x} for subset in P], s, [set()])

#result
print(ps(s))
# ---------- end oneliners_calculatingpowerset_005 ----------
panel_7 = Panel(oneliners_calculatingpowerset_005.out)

# ----
# Caesar's Ciper Encryption Using
# Advanced Indexing and List Comprehension
# The Basics:
# ancient encryption technique
# 006
oneliners_caesarscipherencriptionadvinde = OneLiners_caesarsCipherEncriptionAdvIndexingListComp_006()  # -> out, a
# ---------- oneliners_caesarscipherencriptionadvinde: Python ----------
__author__ = "Sculpture"
__version__ = "2021.06.14"

import rhinoscriptsyntax as rs
from functools import reduce

#data
abc = "abcdefghijklmnopqrstuvwxyz"
s = "xthexrussiansarexcoming"

#oneLiner
rt13 = lambda x: "".join([abc[(abc.find(c) + 13) % 26] for c in x])

#result
print(rt13(s))
print(rt13(rt13(s)))
# ---------- end oneliners_caesarscipherencriptionadvinde ----------
panel_8 = Panel(oneliners_caesarscipherencriptionadvinde.out)

# ----
# 007
# Finding Prime #s with the Sieve of Eratosthenes
# The Basics:
# root out all prime numbers form a range of numbers
oneliners_naiveckeckonprimenumbers_007 = OneLiners_naiveCkeckOnPrimeNumbers_007()  # -> out, a
# ---------- oneliners_naiveckeckonprimenumbers_007: Python ----------
__author__ = "Sculpture"
__version__ = "2021.06.14"

import rhinoscriptsyntax as rs

def prime(n):
    for i in range(2,n):
        if n % i == 0:
            return False
    return True
    
print(prime(10))
print(prime(11))
print(prime(7919))
# ---------- end oneliners_naiveckeckonprimenumbers_007 ----------
oneliners_sieveoferastothenes_009 = OneLiners_sieveOfErastothenes_009()  # -> out, a
# ---------- oneliners_sieveoferastothenes_009: Python ----------
__author__ = "Sculpture"
__version__ = "2021.06.14"

import rhinoscriptsyntax as rs

from functools import reduce

#data
n = 1000

#oneLiner
primes = reduce(lambda r, x: r - set(range(x**2, n, x)) if x in r else r, range(2, int(n**0.5) + 1), set(range(2, n)))

print(primes)
# ---------- end oneliners_sieveoferastothenes_009 ----------
oneliners_findprimesuptomax_m__008 = OneLiners_findPrimesUpToMaxM_008()  # -> out, a
# ---------- oneliners_findprimesuptomax_m__008: Python ----------
__author__ = "Sculpture"
__version__ = "2021.06.14"

import rhinoscriptsyntax as rs

def prime(n):
    for i in range(2,n):
        if n % i == 0:
            return False
    return True

#find all prime numbers <= m
m = 20
primes = [n for n in range(2,m+1) if prime(n)]

print(primes)
# ---------- end oneliners_findprimesuptomax_m__008 ----------
panel_9 = Panel([oneliners_naiveckeckonprimenumbers_007.out, oneliners_findprimesuptomax_m__008.out])
panel_10 = Panel(oneliners_sieveoferastothenes_009.out)

# ----
# 008
# Calculating the Fibonacci Series with reduce() Function
# The Basics:
# Math Art Biology
oneliners_calculatingfibonacciserieswtih = OneLiners_calculatingFibonacciseriesWtihReduce_010()  # -> out, a
# ---------- oneliners_calculatingfibonacciserieswtih: Python ----------
__author__ = "Sculpture"
__version__ = "2021.06.14"

import rhinoscriptsyntax as rs

from functools import reduce

#data
n = 10

#oneLiner
fibs = reduce(lambda x, _: x + [x[-2] + x[-1]], [0] * (n - 2), [ 0,1])

#result
print(fibs)
# ---------- end oneliners_calculatingfibonacciserieswtih ----------
panel_11 = Panel(oneliners_calculatingfibonacciserieswtih.out)

# ----
# 009
# A Recursive Binary Search Algorithm
# The Basics:
# Basic binary search algorithm
oneliners_recursivebinarysearchalgorithm = OneLiners_recursiveBinarySearchAlgorithm_011()  # -> out, a
# ---------- oneliners_recursivebinarysearchalgorithm: Python ----------
__author__ = "Sculpture"
__version__ = "2021.06.14"

import rhinoscriptsyntax as rs

def binary_search(lst, value):
    lo, hi = 0, len(lst)-1
    while lo <= hi:
        mid = (lo + hi) // 2
        if lst[mid] < value:
            lo = mid + 1
        elif value < lst[mid]:
            hi = mid - 1
        else:
            return mid
    return -1

#data
lst = [3, 6, 14, 16, 33, 55, 56, 89]
x = 56
print(binary_search(lst, x))
# ---------- end oneliners_recursivebinarysearchalgorithm ----------
oneliners_recursivebinarysearchalgorithm_2 = OneLiners_recursiveBinarySearchAlgorithm_012()  # -> out, a
# ---------- oneliners_recursivebinarysearchalgorithm_2: Python ----------
__author__ = "Sculpture"
__version__ = "2021.06.14"

import rhinoscriptsyntax as rs

## The Data
l = [3, 6, 14, 16, 33, 55, 56, 89]
x = 33
## The One-Liner
bs = lambda l, x, lo, hi: -1 if lo>hi else \
(lo+hi)//2 if l[(lo+hi)//2] == x else \
bs(l, x, lo, (lo+hi)//2-1) if l[(lo+hi)//2] > x else \
bs(l, x, (lo+hi)//2+1, hi)
## The Results
print(bs(l, x, 0, len(l)-1))
# ---------- end oneliners_recursivebinarysearchalgorithm_2 ----------
panel_12 = Panel(oneliners_recursivebinarysearchalgorithm.out)
panel_13 = Panel(oneliners_recursivebinarysearchalgorithm_2.out)

# ----
# 010
# Recursive Quicksort Algorithm
# The Basics:
# Basic binary search algorithm
oneliners_recursivebinarysearchalgorithm_3 = OneLiners_recursiveBinarySearchAlgorithm_011()  # -> out, a
# ---------- oneliners_recursivebinarysearchalgorithm_3: Python ----------
__author__ = "Sculpture"
__version__ = "2021.06.14"

import rhinoscriptsyntax as rs

def binary_search(lst, value):
    lo, hi = 0, len(lst)-1
    while lo <= hi:
        mid = (lo + hi) // 2
        if lst[mid] < value:
            lo = mid + 1
        elif value < lst[mid]:
            hi = mid - 1
        else:
            return mid
    return -1

lst = [3, 6, 14, 16, 33, 55, 56, 89]
x = 56
print(binary_search(lst, x))
# ---------- end oneliners_recursivebinarysearchalgorithm_3 ----------
panel_14 = Panel(oneliners_recursivebinarysearchalgorithm_3.out)
