# Grasshopper definition BASIC_INTERMEDIATE_listComprehension_001.gh (Grasshopper 1.0.7)
# plug-ins: Bifocals

geometry = Geometry([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])
pipe = Pipe(Curve=reparameterize(geometry), Radius=Slider(0.3, range=0..1), Caps=2)
dispatch = Dispatch(List=flatten(pipe), DispatchPattern=[True, False])  # -> ListA, ListB
geometry_2 = Geometry(dispatch.ListA)
# oneLiners_Basic_Intermediate
# comprehension, file access, the map() function, the Lambda function, the reduce()
#  function, slicing, slice assignment, generator functions, zip() funciton
# comprehension
oneliners_listcomprehension_001 = OneLiners_listcomprehension_001()  # -> out, a
# ---------- oneliners_listcomprehension_001: Python ----------
__author__ = "Sculpture"
__version__ = "2021.05.27"

import rhinoscriptsyntax as rs

#list comprehension

personsOfInterest = {"Batman": 75, 
                    "Joker": 95, 
                    "Penguin": 34,
                    "Cat Woman": 58, 
                    "the Riddler": 100}
                    
favorites = [] #create a list ot output to
for key, val in personsOfInterest.items():
    if val >= 75:
        favorites.append((key,val))

print(favorites)
a = favorites

# now let's look at List comprehension
#[expression + context]
# example [x * 2 for x in range(3) outputs [0, 2, 4]
# ---------- end oneliners_listcomprehension_001 ----------
panel = Panel(oneliners_listcomprehension_001.out)
panel_2 = Panel(oneliners_listcomprehension_001.a)
# comprehension
# examples
ghpython_script = GhPythonScript()  # -> Out, A
