# Grasshopper definition BASIC_INTERMEDIATE_slicedFilesToCorrectCorrupt_008.gh (Grasshopper 1.0.7)
# plug-ins: Bifocals

number_slider = Slider(18, range=0..100)
panel = Panel("""Fantastic
Wonderful
Perfect""")

# ----
# slicing to extract
# substring environments
number_slider_2 = Slider(11, range=0..40)
panel_2 = Panel()
oneliners_slicingtoextract_006 = OneLiners_slicingToExtract_006(x=panel_2, len=number_slider_2)  # -> out, a, b, c, d, e, f, g, h, i; inputs len: Int32
# ---------- oneliners_slicingtoextract_006: Python ----------
__author__ = "Sculpture"
__version__ = "2021.05.28"

import rhinoscriptsyntax as rs

#slicing is the basis of many advanced Python libraries such as
#NumPy, Pandas, TensorFlow, scikit-learn

#a[start:stop:step]

a = (x[0:len])
b = (x[len:0])
c = (x[:len])
d = (x[len:])
e = (x[:100])
f = (x[0:24:2])
g = (x[::4])
h = (x[::-1]) #reverse string
i = (x[16:1:-1])
# ---------- end oneliners_slicingtoextract_006 ----------
panel_3 = Panel([oneliners_slicingtoextract_006.a, oneliners_slicingtoextract_006.b, oneliners_slicingtoextract_006.c, oneliners_slicingtoextract_006.d, oneliners_slicingtoextract_006.e, oneliners_slicingtoextract_006.f, oneliners_slicingtoextract_006.g, oneliners_slicingtoextract_006.h, oneliners_slicingtoextract_006.i])

panel_4 = Panel("""doo doo
doo doo
doo doo""")
# oneLiners_Basic_Intermediate
# comprehension, file access, the map() function, the Lambda function, the reduce()
#  function, slicing, slice assignment, generator functions, zip() funciton
geometry = Geometry([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])
# Slice Assignment to
# Correct Corrupt Files
number_slider_3 = Slider(0.5, range=0..1)
pipe = Pipe(Curve=reparameterize(geometry), Radius=Slider(0.3, range=0..1), Caps=2)
dispatch = Dispatch(List=flatten(pipe), DispatchPattern=[True, False])  # -> ListA, ListB
geometry_2 = Geometry(dispatch.ListA)
repeat_data = RepeatData(Data=panel_4, Length=number_slider)
repeat_data_2 = RepeatData(Data=panel, Length=number_slider)

# ----
# comprehension
# Find Words
oneliners_comprehensionwordfind_003 = OneLiners_comprehensionWordFind_003()  # -> out, a
# ---------- oneliners_comprehensionwordfind_003: Python ----------
__author__ = "Sculpture"
__version__ = "2021.05.28"

import rhinoscriptsyntax as rs

poem = """She's an odd little dittle in a big brown 
fiddle and when she's tuned to play, the kids will 
play an the little brown fox will dance around the 
big old fashioned warehouse."""

#OneLiner
#creates a list of words more than 4 letters
#creates a list of lists separated by new lines
a = [[x for x in line.split() if len(x)>4] for line in poem.split('\n')]
print(a)
# ---------- end oneliners_comprehensionwordfind_003 ----------
panel_5 = Panel(oneliners_comprehensionwordfind_003.out)

# ----
# comprehension
# take your time to really
#  understand LIST COMPREHENSION
# #EXPRESSION AND CONTEXT
oneliners_listcomprehension_001 = OneLiners_listcomprehension_001()  # -> out, a
# ---------- oneliners_listcomprehension_001: Python ----------
__author__ = "Sculpture"
__version__ = "2021.05.27"

import rhinoscriptsyntax as rs

#list comprehension

personsOfInterest = {"Batman": 75, 
                    "Joker": 95, 
                    "Penguin": 34,
                    "Cat Woman": 58, 
                    "the Riddler": 100}
                    
favorites = [] #create a list ot output to
for key, val in personsOfInterest.items():
    if val >= 75:
        favorites.append((key,val))

print(favorites)
a = favorites

# now let's look at List comprehension
#[expression + context]
# example [x * 2 for x in range(3) outputs [0, 2, 4]
# ---------- end oneliners_listcomprehension_001 ----------
panel_6 = Panel(oneliners_listcomprehension_001.out)
panel_7 = Panel(oneliners_listcomprehension_001.a)

jitter = Jitter(List=repeat_data_2, Jitter=number_slider_3, Seed=2)  # -> Values, Indices
weave = Weave(Pattern=[0, 1], Stream0=jitter.Values, Stream1=repeat_data, NullGaps=False)  # -> flatten(Weave)
panel_8 = Panel(weave)

# ----
# find method with Lambda
number_slider_4 = Slider(6, range=0..10)
oneliners_slicingfindwithlambda_007 = OneLiners_slicingFindWithLambda_007(count=number_slider_4)  # -> out, a; inputs count: Int32
# ---------- oneliners_slicingfindwithlambda_007: Python ----------
__author__ = "Sculpture"
__version__ = "2021.05.28"

import rhinoscriptsyntax as rs

#string.find(Value)

#Data
DowJones = """
The Dow Jones Industrial Average, Dow Jones, 
or simply the Dow, is a stock market index that 
measures the stock performance of 30 large companies 
listed on stock exchanges in the United States.
"""

#oneLiner
find = lambda x, q: x[x.find(q)-count:x.find(q)+count] if q in x else -1
print(find(DowJones, "per"))

a = (find(DowJones, "per"))
# ---------- end oneliners_slicingfindwithlambda_007 ----------
panel_9 = Panel(oneliners_slicingfindwithlambda_007.out)
panel_10 = Panel(oneliners_slicingfindwithlambda_007.a)

file_path = FilePath("C:\Program Files\Rhino 7\System\readFileDefault.py")
oneliners_listcomprehensionreadingfile_0 = OneLiners_listComprehensionReadingFile_004(x=file_path)  # -> out, a
# ---------- oneliners_listcomprehensionreadingfile_0: Python ----------
__author__ = "Sculpture"
__version__ = "2021.05.28"

import rhinoscriptsyntax as rs

print([line.strip() for line in open("readFileDefault.py")])

print([line.strip() for line in open(x)])
# ---------- end oneliners_listcomprehensionreadingfile_0 ----------

# ----
# comprehension
# Reading a File
panel_11 = Panel(oneliners_listcomprehensionreadingfile_0.out)
panel_12 = Panel(file_path)

oneliners_slicingassignmenttocorrectcorr = OneLiners_slicingAssignmentToCorrectCorrupt_009(x=panel_8)  # -> out, a; inputs x: list
# ---------- oneliners_slicingassignmenttocorrectcorr: Python ----------
__author__ = "Sculpture"
__version__ = "2021.05.28"

import rhinoscriptsyntax as rs

#using slice assignment to correct corrupted lists
#feature: slice assignment
#select and replace a sequence of elements between indices i and j by using notation 1st[i:j] = [0 0 ...0]
#replace all selected elements in the original sequence on the lt with the elements on the rt

#Data x


x[1::2] = x[::2]

print(x)
# ---------- end oneliners_slicingassignmenttocorrectcorr ----------
panel_13 = Panel(oneliners_slicingassignmenttocorrectcorr.out)

# ----
# list comprehension
# with slicing
number_slider_5 = Slider(1, range=0..1)
number_slider_6 = Slider(110, range=0..110)
series = Series(Start="1", Step=number_slider_5, Count=number_slider_6)
series_2 = Series(Start="1", Step=number_slider_5, Count=number_slider_6)
addition = Addition(A=series_2, B=graft(series))
jitter_2 = Jitter(List=addition, Jitter=Slider(0.48, range=0..1), Seed=2)  # -> Values, Indices
panel_14 = Panel(jitter_2.Values)
oneliners_listcomprehensionwithslicing_0 = OneLiners_listComprehensionWithSlicing_008(x=jitter_2.Values, freq=Slider(10, range=0..10))  # -> out; inputs x: list, freq: Int32
# ---------- oneliners_listcomprehensionwithslicing_0: Python ----------
__author__ = "Sculpture"
__version__ = "2021.05.28"

import rhinoscriptsyntax as rs

#combining List Comprehension and Slicing
#2 dimensional data sets
# create a smaller but relevant sample of data

#oneLiner
price = [x]

sample = [line[::freq] for line in price]
print(sample)
# ---------- end oneliners_listcomprehensionwithslicing_0 ----------
panel_15 = Panel(oneliners_listcomprehensionwithslicing_0)

# ----
# comprehension
# examples
oneliners_listcomprehensionexamples_002 = OneLiners_listComprehensionExamples_002()  # -> out, a, b, c, d, favorites
# ---------- oneliners_listcomprehensionexamples_002: Python ----------
__author__ = "Sculpture"
__version__ = "2021.05.27"

import rhinoscriptsyntax as rs

#1
a = ([x for x in range(4)])
#2
b = ([(x,y) for x in range(3) for y in range(3)])
#3
c = ([x ** 2 for x in range(10) if x % 2 < 1])
#4
d = ([x.lower() for x in ["MICHAEL", "DAVID", "WICKERSON"]])

#try the previous script again
personsOfInterest = {"Batman": 75, 
                    "Joker": 95, 
                    "Penguin": 34,
                    "Cat Woman": 58, 
                    "the Riddler": 100}
                    
#ONELINER!!!
favorites = [(k, v) for k, v in personsOfInterest.items() if v >= 75]

#take your time to really understand LIST COMPREHENSION
#EXPRESSION AND CONTEXT
# ---------- end oneliners_listcomprehensionexamples_002 ----------
panel_16 = Panel(oneliners_listcomprehensionexamples_002.favorites)
panel_17 = Panel([oneliners_listcomprehensionexamples_002.a, oneliners_listcomprehensionexamples_002.b])
panel_18 = Panel([oneliners_listcomprehensionexamples_002.c, oneliners_listcomprehensionexamples_002.d])

# ----
# Lambda and Map Functions
# returning to calling environment
oneliners_lambdaandmapfunctions_005 = OneLiners_LambdaAndMapFunctions_005()  # -> out, check, check2
# ---------- oneliners_lambdaandmapfunctions_005: Python ----------
__author__ = "Sculpture"
__version__ = "2021.05.28"

import rhinoscriptsyntax as rs

#lambda arguments : return expression
#lambda x, y: x + y

#Data
txt = ['The quick brown fox ',
        'jumps over the ',
        'lazy dog.']

#oneLiner
check = map(lambda s: (True, s) if 'jumps' in s else (False, s), txt)

#lambda functions are anonymous functions
#anonymous functions don't have a name
#functions are objects in Python

print(list(check))

#use list comprehension rather than map()

check2 = [(True, s) if 'quick' in s else (False, s) for s in txt]
# ---------- end oneliners_lambdaandmapfunctions_005 ----------
panel_19 = Panel(oneliners_lambdaandmapfunctions_005.check)
panel_20 = Panel(oneliners_lambdaandmapfunctions_005.out)
panel_21 = Panel(oneliners_lambdaandmapfunctions_005.check2)
