# Grasshopper definition strings_004.gh (Grasshopper 1.0.7)
# plug-ins: Bifocals

geometry = Geometry([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])
pipe = Pipe(Curve=reparameterize(geometry), Radius=Slider(0.3, range=0..1), Caps=2)
dispatch = Dispatch(List=flatten(pipe), DispatchPattern=[True, False])  # -> ListA, ListB
# container data structures
# lists
geometry_2 = Geometry(dispatch.ListA)

# ----
# oneLiners_Basic
# squares
number_slider = Slider(2, range=0..5)
oneliner_squares = OneLiner_squares(x=number_slider, y=Slider(3, range=0..5))  # -> out, squares; inputs x: Int32, y: Int32
# ---------- oneliner_squares: Python ----------
__author__ = "Sculpture"
__version__ = "2021.05.23"

import rhinoscriptsyntax as rs

#before
squares = []
        
for i in range(10):
    squares.append(i**x) 
        
#after oneliner
print([i**y for i in range(10)])
# ---------- end oneliner_squares ----------
panel = Panel(oneliner_squares.out)
panel_2 = Panel(oneliner_squares.squares)

# ----
# data structures
number_slider_2 = Slider(3, range=0..10)
oneliner_datastructures = OneLiner_dataStructures(x=number_slider_2, y=Slider(5, range=0..10))  # -> out, add, minus, times, divide, divideDown, modulus, negative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; inputs x: Int32, y: Int32
# ---------- oneliner_datastructures: Python ----------
__author__ = "Sculpture"
__version__ = "2021.05.23"

import rhinoscriptsyntax as rs

add = x + y
minus = x - y
times = x * y
divide = x / y
divideDown = x // y
modulus = x % y
negative = -x
castInt = int(3.9)
castFloat = float(x) #strange, works in output but not in castFloat output
print(x)
print(float(x))

exponent = x ** y
# ---------- end oneliner_datastructures ----------
panel_3 = Panel(oneliner_datastructures.castFloat)
panel_4 = Panel(oneliner_datastructures.out)
panel_5 = Panel(oneliner_datastructures.add)
panel_6 = Panel(oneliner_datastructures.times)
panel_7 = Panel(oneliner_datastructures.divideDown)
panel_8 = Panel(oneliner_datastructures.negative)
panel_9 = Panel(oneliner_datastructures.minus)
panel_10 = Panel(oneliner_datastructures.modulus)
panel_11 = Panel(oneliner_datastructures.castInt)
panel_12 = Panel(oneliner_datastructures.divide)
panel_13 = Panel(oneliner_datastructures.exponent)

# ----
# booleans
number_slider_3 = Slider(3, range=0..10)
number_slider_4 = Slider(5, range=0..10)
oneliner_booleans = OneLiner_booleans(x=number_slider_3, y=number_slider_4)  # -> out, a, b, e, f, g; inputs x: Int32, y: Int32
# ---------- oneliner_booleans: Python ----------
__author__ = "Sculpture"
__version__ = "2021.05.24"

import rhinoscriptsyntax as rs

a = x < y
b = x > y

c, d = True, False

e = (c or d) == True
f = (c and d) == False
g = (not d) == True

print(e)
print(f)
print(g)
# ---------- end oneliner_booleans ----------
panel_14 = Panel(oneliner_booleans.out)
panel_15 = Panel([oneliner_booleans.a, oneliner_booleans.b])
panel_16 = Panel([oneliner_booleans.e, oneliner_booleans.f, oneliner_booleans.g])

oneliner_booleans_002 = OneLiner_booleans_002(x=number_slider_3, y=number_slider_4, c=Toggle(False), d=Toggle(False))  # -> out, a, b, e, f, g; inputs x: Int32, y: Int32, c: Boolean, d: Boolean
# ---------- oneliner_booleans_002: Python ----------
__author__ = "Sculpture"
__version__ = "2021.05.24"

import rhinoscriptsyntax as rs

a = x < y
b = x > y

#c, d = True, False

e = (c or d) == True
f = (c and d) == False
g = (not d) == True

print(e)
print(f)
print(g)
# ---------- end oneliner_booleans_002 ----------
panel_17 = Panel(oneliner_booleans_002.out)
panel_18 = Panel([oneliner_booleans_002.a, oneliner_booleans_002.b])
panel_19 = Panel([oneliner_booleans_002.e, oneliner_booleans_002.f, oneliner_booleans_002.g])

oneliner_booleans_003 = OneLiner_booleans_003(x=Toggle(True), y=Toggle(False))  # -> out, a, b; inputs x: Boolean, y: Boolean
# ---------- oneliner_booleans_003: Python ----------
__author__ = "Sculpture"
__version__ = "2021.05.24"

import rhinoscriptsyntax as rs

#order of precedence not, and, or
a = x and not y
b = not x and y or x

# if condition evaluates to False
if None or 0 or 0.0 or '' or [] or {} or set():
    print("Dead Code") #Not Reached
else:
    print("oh, yeah!")
# ---------- end oneliner_booleans_003 ----------
panel_20 = Panel(oneliner_booleans_003.a)
panel_21 = Panel(oneliner_booleans_003.out)
panel_22 = Panel(oneliner_booleans_003.b)

# ----
# strings
panel_23 = Panel("MICHAEL")
oneliners_strings_004 = OneLiners_Strings_004(x=panel_23, y="wickerson")  # -> out, a, b, c, d, e, f, g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
# ---------- oneliners_strings_004: Python ----------
__author__ = "Sculpture"
__version__ = "2021.05.24"

import rhinoscriptsyntax as rs

"""
\n new line
\s new space
\t new tab
"""

a = "    This is lazy\t\n    "
b = a.strip()
c = x.lower()
d = y.upper()
e = "smartphone".startswith("smart")
f = "smartphone".endswith("phone")
g = "another".find("other")
h = "cheat".replace("ch", "m")
i = ",".join(["F", "B", "I"])
j = len("Rumpelstiltskin")
k = "ear" in "earth"
# ---------- end oneliners_strings_004 ----------
panel_24 = Panel([oneliners_strings_004.a, oneliners_strings_004.b, oneliners_strings_004.c, oneliners_strings_004.d, oneliners_strings_004.e, oneliners_strings_004.f, oneliners_strings_004.g, oneliners_strings_004.h, oneliners_strings_004.i, oneliners_strings_004.j, oneliners_strings_004.k])

# ----
# keyword: None
oneliners_keywordnone_005 = Oneliners_keywordNone_005()  # -> out, a, b, c
# ---------- oneliners_keywordnone_005: Python ----------
__author__ = "Sculpture"
__version__ = "2021.05.24"

import rhinoscriptsyntax as rs

def f():
    x = 2
    # if you do not return a value for a function
    
a = f() is None
b = "" == None
c = 0 == None
# ---------- end oneliners_keywordnone_005 ----------
panel_25 = Panel([oneliners_keywordnone_005.a, oneliners_keywordnone_005.b, oneliners_keywordnone_005.c])
