# Grasshopper definition BASIC_INTERMEDIATE_listComprehensionReadingLambdaMap_005.gh (Grasshopper 1.0.7)
# plug-ins: Bifocals

# oneLiners_Basic_Intermediate
# comprehension, file access, the map() function, the Lambda function, the reduce()
#  function, slicing, slice assignment, generator functions, zip() funciton
geometry = Geometry([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])
pipe = Pipe(Curve=reparameterize(geometry), Radius=Slider(0.3, range=0..1), Caps=2)
dispatch = Dispatch(List=flatten(pipe), DispatchPattern=[True, False])  # -> ListA, ListB
# comprehension
# Find Words
geometry_2 = Geometry(dispatch.ListA)
oneliners_comprehensionwordfind_003 = OneLiners_comprehensionWordFind_003()  # -> out, a
# ---------- oneliners_comprehensionwordfind_003: Python ----------
__author__ = "Sculpture"
__version__ = "2021.05.28"

import rhinoscriptsyntax as rs

poem = """She's an odd little dittle in a big brown 
fiddle and when she's tuned to play, the kids will 
play an the little brown fox will dance around the 
big old fashioned warehouse."""

#OneLiner
#creates a list of words more than 4 letters
#creates a list of lists separated by new lines
a = [[x for x in line.split() if len(x)>4] for line in poem.split('\n')]
print(a)
# ---------- end oneliners_comprehensionwordfind_003 ----------
panel = Panel(oneliners_comprehensionwordfind_003.out)

# ----
# comprehension
# take your time to really
#  understand LIST COMPREHENSION
# #EXPRESSION AND CONTEXT
oneliners_listcomprehension_001 = OneLiners_listcomprehension_001()  # -> out, a
# ---------- oneliners_listcomprehension_001: Python ----------
__author__ = "Sculpture"
__version__ = "2021.05.27"

import rhinoscriptsyntax as rs

#list comprehension

personsOfInterest = {"Batman": 75, 
                    "Joker": 95, 
                    "Penguin": 34,
                    "Cat Woman": 58, 
                    "the Riddler": 100}
                    
favorites = [] #create a list ot output to
for key, val in personsOfInterest.items():
    if val >= 75:
        favorites.append((key,val))

print(favorites)
a = favorites

# now let's look at List comprehension
#[expression + context]
# example [x * 2 for x in range(3) outputs [0, 2, 4]
# ---------- end oneliners_listcomprehension_001 ----------
panel_2 = Panel(oneliners_listcomprehension_001.out)
panel_3 = Panel(oneliners_listcomprehension_001.a)

# ----
# comprehension
# Reading a File
file_path = FilePath("C:\Program Files\Rhino 7\System\readFileDefault.py")
oneliners_listcomprehensionreadingfile_0 = OneLiners_listComprehensionReadingFile_004(x=file_path)  # -> out, a
# ---------- oneliners_listcomprehensionreadingfile_0: Python ----------
__author__ = "Sculpture"
__version__ = "2021.05.28"

import rhinoscriptsyntax as rs

print([line.strip() for line in open("readFileDefault.py")])

print([line.strip() for line in open(x)])
# ---------- end oneliners_listcomprehensionreadingfile_0 ----------
panel_4 = Panel(oneliners_listcomprehensionreadingfile_0.out)
panel_5 = Panel(file_path)
# Lambda and Map Functions
# returning to calling environment
oneliners_lambdaandmapfunctions_005 = OneLiners_LambdaAndMapFunctions_005()  # -> out, check, check2
# ---------- oneliners_lambdaandmapfunctions_005: Python ----------
__author__ = "Sculpture"
__version__ = "2021.05.28"

import rhinoscriptsyntax as rs

#lambda arguments : return expression
#lambda x, y: x + y

#Data
txt = ['The quick brown fox ',
        'jumps over the ',
        'lazy dog.']

#oneLiner
check = map(lambda s: (True, s) if 'jumps' in s else (False, s), txt)

#lambda functions are anonymous functions
#anonymous functions don't have a name
#functions are objects in Python

print(list(check))

#use list comprehension rather than map()

check2 = [(True, s) if 'quick' in s else (False, s) for s in txt]
# ---------- end oneliners_lambdaandmapfunctions_005 ----------

# ----
# comprehension
# examples
oneliners_listcomprehensionexamples_002 = OneLiners_listComprehensionExamples_002()  # -> out, a, b, c, d, favorites
# ---------- oneliners_listcomprehensionexamples_002: Python ----------
__author__ = "Sculpture"
__version__ = "2021.05.27"

import rhinoscriptsyntax as rs

#1
a = ([x for x in range(4)])
#2
b = ([(x,y) for x in range(3) for y in range(3)])
#3
c = ([x ** 2 for x in range(10) if x % 2 < 1])
#4
d = ([x.lower() for x in ["MICHAEL", "DAVID", "WICKERSON"]])

#try the previous script again
personsOfInterest = {"Batman": 75, 
                    "Joker": 95, 
                    "Penguin": 34,
                    "Cat Woman": 58, 
                    "the Riddler": 100}
                    
#ONELINER!!!
favorites = [(k, v) for k, v in personsOfInterest.items() if v >= 75]

#take your time to really understand LIST COMPREHENSION
#EXPRESSION AND CONTEXT
# ---------- end oneliners_listcomprehensionexamples_002 ----------
panel_6 = Panel(oneliners_listcomprehensionexamples_002.favorites)
panel_7 = Panel([oneliners_listcomprehensionexamples_002.a, oneliners_listcomprehensionexamples_002.b])
panel_8 = Panel([oneliners_listcomprehensionexamples_002.c, oneliners_listcomprehensionexamples_002.d])

panel_9 = Panel(oneliners_lambdaandmapfunctions_005.check)
panel_10 = Panel(oneliners_lambdaandmapfunctions_005.out)
panel_11 = Panel(oneliners_lambdaandmapfunctions_005.check2)
