# Grasshopper definition Control_loops_014.gh (Grasshopper 1.0.7)
# plug-ins: Bifocals

# oneLiners_Basic
number_slider = Slider(0.3, range=0..1)
geometry = Geometry([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])
pipe = Pipe(Curve=reparameterize(geometry), Radius=number_slider, Caps=2)
dispatch = Dispatch(List=flatten(pipe), DispatchPattern=[True, False])  # -> ListA, ListB
geometry_2 = Geometry(dispatch.ListA)

# ----
# squares
number_slider_2 = Slider(2, range=0..5)
oneliner_squares = OneLiner_squares(x=number_slider_2, y=Slider(3, range=0..5))  # -> out, squares; inputs x: Int32, y: Int32
# ---------- oneliner_squares: Python ----------
__author__ = "Sculpture"
__version__ = "2021.05.23"

import rhinoscriptsyntax as rs

#before
squares = []
        
for i in range(10):
    squares.append(i**x) 
        
#after oneliner
print([i**y for i in range(10)])
# ---------- end oneliner_squares ----------
panel = Panel(oneliner_squares.out)
panel_2 = Panel(oneliner_squares.squares)

# ----
# container data structures
# lists
number_slider_3 = Slider(2, range=0..10)
oneliners_listsandkeywordis = OneLiners_listsAndKeywordIs(x=number_slider_3, y=Toggle(True), z="Wickerson")  # -> out, a, b, c
# ---------- oneliners_listsandkeywordis: Python ----------
__author__ = "Sculpture"
__version__ = "2021.05.26"

import rhinoscriptsyntax as rs

a = [x, y, z]

p = q = x
b = p is q # True
c = [23] is [23] # False
# ---------- end oneliners_listsandkeywordis ----------
merge = Merge(Data1=oneliners_listsandkeywordis.a, Data2=oneliners_listsandkeywordis.b, Data4=oneliners_listsandkeywordis.c)
panel_3 = Panel(merge)

# ----
# Control flow
# if, else, and elif
number_slider_4 = Slider(0, range=0..10)
oneliners_ifelifelse_013 = OneLiners_ifElifElse_013(x=number_slider_4)  # -> out, a; inputs x: Int32
# ---------- oneliners_ifelifelse_013: Python ----------
__author__ = "Sculpture"
__version__ = "2021.05.27"

import rhinoscriptsyntax as rs

if x > 3:
    a = 'Big'
elif x == 3:
    a = 'Medium'
else:
    a = 'Small'
# ---------- end oneliners_ifelifelse_013 ----------
panel_4 = Panel(oneliners_ifelifelse_013.a)

# ----
# stacks
number_slider_5 = Slider(3, range=0..10)
oneliners_stacks_007 = OneLiners_stacks_007(x=number_slider_5, y=Slider(8, range=0..10))  # -> out, a
# ---------- oneliners_stacks_007: Python ----------
__author__ = "Sculpture"
__version__ = "2021.05.26"

import rhinoscriptsyntax as rs

a = stack = [x]
stack.append(y) #[x, y]
stack.pop() #removes last element
stack.pop()
# ---------- end oneliners_stacks_007 ----------
panel_5 = Panel(oneliners_stacks_007.a)

# ----
# loops
# for
number_slider_6 = Slider(28.99, range=0..100)
panel_6 = Panel()
oneliner_forloop_014 = OneLiner_forLoop_014(x=panel_6, y=Toggle(True), z=number_slider_6)  # -> out, a
# ---------- oneliner_forloop_014: Python ----------
__author__ = "Sculpture"
__version__ = "2021.05.27"

import rhinoscriptsyntax as rs

a = []

for i in [x, y, z]:
    print(i)
    a.append(i)
# ---------- end oneliner_forloop_014 ----------
panel_7 = Panel(oneliner_forloop_014.out)
panel_8 = Panel(oneliner_forloop_014.a)

# ----
# adding elements to list
number_slider_7 = Slider(5, range=0..10)
oneliner_addingelements = OneLiner_addingElements(
    x=Slider(2, range=0..10),
    y=Toggle(True),
    z="Wickerson",
    data="New data",
    i=number_slider_7,
    dash=Slider(14, range=0..100))  # -> out, a, b, c, d; inputs i: Int32, dash: Int32
# ---------- oneliner_addingelements: Python ----------
__author__ = "Sculpture"
__version__ = "2021.05.26"

import rhinoscriptsyntax as rs

a = [x,y,z]
a.append("Hot dog")
b = ["_"*dash] + a 
b.insert(i, data)
c = b
d = ["_"*dash] + a + [12] #concatenation
# ---------- end oneliner_addingelements ----------
merge_2 = Merge(
    Data1=oneliner_addingelements.a,
    Data2=oneliner_addingelements.b,
    Data3=oneliner_addingelements.c,
    Data4=oneliner_addingelements.d)
panel_9 = Panel(merge_2)

# ----
# sets
# collections
# unordered and unique
oneliners_setscollections_008 = OneLiners_setsCollections_008()  # -> out, a, b, players, party, NPC, everyone
# ---------- oneliners_setscollections_008: Python ----------
__author__ = "Sculpture"
__version__ = "2021.05.26"

import rhinoscriptsyntax as rs

prince = "Harry"
DM = "Duchame"
Lord = "Mordus"
a = hash(prince)
b = hash(DM)
players = {prince, DM, Lord}
party = {prince, Lord}

NPC = ["orc", "kobold"]

#everyone = {party, NPC} 
#TypeError: unhashable type: 'list'
# ---------- end oneliners_setscollections_008 ----------
panel_10 = Panel([oneliners_setscollections_008.a, oneliners_setscollections_008.b])
panel_11 = Panel(oneliners_setscollections_008.players)
panel_12 = Panel(oneliners_setscollections_008.party)
panel_13 = Panel(oneliners_setscollections_008.NPC)
panel_14 = Panel(oneliners_setscollections_008.everyone)
oneliners_setsunorderedunique_009 = OneLiners_setsUnorderedUnique_009()  # -> out, players, mob
# ---------- oneliners_setsunorderedunique_009: Python ----------
__author__ = "Sculpture"
__version__ = "2021.05.26"

import rhinoscriptsyntax as rs

prince = "Harry"
DM = "Duchame"
Lord = "Mordus"
players = {prince, DM, Lord} #UNORDERED in sets


#all elements in the set must be UNIQUE
mob = {"orc", "orc", "orc", "orc", DM}
# ---------- end oneliners_setsunorderedunique_009 ----------
panel_15 = Panel(oneliners_setsunorderedunique_009.players)
panel_16 = Panel(oneliners_setsunorderedunique_009.mob)

# ----
# data structures
number_slider_8 = Slider(3, range=0..10)
oneliner_datastructures = OneLiner_dataStructures(x=number_slider_8, y=Slider(5, range=0..10))  # -> out, add, minus, times, divide, divideDown, modulus, negative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; inputs x: Int32, y: Int32
# ---------- oneliner_datastructures: Python ----------
__author__ = "Sculpture"
__version__ = "2021.05.23"

import rhinoscriptsyntax as rs

add = x + y
minus = x - y
times = x * y
divide = x / y
divideDown = x // y
modulus = x % y
negative = -x
castInt = int(3.9)
castFloat = float(x) #strange, works in output but not in castFloat output
print(x)
print(float(x))

exponent = x ** y
# ---------- end oneliner_datastructures ----------
panel_17 = Panel(oneliner_datastructures.castFloat)
panel_18 = Panel(oneliner_datastructures.out)
panel_19 = Panel(oneliner_datastructures.add)
panel_20 = Panel(oneliner_datastructures.times)
panel_21 = Panel(oneliner_datastructures.divideDown)
panel_22 = Panel(oneliner_datastructures.negative)
panel_23 = Panel(oneliner_datastructures.minus)
panel_24 = Panel(oneliner_datastructures.modulus)
panel_25 = Panel(oneliner_datastructures.castInt)
panel_26 = Panel(oneliner_datastructures.divide)
panel_27 = Panel(oneliner_datastructures.exponent)

# ----
# booleans
number_slider_9 = Slider(3, range=0..10)
number_slider_10 = Slider(5, range=0..10)
oneliner_booleans = OneLiner_booleans(x=number_slider_9, y=number_slider_10)  # -> out, a, b, e, f, g; inputs x: Int32, y: Int32
# ---------- oneliner_booleans: Python ----------
__author__ = "Sculpture"
__version__ = "2021.05.24"

import rhinoscriptsyntax as rs

a = x < y
b = x > y

c, d = True, False

e = (c or d) == True
f = (c and d) == False
g = (not d) == True

print(e)
print(f)
print(g)
# ---------- end oneliner_booleans ----------
panel_28 = Panel(oneliner_booleans.out)
panel_29 = Panel([oneliner_booleans.a, oneliner_booleans.b])
panel_30 = Panel([oneliner_booleans.e, oneliner_booleans.f, oneliner_booleans.g])

# ----
# removing elements in list
number_slider_11 = Slider(8, range=0..10)
number_slider_12 = Slider(2, range=0..10)
boolean_toggle = BooleanToggle(True)
list_item = ListItem(List=[number_slider_12, boolean_toggle, "Wickerson"], Index=Slider(2, range=0..10), Wrap=True)
oneliners_reversingsortingindexing = OneLiners_reversingSortingIndexing(
    x=number_slider_12,
    y=boolean_toggle,
    z="Wickerson",
    listObject=list_item,
    dashCount=number_slider_11,
    iNum=Slider(3, range=0..10))  # -> out, a, b, c, d; inputs dashCount: Int32
# ---------- oneliners_reversingsortingindexing: Python ----------
__author__ = "Sculpture"
__version__ = "2021.05.26"

import rhinoscriptsyntax as rs

a = [x, y, z]
a.remove(listObject) #modifies the exact object to save memory
b = a

numberList = [23,4534,213,5465,32,3]
numberList.sort()
c = ["-"*dashCount] + numberList

d = [9,8,7,6,5,4,3,2,1,0].index(iNum)
# ---------- end oneliners_reversingsortingindexing ----------
panel_31 = Panel(list_item)
merge_3 = Merge(
    Data1=oneliners_reversingsortingindexing.a,
    Data2=oneliners_reversingsortingindexing.b,
    Data3=oneliners_reversingsortingindexing.c,
    Data4=oneliners_reversingsortingindexing.d)
panel_32 = Panel(merge_3)

# ----
# while and break
oneliners_whileloopbreakcontinue_015 = OneLiners_whileLoopBreakContinue_015()  # -> out, a
# ---------- oneliners_whileloopbreakcontinue_015: Python ----------
__author__ = "Sculpture"
__version__ = "2021.05.27"

import rhinoscriptsyntax as rs

a = [] #create an empty list

x = 0 #initialize to 0 to prevent infinite loop
while x < 3:
    print(x)
    x = x + 1
    a.append(x)

while True:
    break # prevents infinite loop
    
print("hello Wickerson")

"""
DO NOT UNCOMMENT
while True:
    continue
    print("dead code") #dead code CRASH!
"""
# ---------- end oneliners_whileloopbreakcontinue_015 ----------
panel_33 = Panel(oneliners_whileloopbreakcontinue_015.a)
panel_34 = Panel(oneliners_whileloopbreakcontinue_015.out)

# ----
# dictionaries
number_slider_13 = Slider(33, range=0..100)
oneliners_dictskeysvaluesitems_010 = OneLiners_dictsKeysValuesItems_010(age=number_slider_13)  # -> out, ages, a, b, c, d, e, f, g; inputs age: Int32
# ---------- oneliners_dictskeysvaluesitems_010: Python ----------
__author__ = "Sculpture"
__version__ = "2021.05.26"

import rhinoscriptsyntax as rs

ages = {'bob' : 15, 'mary' : 25, 'oscar' : 35}
a = ages['bob']
b = ages['mary'] < ages['oscar']

ages['Jimmy'] = 45
c = ages['Jimmy'] < ages['bob']

d = 'mary' in ages.keys()
e = 'oscar' in ages.values()
f = 'fred' in ages.keys()

#item() method
for k, v in ages.items():
    print(k) if v > age else None
# ---------- end oneliners_dictskeysvaluesitems_010 ----------
panel_35 = Panel(oneliners_dictskeysvaluesitems_010.ages)
panel_36 = Panel([oneliners_dictskeysvaluesitems_010.a, oneliners_dictskeysvaluesitems_010.b, oneliners_dictskeysvaluesitems_010.c, oneliners_dictskeysvaluesitems_010.d, oneliners_dictskeysvaluesitems_010.e, oneliners_dictskeysvaluesitems_010.f])
panel_37 = Panel(oneliners_dictskeysvaluesitems_010.out)

oneliner_booleans_002 = OneLiner_booleans_002(x=number_slider_9, y=number_slider_10, c=Toggle(False), d=Toggle(False))  # -> out, a, b, e, f, g; inputs x: Int32, y: Int32, c: Boolean, d: Boolean
# ---------- oneliner_booleans_002: Python ----------
__author__ = "Sculpture"
__version__ = "2021.05.24"

import rhinoscriptsyntax as rs

a = x < y
b = x > y

#c, d = True, False

e = (c or d) == True
f = (c and d) == False
g = (not d) == True

print(e)
print(f)
print(g)
# ---------- end oneliner_booleans_002 ----------
panel_38 = Panel(oneliner_booleans_002.out)
panel_39 = Panel([oneliner_booleans_002.a, oneliner_booleans_002.b])
panel_40 = Panel([oneliner_booleans_002.e, oneliner_booleans_002.f, oneliner_booleans_002.g])

# ----
# Functions
number_slider_14 = Slider(309, range=0..1000)
oneliners_functionsreturndeclaration_015 = OneLiners_FunctionsReturnDeclaration_015(x=number_slider_14)  # -> out, a; inputs x: Int32
# ---------- oneliners_functionsreturndeclaration_015: Python ----------
__author__ = "Sculpture"
__version__ = "2021.05.27"

import rhinoscriptsyntax as rs

a = 0.0 #needs ot be declared as a float to work

def increase(x, percent):
    return x + x * percent / 100

print(increase(x, 5)) 
a = (increase(x, 5))

print(type(increase(10000, 5)))
# ---------- end oneliners_functionsreturndeclaration_015 ----------
panel_41 = Panel(oneliners_functionsreturndeclaration_015.out)
panel_42 = Panel(oneliners_functionsreturndeclaration_015.a)

oneliner_booleans_003 = OneLiner_booleans_003(x=Toggle(True), y=Toggle(False))  # -> out, a, b; inputs x: Boolean, y: Boolean
# ---------- oneliner_booleans_003: Python ----------
__author__ = "Sculpture"
__version__ = "2021.05.24"

import rhinoscriptsyntax as rs

#order of precedence not, and, or
a = x and not y
b = not x and y or x

# if condition evaluates to False
if None or 0 or 0.0 or '' or [] or {} or set():
    print("Dead Code") #Not Reached
else:
    print("oh, yeah!")
# ---------- end oneliner_booleans_003 ----------
panel_43 = Panel(oneliner_booleans_003.a)
panel_44 = Panel(oneliner_booleans_003.out)
panel_45 = Panel(oneliner_booleans_003.b)

# ----
# membership
oneliners_membership_011 = OneLiners_membership_011()  # -> out, a, b, c
# ---------- oneliners_membership_011: Python ----------
__author__ = "Sculpture"
__version__ = "2021.05.26"

import rhinoscriptsyntax as rs

a = 33 in [11, 22, 33, 44] #list
b = '33' in {'11', '22', '33', '44'} #set *MUCH FASTER THAN LIST MEMBERSHIP*
c = "mike" in {"mike" : 49, "ella" : 4, "Oscar" : 11} #dictionary
# ---------- end oneliners_membership_011 ----------
merge_4 = Merge(Data1=oneliners_membership_011.a, Data2=oneliners_membership_011.b, Data3=oneliners_membership_011.c)
panel_46 = Panel(merge_4)

# ----
# LAMBDAS
number_slider_15 = Slider(4, range=0..10)
oneliners_lambdas_016 = OneLinersLAMBDAS_016(x=number_slider_15, y=Slider(6, range=0..10), z=Slider(5, range=0..10))  # -> out, a
# ---------- oneliners_lambdas_016: Python ----------
__author__ = "Sculpture"
__version__ = "2021.05.27"

import rhinoscriptsyntax as rs

#they are functions without names to be used for single use
#lambda <arguments> : <return expression>

print((lambda x: x + y)(z))
# ---------- end oneliners_lambdas_016 ----------
panel_47 = Panel(oneliners_lambdas_016.out)

# ----
# strings
panel_48 = Panel("MICHAEL")
oneliners_strings_004 = OneLiners_Strings_004(x=panel_48, y="wickerson")  # -> out, a, b, c, d, e, f, g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
# ---------- oneliners_strings_004: Python ----------
__author__ = "Sculpture"
__version__ = "2021.05.24"

import rhinoscriptsyntax as rs

"""
\n new line
\s new space
\t new tab
"""

a = "    This is lazy\t\n    "
b = a.strip()
c = x.lower()
d = y.upper()
e = "smartphone".startswith("smart")
f = "smartphone".endswith("phone")
g = "another".find("other")
h = "cheat".replace("ch", "m")
i = ",".join(["F", "B", "I"])
j = len("Rumpelstiltskin")
k = "ear" in "earth"
# ---------- end oneliners_strings_004 ----------
panel_49 = Panel([oneliners_strings_004.a, oneliners_strings_004.b, oneliners_strings_004.c, oneliners_strings_004.d, oneliners_strings_004.e, oneliners_strings_004.f, oneliners_strings_004.g, oneliners_strings_004.h, oneliners_strings_004.i, oneliners_strings_004.j, oneliners_strings_004.k])

# ----
# comprehension
oneliners_comprehensionlistandsets_012 = OneLiners_comprehensionListAndSets_012()  # -> out, old, kids
# ---------- oneliners_comprehensionlistandsets_012: Python ----------
__author__ = "Sculpture"
__version__ = "2021.05.26"

import rhinoscriptsyntax as rs

#(name, age)
family = [("mike", 49), ("beth", 43), ("oscar", 11), ("max", 9), ("ella", 4)]

#EXPRESSION AND CONTEXT
old = [x for x, y in family if y > 39]
kids = [x for x, y in family if y < 19]
# ---------- end oneliners_comprehensionlistandsets_012 ----------
panel_50 = Panel(oneliners_comprehensionlistandsets_012.old)
panel_51 = Panel(oneliners_comprehensionlistandsets_012.kids)

# ----
# keyword: None
oneliners_keywordnone_005 = Oneliners_keywordNone_005()  # -> out, a, b, c
# ---------- oneliners_keywordnone_005: Python ----------
__author__ = "Sculpture"
__version__ = "2021.05.24"

import rhinoscriptsyntax as rs

def f():
    x = 2
    # if you do not return a value for a function
    
a = f() is None
b = "" == None
c = 0 == None
# ---------- end oneliners_keywordnone_005 ----------
panel_52 = Panel([oneliners_keywordnone_005.a, oneliners_keywordnone_005.b, oneliners_keywordnone_005.c])
