# Grasshopper definition INTERMEDIATE_ADVANCED__K-NearestNeighbors_010.gh (Grasshopper 1.0.7)
# Copyright: © 2017-2018 Pierre Cuvilliers, Caitlin Mueller, Massachusetts Institute of Technology
# plug-ins: Bifocals

# ----
# Branch
# Managment
# Script
number_slider = Slider(7, range=0..10)
oneliners_intadvanced_branchmanagment_00 = OneLiners_intAdvanced_branchManagment_001(
    numPaths=Slider(5, range=0..10),
    startBranch=Slider(3, range=0..10),
    stopBranch=number_slider,
    stepBranch=Slider(3, range=0..10),
    numItems=Slider(6, range=0..10))  # -> out, nest, paths, a, b; inputs numPaths: Int32, startBranch: Int32, stopBranch: Int32, numItems: Int32
# ---------- oneliners_intadvanced_branchmanagment_00: Python ----------
##################################################
import random
import Grasshopper.Kernel.Data.GH_Path as ghpath
import Grasshopper.DataTree as datatree 
import System
import ghpythonlib.components as ghc
import rhinoscriptsyntax as rs
import Rhino.Geometry as rg
##################################################

nest = datatree[System.Object]() #the tree
paths = datatree[System.Object]()
for Alpha_path in range(numPaths): # numPaths Alpha paths
    for Beta_branch in range(random.randrange(startBranch,stopBranch,stepBranch)): #each gets random number of beta branchs
        paths.Add( (ghpath(Alpha_path,Beta_branch)),ghpath(Alpha_path))#add full_path name to Alph path
        for item in range(numItems):# each path has (numItems) numbers
            nest.Add(item, ghpath(Alpha_path,Beta_branch)) # assign number to given path

#how to call all Beta Branchs from Alpha path (zero) ??
for path in paths.Branch(0):
    print path
    print nest.Branch(ghpath(path))

a = nest
b = paths
# ---------- end oneliners_intadvanced_branchmanagment_00 ----------
panel = Panel(oneliners_intadvanced_branchmanagment_00.out)
panel_2 = Panel(oneliners_intadvanced_branchmanagment_00.paths)
# MACHINE LEARNING: notes
# Notes:
# - Machine Learning is found in most every area of Comuter Science
# - 10 practical one-liners to apply these algorithms to your own projects
# - the Basics of Supervised Machine Learning
# - aim to make predictions using existing data
# - A model is a black box full of data
# - the input data is called "features", denoted with variable "x"
# - you get the prediction "y" back as output from the box
# - Two major phases: the training phase and the inference phase
viewer = ParamViewer(oneliners_intadvanced_branchmanagment_00.nest)

# ----
# GH Python Remote Node Setup
panel_3 = Panel("""numpy
scipy
numpy.linalg
matplotlib
matplotlib.pyplot
pandas
sklearn
sklearn.linear_model
sklearn.cluster
sklearn.neighbors""")
# ghPython oneLiners_Intermediate_Advanced
panel_4 = Panel("C:\Users\Sculpture\.conda\envs\rhinoremote")
gh_python_remote = GHPythonRemote(location=panel_4, run=Toggle(True), modules=panel_3)  # -> out, linked_modules, rpy, import_statements
panel_5 = Panel(gh_python_remote.linked_modules)
panel_6 = Panel(gh_python_remote.import_statements)

# ----
# 001
# linear
# Regression
# Linear Regression:
# #the most common machine learning algorithm
# #used in regression problems
# #model predicts missing ones from existing ones
# #simplicity
# #market research, astronomy, biology
# 
# the Basics:
# #model parameters are internal configuration
# variables that are estimated from data
# #determine predictions calculations
# given input features
# #model parameters are called coefficients
# # y = f(x) =a0 + a1x
oneliners_linearregression_001 = OneLiners_linearRegression_001()  # -> out, a; disabled
# ---------- oneliners_linearregression_001: Python ----------
__author__ = "Sculpture"
__version__ = "2021.05.30"

import rhinoscriptsyntax as rs

#import and do all this JAZZ!
import rhinoscriptsyntax as rs
import scriptcontext as sc
import ghpythonremote

np = sc.sticky['numpy']
scipy = sc.sticky['scipy']
mpl = sc.sticky['matplotlib']
plt = mpl.pyplot
rpy = sc.sticky['rpy']
pandas = sc.sticky['pandas']
skl = sc.sticky['sklearn']
linm = sc.sticky['sklearn.linear_model']

#data (Apple stock prices)
apple = np.array([1, 2, 4, 9, 16])
n = len(apple)

#oneLiner
model = linm.LinearRegression().fit(np.arange(n).reshape((n,1)), apple)

#result
print(model.predict([[12],[13]]))
print(type(model.predict([[3],[4]])))
# ---------- end oneliners_linearregression_001 ----------
panel_7 = Panel(oneliners_linearregression_001.out)  # disabled

# ----
# K-Means
# Clustering
# K-Means
# Clustering:
# Procedure
# Initialized random cluster centers (centroids)
# Repeat until convergence
# Assign every data to its closest cluster
# Recompute each cluster center as the centroid
# of all data points to assigned to it
# The Result:
# first assign the data to the k cluster centers
# then recompute each cluster center
# as the centroid of the data is assigned to it
k_number = Slider(5, range=0..7)
step = Slider(3.74, range=0..10)
# 003
startage = Slider(12, range=0..100)
stepage = Slider(9, range=0..10)
count = Panel("7")
series = Series(Start=startage, Step=stepage, Count=count)
series_2 = Series(Start=count, Step=step, Count=count)
hours = Slider(1, range=0..1)
oneliners_kmeansclustering_008 = OneLinersKMeansClustering_008(ageList=series, moneyList=series_2, k=k_number, column=hours)  # -> out, a; inputs ageList: list of Int32, moneyList: list, k: Int32, column: Int32
# ---------- oneliners_kmeansclustering_008: Python ----------
__author__ = "Sculpture"
__version__ = "2021.05.30"

import rhinoscriptsyntax as rs

#import and do all this JAZZ!
import rhinoscriptsyntax as rs
import scriptcontext as sc
import ghpythonremote

np = sc.sticky['numpy']
scipy = sc.sticky['scipy']
mpl = sc.sticky['matplotlib']
plt = mpl.pyplot
rpy = sc.sticky['rpy']
pandas = sc.sticky['pandas']
skl = sc.sticky['sklearn'] #machine learning models
linm = sc.sticky['sklearn.linear_model']
cluster = sc.sticky['sklearn.cluster']

"""
K-Means Clustering, the one clustering algorithm to know
good for unlabeled data
when unclear about the "optimal output"
prediction is impossible
find clusters fo unlabeled data sets
falls under unsupervised learning
finds k number ofclusters of data 
so that the between the centroid
and the data is minimal
every cluster represents something distinct
requires the num of k cluster centers as an input
"Learning the k in K-Means" by Greg Hamerly and Charles Elkan
"""

#data (work hours / pay $)
X = np.array([[ageList[0], moneyList[0]],
                [ageList[1], moneyList[1]],
                [ageList[2], moneyList[2]],
                [ageList[3], moneyList[3]],
                [ageList[4], moneyList[4]],
                [ageList[5], moneyList[5]],
                [ageList[6], moneyList[6]]])

#oneLiner
kmeans = cluster.KMeans(n_clusters=k).fit(X)

#result
cluCen = kmeans.cluster_centers_
print(cluCen)
print(type((cluCen)))
print(cluCen)[-1][column]
# ---------- end oneliners_kmeansclustering_008 ----------
# the CODE:
# given two dimensional data,
# find two clusters in the given data set
# that have similar A and similar B
# How it works:
# We are introduced to an important
# subtopic of unsupervised learning:
# Clustering
# It recomputes cluster centers
# reassigns each data vale to closest center
# finds the optimal clusters
# Using distance is good to know
# Use the distance of Euclidean data values
# K-Nearest Neighbors algorithm is next
panel_8 = Panel(oneliners_kmeansclustering_008.out)

# ----
# Logistic
# Regression
# the Sigmoid
# function
# 002
# Logistic Regression:
# the Sigmoid function
# #commonly used for classification problems
# #predict as to whether something belongs
# to a particular category
# #example to divide data according to inputs features
# #the Basics:
# #used for non continuous output, categorical
# 
# #The Sigmoid Function
# #fits an S-shaped curve
# #helps to make binary decisions (yes/no)
# #generalized "softmax function"
# #returns a tuple of probabilities for each class
oneliners_logisticregression_006 = OneLiners_logisticRegression_006()  # -> out, a; disabled
# ---------- oneliners_logisticregression_006: Python ----------
__author__ = "Sculpture"
__version__ = "2021.05.30"

import rhinoscriptsyntax as rs

#import and do all this JAZZ!
import rhinoscriptsyntax as rs
import scriptcontext as sc
import ghpythonremote

np = sc.sticky['numpy']
scipy = sc.sticky['scipy']
mpl = sc.sticky['matplotlib']
plt = mpl.pyplot
rpy = sc.sticky['rpy']
pandas = sc.sticky['pandas']
skl = sc.sticky['sklearn'] #machine learning models
linm = sc.sticky['sklearn.linear_model']

"""
EXAMPLE with LinearRegression() function
#data (Apple stock prices)
apple = np.array([155, 156, 157])

#oneLiner
model = linm.LinearRegression().fit(np.arange(n).reshape((n,1)), apple)
#result
print(model.predict([[3],[4]]))
"""
#data (3cigarettes, cancer)
X = np.array([[0, "No"],
                [10, "No"],
                [60, "Yes"],
                [90, "Yes"]])

n = len(X)

#oneLiner
#model = linm.LogisticRegression().fit(X[:,0].reshape(n,1), X[:,1])
#or this code -1 if you don't want to type in n = len(X)
model = linm.LogisticRegression().fit(X[:,0].reshape(-1,1), X[:,1])

#result and puzzle
print(model.predict([[2],[12],[13],[40],[90]]))

#look at probabilities
for i in range(20):
    print("x=" + str(i) + " --> " + str(model.predict_proba([[i]])))
# ---------- end oneliners_logisticregression_006 ----------
# the CODE:
# #four patients (rows)
# # 2 columns
# input feature and class label
# #call logisticRegression()
# call fit() takes two arguments
# input cig consumption
# output label (cancer)
# #fit() expects 2D array
# #reshape  used n of rows and one column
# pass -1 and it finds # rows automatically
# #next we predict given # of cigs
# 
# The Sigmoid Function
# assigns 0 to 1 to every new data point
# and belonging to a given class
# 
# Now onto unsupervised learning, find
# clusters of data points
# an important subset of unsupervised
# learning
panel_9 = Panel(oneliners_logisticregression_006.out)  # disabled

# ----
# K-Means
# Clustering
step_2 = Slider(24.36, range=0..100)
# 004
# K-Nearest
# Neighbours
startage_2 = Slider(21, range=0..100)
stepage_2 = Slider(8, range=0..10)
# K_Nearest
# Neighbors:
# K-Nearest Neighbors
# KNN is used for regression and classification
# image and data forecasting
# basis for many advanced ML techniques like information retrieval
# KNN is an important building block
# The Basics:
# the ML models nothing more than a set of observations
# this may require sampling or filtering
# Given vector x:
#     1. find the nearest neighbors of x with predefined distance metric
#     2. aggregate into a single prediction or classification value
#         use as mean, average, max, min...
# KNN simply calculates the k = 3 neighbors to query D distance
# Nearest Neighbors A, B, C
# Then KNN aggregates the 3 nearest by simple average of values
# Denoted as 3NN
# It is necessary to cull out "stale" values from the model
k_number_2 = Slider(2, range=1..6)
count_2 = Panel("6")
series_3 = Series(Start=startage_2, Step=stepage_2, Count=count_2)
series_4 = Series(Start=0, Step=step_2, Count=count_2)
panel_10 = Panel(series_3)
panel_11 = Panel(series_4)
oneliners_k_nearestneighbors_010 = OneLiners_KNearestNeighbors_010(size=series_3, cost=series_4, k=k_number_2, predNum=Slider(82, range=0..200))  # -> out, a; inputs size: list of Int32, cost: list, k: Int32, predNum: Int32
# ---------- oneliners_k_nearestneighbors_010: Python ----------
__author__ = "Sculpture"
__version__ = "2021.05.30"

import rhinoscriptsyntax as rs

#import and do all this JAZZ!
import rhinoscriptsyntax as rs
import scriptcontext as sc
import ghpythonremote

np = sc.sticky['numpy']
scipy = sc.sticky['scipy']
mpl = sc.sticky['matplotlib']
plt = mpl.pyplot
rpy = sc.sticky['rpy']
pandas = sc.sticky['pandas']
skl = sc.sticky['sklearn'] #machine learning models
linm = sc.sticky['sklearn.linear_model']
cluster = sc.sticky['sklearn.cluster']
nb = sc.sticky['sklearn.neighbors']

"""
K-Nearest Neighbors
KNN is used for regression and classification
image and data forecasting
basis for many advanced ML techniques like information retrieval
KNN is an important building block
The Basics:
the ML models nothing more than a set of observations
this may require sampling or filtering
Given vector x:
    1. find the nearest neighbors of x with predefined distance metric
    2. aggregate into a single prediction or classification value 
        use as mean, average, max, min...
KNN simply calculates the k = 3 neighbors to query D distance
Nearest Neighbors A, B, C
Then KNN aggregates the 3 nearest by simple average of values
Denoted as 3NN
It is necessary to cull out "stale" values from the model
"""

#data (size / cost)
X = np.array([  [size[0], cost[0]],
                [size[1], cost[1]],
                [size[2], cost[2]],
                [size[3], cost[3]],
                [size[4], cost[4]],
                [size[5], cost[5]]])

#oneLiner
KNN = nb.KNeighborsRegressor(n_neighbors=k).fit(X[:,0].reshape(-1,1), X[:,1])

#result
res = KNN.predict([[predNum]])
print(res)[0]
# ---------- end oneliners_k_nearestneighbors_010 ----------
# the CODE:
# Can also be used for classification problems
# Example:
# instead of average you can use a voting mechanism
# Each NN votes for its class and the class with the most wins
# How it works:
panel_12 = Panel(oneliners_k_nearestneighbors_010.out)

# ---- group: All that JAZZ
# MACHINE LEARNING:
#  scikit-learn
# TRAINING PHASE:
# model your desired output y' for x
# -when y is output you compare it to y'
# - if y and y' are different you update the model
# - trying to get closer to y'
# - this is supervized learning, dependent on
#  training data which supervises the machine
#  learning process
# Base Script
# Jazz
ghpython_script = GhPythonScript()  # -> out, a
# ---------- ghpython_script: Python ----------
__author__ = "Sculpture"
__version__ = "2021.05.30"

import rhinoscriptsyntax as rs

#import and do all this JAZZ!
import rhinoscriptsyntax as rs
import scriptcontext as sc
import ghpythonremote

np = sc.sticky['numpy']
scipy = sc.sticky['scipy']
mpl = sc.sticky['matplotlib']
plt = mpl.pyplot
rpy = sc.sticky['rpy']
pandas = sc.sticky['pandas']
skl = sc.sticky['sklearn']
linm = sc.sticky['sklearn.linear_model']

"""
EXAMPLE with LinearRegression() function
#data (Apple stock prices)
apple = np.array([155, 156, 157])
n = len(apple)
#oneLiner
model = linm.LinearRegression().fit(np.arange(n).reshape((n,1)), apple)
#result
print(model.predict([[3],[4]]))
"""
# ---------- end ghpython_script ----------

# ----
puzzlesample = Slider(11, range=0..100)  # disabled
puzzlesample_2 = Slider(39, range=0..100)  # disabled
puzzlesample_3 = Slider(97, range=0..100)  # disabled
# Logistic Regression
# Wickerson Studios Geometry
# EXAMPLE
rangeprob = Slider(50, range=0..100)  # disabled
inputfeature = Slider(0, range=0..10)  # disabled
inputfeature_2 = Slider(11, range=11..20)  # disabled
inputfeature_3 = Slider(60, range=21..60)  # disabled
inputfeature_4 = Slider(100, range=0..100)  # disabled
data = Slider(0, range=0..1)  # disabled

inputfeature_5 = Slider(5, range=3..5)
inputfeature_6 = Slider(2, range=1..2)
inputfeature_7 = Slider(10, range=10..25)
inputfeature_8 = Slider(26, range=26..100)
# Logistic Regression
# Wickerson Studios Geometry
# EXAMPLE 2
number_slider_2 = Slider(19, range=1..25)
value_list = ValueList({"One": 0, "Two": 1, "Three": 2, "Four": 3}, selected="One")

# ----
# K-Means clustering
# Wickerson Studios Geometry
# EXAMPLE
startage_3 = Slider(6, range=0..100)
stepage_3 = Slider(8, range=0..10)
step_3 = Slider(3.07, range=0..10)
k_number_3 = Slider(7, range=1..7)
count_3 = Panel("7")

age = Series(Start=startage_3, Step=stepage_3, Count=count_3)
series_5 = Series(Start=count_3, Step=step_3, Count=count_3)
oneliners_kmeansclustering_example_009 = OneLiners_KMeansClustering_EXAMPLE_009(ageList=age, moneyList=series_5, k=k_number_3)  # -> out, a; inputs ageList: list of Int32, moneyList: list, k: Int32
# ---------- oneliners_kmeansclustering_example_009: Python ----------
__author__ = "Sculpture"
__version__ = "2021.05.30"

import rhinoscriptsyntax as rs

#import and do all this JAZZ!
import rhinoscriptsyntax as rs
import scriptcontext as sc
import ghpythonremote

np = sc.sticky['numpy']
scipy = sc.sticky['scipy']
mpl = sc.sticky['matplotlib']
plt = mpl.pyplot
rpy = sc.sticky['rpy']
pandas = sc.sticky['pandas']
skl = sc.sticky['sklearn'] #machine learning models
linm = sc.sticky['sklearn.linear_model']
cluster = sc.sticky['sklearn.cluster']

"""
K-Means Clustering, the one clustering algorithm to know
good for unlabeled data
when unclear about the "optimal output"
prediction is impossible
find clusters fo unlabeled data sets
falls under unsupervised learning
finds k number ofclusters of data 
so that the between the centroid
and the data is minimal
every cluster represents something distinct
requires the num of k cluster centers as an input
"Learning the k in K-Means" by Greg Hamerly and Charles Elkan
"""

#data SEVEN SAMPLES
X = np.array([[ageList[0], moneyList[0]],
                [ageList[1], moneyList[1]],
                [ageList[2], moneyList[2]],
                [ageList[3], moneyList[3]],
                [ageList[4], moneyList[4]],
                [ageList[5], moneyList[5]],
                [ageList[6], moneyList[6]]])

#oneLiner
kmeans = cluster.KMeans(n_clusters=k).fit(X)

#result
cluCen = kmeans.cluster_centers_ #note the use of trailing underscore in scikit
#print(cluCen)
#print(type((cluCen)))
for i in range(k):
    for j in range(2):
        print(cluCen)[i][j]
# ---------- end oneliners_kmeansclustering_example_009 ----------
panel_13 = Panel(oneliners_kmeansclustering_example_009.out)

oneliners_logisticregression_006_2 = OneLiners_logisticRegression_006(
    rang=number_slider_2,
    low=inputfeature_6,
    med=inputfeature_5,
    medHigh=inputfeature_7,
    high=inputfeature_8,
    noYes=value_list)  # -> out, a; inputs rang: Int32, med: Int32, noYes: Int32
# ---------- oneliners_logisticregression_006_2: Python ----------
__author__ = "Sculpture"
__version__ = "2021.05.30"

import rhinoscriptsyntax as rs

#import and do all this JAZZ!
import rhinoscriptsyntax as rs
import scriptcontext as sc
import ghpythonremote

np = sc.sticky['numpy']
scipy = sc.sticky['scipy']
mpl = sc.sticky['matplotlib']
plt = mpl.pyplot
rpy = sc.sticky['rpy']
pandas = sc.sticky['pandas']
skl = sc.sticky['sklearn'] #machine learning models
linm = sc.sticky['sklearn.linear_model']

"""
EXAMPLE with LinearRegression() function
#data (Apple stock prices)
apple = np.array([155, 156, 157])

#oneLiner
model = linm.LinearRegression().fit(np.arange(n).reshape((n,1)), apple)
#result
print(model.predict([[3],[4]]))
"""
#data (3cigarettes, cnacer)
X = np.array([[low, 2],
                [med, 4],
                [medHigh, 9],
                [high, 16]])

#n = len(X)

#oneLiner
#model = linm.LogisticRegression().fit(X[:,0].reshape(n,1), X[:,1])
#or this code -1 if you don't want to type in n = len(X)
model = linm.LogisticRegression().fit(X[:,1].reshape(-1,1), X[:,1])

#look at probabilities
for i in range(rang):
    print((model.predict_proba([[i]])))[0:,noYes]
    
    
#print(model.predict_proba([[x],[y]]))
#print(type(model.predict_proba([[x],[y]])))

#access data
#print(model.predict_proba([[x],[y]]))[0]
#print(model.predict_proba([[x],[y]]))[1]
#print(type((model.predict_proba([[x],[y]]))[0]))
#print(type((model.predict_proba([[x],[y]]))[1]))
# ---------- end oneliners_logisticregression_006_2 ----------
replace_text = ReplaceText(Text=graft(oneliners_logisticregression_006_2.out), Find="[", RecursiveReplace=False)
replace_text_2 = ReplaceText(Text=replace_text, Find="]", RecursiveReplace=False)  # -> flatten(Result)
panel_14 = Panel(replace_text_2)

oneliners_logisticregression_006_3 = OneLiners_logisticRegression_006(
    rang=rangeprob,
    low=inputfeature,
    med=inputfeature_2,
    medHigh=inputfeature_3,
    high=inputfeature_4,
    x=puzzlesample,
    y=puzzlesample_2,
    z=puzzlesample_3,
    noYes=data)  # -> out, a; inputs rang: Int32, med: Int32, noYes: Int32; disabled
# ---------- oneliners_logisticregression_006_3: Python ----------
__author__ = "Sculpture"
__version__ = "2021.05.30"

import rhinoscriptsyntax as rs

#import and do all this JAZZ!
import rhinoscriptsyntax as rs
import scriptcontext as sc
import ghpythonremote

np = sc.sticky['numpy']
scipy = sc.sticky['scipy']
mpl = sc.sticky['matplotlib']
plt = mpl.pyplot
rpy = sc.sticky['rpy']
pandas = sc.sticky['pandas']
skl = sc.sticky['sklearn'] #machine learning models
linm = sc.sticky['sklearn.linear_model']

"""
EXAMPLE with LinearRegression() function
#data (Apple stock prices)
apple = np.array([155, 156, 157])

#oneLiner
model = linm.LinearRegression().fit(np.arange(n).reshape((n,1)), apple)
#result
print(model.predict([[3],[4]]))
"""
#data (3cigarettes, cnacer)
X = np.array([[low, "No"],
                [med, "No"],
                [medHigh, "Yes"],
                [high, "Yes"]])

#n = len(X)

#oneLiner
#model = linm.LogisticRegression().fit(X[:,0].reshape(n,1), X[:,1])
#or this code -1 if you don't want to type in n = len(X)
model = linm.LogisticRegression().fit(X[:,0].reshape(-1,1), X[:,1])

#result and puzzle
print(model.predict([[x],[y],[z]]))

#look at probabilities
for i in range(rang):
    print((model.predict_proba([[i]])))[:,noYes]
    
    
#print(model.predict_proba([[x],[y]]))
#print(type(model.predict_proba([[x],[y]])))

#access data
#print(model.predict_proba([[x],[y]]))[0]
#print(model.predict_proba([[x],[y]]))[1]
#print(type((model.predict_proba([[x],[y]]))[0]))
#print(type((model.predict_proba([[x],[y]]))[1]))
# ---------- end oneliners_logisticregression_006_3 ----------
panel_15 = Panel("")  # disabled
panel_16 = Panel("[")  # disabled
panel_17 = Panel("0")  # disabled
panel_18 = Panel(oneliners_logisticregression_006_3.out)  # disabled
cull_index = CullIndex(List=oneliners_logisticregression_006_3.out, Indices=panel_17, Wrap=True)  # disabled
replace_text_3 = ReplaceText(Text=graft(cull_index), Find=panel_16, Replace=panel_15, RecursiveReplace=False)  # disabled
panel_19 = Panel("]")  # disabled
replace_text_4 = ReplaceText(Text=replace_text_3, Find=panel_19, Replace=panel_15, RecursiveReplace=False)  # disabled
ghpython_script_2 = GhPythonScript(x=replace_text_4)  # -> out, flatten(a); inputs x: list; disabled
# ---------- ghpython_script_2: Python ----------
__author__ = "Sculpture"
__version__ = "2021.06.04"

import rhinoscriptsyntax as rs

a = x[0]
print(type(a))
print(a)
# ---------- end ghpython_script_2 ----------
panel_20 = Panel(ghpython_script_2.a)  # disabled

panel_21 = Panel(series_5)
panel_22 = Panel(oneliners_logisticregression_006_2.out)
# K-Nearest Neighbors
# Wickerson Studios Geometry
# EXAMPLE
# K-Means
# Clustering
startage_4 = Slider(21, range=0..100)
stepage_4 = Slider(8, range=0..10)
step_4 = Slider(24.36, range=0..100)
k_number_4 = Slider(2, range=1..6)
count_4 = Panel("6")

dispatch = Dispatch(List=flatten(oneliners_kmeansclustering_example_009.out), DispatchPattern=[True, False])  # -> ListA, ListB
number = Number(dispatch.ListA)
number_2 = Number(dispatch.ListB)
division = Division(A=number, B=number_2)
number_3 = Number(division)
division_2 = Division(A=number, B=number_3)
division_3 = Division(A=number_2, B=number_3)
circle = Circle(Plane=PlaneXY(0, 0, 0), Radius=division_3)
circle_2 = Circle(Plane=PlaneXY(0, 0, 0), Radius=division_2)
list_length = ListLength(List=circle_2)  # -> flatten(Length)
list_length_2 = ListLength(List=circle)  # -> flatten(Length)
construct_domain = ConstructDomain(DomainStart=0, DomainEnd=list_length)
construct_domain_2 = ConstructDomain(DomainStart=0, DomainEnd=list_length_2)
range = Range(Domain=construct_domain, Steps=list_length)
range_2 = Range(Domain=construct_domain_2, Steps=list_length_2)
unit_z = UnitZ(Factor=range)
unit_z_2 = UnitZ(Factor=range_2)
move = Move(Geometry=circle_2, Motion=unit_z)  # -> Geometry, Transform
move_2 = Move(Geometry=circle, Motion=unit_z_2)  # -> Geometry, Transform
boundary_surfaces = BoundarySurfaces(Edges=move.Geometry)
boundary_surfaces_2 = BoundarySurfaces(Edges=move_2.Geometry)
area = Area(Geometry=boundary_surfaces)  # -> Area, Centroid
area_2 = Area(Geometry=boundary_surfaces_2)  # -> Area, Centroid
unit_x = UnitX(Factor=1)
unit_y = UnitY(Factor=1)
pi = Pi(Factor=number_3)
pi_2 = Pi(Factor=number_3)
number_slider_3 = Slider(8.095, range=0..10)
rotate_3d = Rotate3D(Geometry=move.Geometry, Angle=pi, Center=area.Centroid, Axis=unit_x)  # -> flatten(Geometry), Transform
rotate_3d_2 = Rotate3D(Geometry=move_2.Geometry, Angle=pi_2, Center=area_2.Centroid, Axis=unit_y)  # -> flatten(Geometry), Transform
pipe = Pipe(Curve=rotate_3d.Geometry, Radius=number_slider_3, Caps=1)
pipe_2 = Pipe(Curve=rotate_3d_2.Geometry, Radius=number_slider_3, Caps=1)
solid_intersection = SolidIntersection(BrepsA=pipe, BrepsB=pipe_2)  # -> flatten(Result)
solid_union = SolidUnion(Breps=solid_intersection)

yz_plane = YZPlane(Origin=Point(0, 0, 0))

series_6 = Series(Start=startage_4, Step=stepage_4, Count=count_4)
series_7 = Series(Start=0, Step=step_4, Count=count_4)

number_slider_4 = Slider(17, range=0..100)  # disabled
number_slider_5 = Slider(23, range=0..100)  # disabled

panel_23 = Panel(series_6)
ghpython_script_3 = GhPythonScript(size=series_6, cost=series_7, k=k_number_4, predNum=Slider(82, range=0..200))  # -> out, a; inputs size: list of Int32, cost: list, k: Int32, predNum: Int32
# ---------- ghpython_script_3: Python ----------
__author__ = "Sculpture"
__version__ = "2021.05.30"

import rhinoscriptsyntax as rs

#import and do all this JAZZ!
import rhinoscriptsyntax as rs
import scriptcontext as sc
import ghpythonremote

np = sc.sticky['numpy']
scipy = sc.sticky['scipy']
mpl = sc.sticky['matplotlib']
plt = mpl.pyplot
rpy = sc.sticky['rpy']
pandas = sc.sticky['pandas']
skl = sc.sticky['sklearn'] #machine learning models
linm = sc.sticky['sklearn.linear_model']
cluster = sc.sticky['sklearn.cluster']
nb = sc.sticky['sklearn.neighbors']

"""
K-Nearest Neighbors
KNN is used for regression and classification
image and data forecasting
basis for many advanced ML techniques like information retrieval
KNN is an important building block
The Basics:
the ML models nothing more than a set of observations
this may require sampling or filtering
Given vector x:
    1. find the nearest neighbors of x with predefined distance metric
    2. aggregate into a single prediction or classification value 
        use as mean, average, max, min...
KNN simply calculates the k = 3 neighbors to query D distance
Nearest Neighbors A, B, C
Then KNN aggregates the 3 nearest by simple average of values
Denoted as 3NN
It is necessary to cull out "stale" values from the model
"""

#data (size / cost)
X = np.array([  [size[0], cost[0]],
                [size[1], cost[1]],
                [size[2], cost[2]],
                [size[3], cost[3]],
                [size[4], cost[4]],
                [size[5], cost[5]]])

#oneLiner
KNN = nb.KNeighborsRegressor(n_neighbors=k).fit(X[:,0].reshape(-1,1), X[:,1])

#result
res = KNN.predict([[predNum]])
print(res)
# ---------- end ghpython_script_3 ----------
panel_24 = Panel(series_7)
panel_25 = Panel(ghpython_script_3.out)

# ----
# linear Regression
# EXAMPLE
number_slider_6 = Slider(6, range=-10..10)  # disabled
negative = Negative(Value=number_slider_6)  # disabled

oneliners_linearregressionexample_002 = OneLiners_linearRegressionEXAMPLE_002(x=number_slider_6, y=negative)  # -> out, a; disabled
# ---------- oneliners_linearregressionexample_002: Python ----------
__author__ = "Sculpture"
__version__ = "2021.05.30"

import rhinoscriptsyntax as rs

#import and do all this JAZZ!
import rhinoscriptsyntax as rs
import scriptcontext as sc
import ghpythonremote

np = sc.sticky['numpy']
scipy = sc.sticky['scipy']
mpl = sc.sticky['matplotlib']
plt = mpl.pyplot
rpy = sc.sticky['rpy']
pandas = sc.sticky['pandas']
skl = sc.sticky['sklearn']
linm = sc.sticky['sklearn.linear_model']

#data (Apple stock prices)
apple = np.array([10, 20, 90, 160, 250])
n = len(apple)

#oneLiner
model = linm.LinearRegression().fit(np.arange(n).reshape((n, 1)), apple)

#result
print(model.predict([[x],[y]]))
print(type(model.predict([[x],[y]])))

#access data
print(model.predict([[x],[y]]))[0]
print(model.predict([[x],[y]]))[1]
print(type((model.predict([[x],[y]]))[0]))
print(type((model.predict([[x],[y]]))[1]))

#try something like this
"""
someList = x.Branch(1)    #List[Object]
pythonList = list(someList)

or 

something like this...

import Rhino
#import grasshopper classes
import clr
clr.AddReference("Grasshopper")
from Grasshopper.Kernel.Data import GH_Path
from Grasshopper import DataTree

newlist = {}
newlist = x[:][:]
print newlist
print newlist[:][:]
A = newlist[:][:]

or 

a = []

for path in x.Paths:

    one_list = x.Branch(path)
    print(path)

    first_item = one_list[0]

    a.append(first_item)
"""
# ---------- end oneliners_linearregressionexample_002 ----------

panel_26 = Panel(oneliners_linearregressionexample_002.out)  # disabled

# ----
# use data
# the CODE:
# - pip install sklearn in shell
# -create simple data set and record length
# -build model by calling LinearRegression()
# -to find parameters call fit() function
# to train the model
# -fit() trains the model
# take two parameters: input features
# and ideal output for these inputs
# -matrix with only one column is called
# the column vector
# -scikit-learn allows for a one dimenssional array
# -fit() does error minimization
# -finds model parameters (the means line)
# -predict() function has the same input
# requirements as fit()
# ONTO "classification" and Logisitc Regression
# in one line
panel_27 = Panel("2")  # disabled
list_item = ListItem(List=oneliners_linearregressionexample_002.out, Index=panel_27, Wrap=True)  # -> Item, Item1, Item2; disabled
circle_3 = Circle(Plane=PlaneXY(0, 0, 0), Radius=[list_item.Item, list_item.Item1])  # disabled
# INFERENCE PHASE:
# -use the trained model to predict
# output values for new input features x
# - Note: the model has the power to
# predict outputs for inputs that have
# never been observed in the training data!
# - possess the ability to "generalize"
# - this is the main reason for its popularity
panel_28 = Panel([list_item.Item, list_item.Item1])  # disabled

# ----
# linear Regression
# Wickerson Studios Geometry
# EXAMPLE
number_slider_7 = Slider(16, range=0..120)  # disabled
number_slider_8 = Slider(2, range=0..10)  # disabled
number_slider_9 = Slider(10, range=0..10)  # disabled
number_slider_10 = Slider(8, range=-10..10)  # disabled
square = Square(Value=number_slider_10)  # disabled
negative_2 = Negative(Value=number_slider_10)  # disabled

# ---- group: Series
number_slider_11 = Slider(1, range=0..1)  # disabled
number_slider_12 = Slider(77, range=0..100)  # disabled
series_8 = Series(Start=number_slider_9, Step=number_slider_8, Count=number_slider_7)  # disabled

# ----
jitter = Jitter(List=series_8, Jitter=number_slider_11, Seed=number_slider_12)  # -> Values, Indices; disabled
oneliners_linearregressionexample_002_2 = OneLiners_linearRegressionEXAMPLE_002(apple=jitter.Values, x=number_slider_10, y=square)  # -> out, a; inputs apple: list of Int32; disabled
# ---------- oneliners_linearregressionexample_002_2: Python ----------
__author__ = "Sculpture"
__version__ = "2021.05.30"

import rhinoscriptsyntax as rs

#import and do all this JAZZ!
import rhinoscriptsyntax as rs
import scriptcontext as sc
import ghpythonremote

np = sc.sticky['numpy']
scipy = sc.sticky['scipy']
mpl = sc.sticky['matplotlib']
plt = mpl.pyplot
rpy = sc.sticky['rpy']
pandas = sc.sticky['pandas']
skl = sc.sticky['sklearn']
linm = sc.sticky['sklearn.linear_model']

#data (Apple stock prices)
#apple = np.array([10, 20, 90, 160, 250])
n = len(apple)

#oneLiner
model = linm.LinearRegression().fit(np.arange(n).reshape((n, 1)), apple)

#result
print(model.predict([[x],[y]]))
print(type(model.predict([[x],[y]])))

#access data
print(model.predict([[x],[y]]))[0]
print(model.predict([[x],[y]]))[1]
print(type((model.predict([[x],[y]]))[0]))
print(type((model.predict([[x],[y]]))[1]))
# ---------- end oneliners_linearregressionexample_002_2 ----------
panel_29 = Panel(oneliners_linearregressionexample_002_2.out)  # disabled
panel_30 = Panel(jitter.Values)  # disabled

# ----
# use data
panel_31 = Panel("2")  # disabled
list_item_2 = ListItem(List=oneliners_linearregressionexample_002_2.out, Index=panel_31, Wrap=True)  # -> Item, Item1, Item2; disabled
unit_z_3 = UnitZ(Factor=[list_item_2.Item, list_item_2.Item1])  # disabled
panel_32 = Panel([list_item_2.Item, list_item_2.Item1])  # disabled
circle_4 = Circle(Plane=PlaneXY(0, 0, 0), Radius=[list_item_2.Item, list_item_2.Item1])  # disabled
move_3 = Move(Geometry=circle_4, Motion=unit_z_3)  # -> Geometry, Transform; disabled
unit_x_2 = UnitX(Factor=1)  # disabled
merge = Merge(Data1=list_item_2.Item, Data2=list_item_2.Item1)  # disabled
rotate_3d_3 = Rotate3D(Geometry=move_3.Geometry, Angle=merge, Center=Point(0, 0, 0), Axis=unit_x_2)  # -> Geometry, Transform; disabled
merge_2 = Merge(Data1=circle_4, Data2=rotate_3d_3.Geometry)  # -> flatten(Result); disabled
loft = Loft(Curves=merge_2, Options={Adjust=False, Closed=False, LoftEnds=0, LoftSimp=0, LoftType=0, Rebuild=10, Refit=0.01})  # disabled
cap_holes = CapHoles(Brep=loft)  # disabled
context_bake = ContextBake(Geometry=cap_holes)  # disabled

list_length_3 = ListLength(List=replace_text_2)  # -> flatten(Length)
range_3 = Range(Domain=Slider(40, range=0..100), Steps=expr("x-1", list_length_3))
circle_5 = Circle(Plane=yz_plane, Radius=Slider(21, range=0..100))
evaluate_curve = EvaluateCurve(Curve=reparameterize(circle_5), Parameter=replace_text_2)  # -> Point, Tangent, Angle

unit_x_3 = UnitX(Factor=range_3)
move_4 = Move(Geometry=evaluate_curve.Point, Motion=unit_x_3)  # -> Geometry, Transform

negative_3 = Negative(Value=unit_x_3)
move_5 = Move(Geometry=evaluate_curve.Point, Motion=negative_3)  # -> Geometry, Transform
line = Line(StartPoint=move_4.Geometry, EndPoint=move_5.Geometry)
cull_index_2 = CullIndex(List=line, Indices="0", Wrap=True)
loft_2 = Loft(Curves=cull_index_2, Options={Adjust=False, Closed=False, LoftEnds=0, LoftSimp=0, LoftType=0, Rebuild=10, Refit=0.01})

divide_surface = DivideSurface(Surface=loft_2, UCount="9", VCount="9")  # -> flatten(Points), Normals, Parameters
number_4 = Number(replace_text_2)
multiplication = Multiplication(A=number_4, B=Slider(46, range=0..100))
amplitude = Amplitude(Vector=graft(divide_surface.Normals), Amplitude=graft(multiplication))  # -> flatten(Vector)
move_6 = Move(Geometry=graft(divide_surface.Points), Motion=graft(amplitude))  # -> flatten(Geometry), Transform
panel_33 = Panel(amplitude)
param_viewer = ParamViewer(divide_surface.Points)
surface_from_points = SurfaceFromPoints(Points=move_6.Geometry, UCount=expr("x+1", "9"), Interpolate=False)
surface = Surface(surface_from_points)
surface_2 = Surface(loft_2)
deconstruct_brep = DeconstructBrep(Brep=surface)  # -> Faces, Edges, Vertices
deconstruct_brep_2 = DeconstructBrep(Brep=surface_2)  # -> Faces, Edges, Vertices
list_item_3 = ListItem(List=simplify(flatten(deconstruct_brep_2.Edges)), Index=0, Wrap=True)  # -> Item, Item1, Item2, Item3
list_item_4 = ListItem(List=simplify(flatten(deconstruct_brep.Edges)), Index=0, Wrap=True)  # -> Item, Item1, Item2, Item3
loft_3 = Loft(
    Curves=[list_item_3.Item, list_item_4.Item],
    Options={Adjust=False, Closed=False, LoftEnds=0, LoftSimp=0, LoftType=0, Rebuild=10, Refit=0.01})
loft_4 = Loft(
    Curves=[list_item_3.Item1, list_item_4.Item1],
    Options={Adjust=False, Closed=False, LoftEnds=0, LoftSimp=0, LoftType=0, Rebuild=10, Refit=0.01})
loft_5 = Loft(
    Curves=[list_item_3.Item2, list_item_4.Item2],
    Options={Adjust=False, Closed=False, LoftEnds=0, LoftSimp=0, LoftType=0, Rebuild=10, Refit=0.01})
loft_6 = Loft(
    Curves=[list_item_3.Item3, list_item_4.Item3],
    Options={Adjust=False, Closed=False, LoftEnds=0, LoftSimp=0, LoftType=0, Rebuild=10, Refit=0.01})
merge_3 = Merge(Data1=surface_2, Data2=surface, Data3=loft_3, Data4=loft_4, Data5=loft_5, Data6=loft_6)  # -> flatten(Result)
brep_join = BrepJoin(Breps=merge_3)  # -> Breps, Closed

list_length_4 = ListLength(List=ghpython_script_2.a)  # -> flatten(Length); disabled
range_4 = Range(Domain=number_slider_4, Steps=expr("x-1", list_length_4))  # disabled
circle_6 = Circle(Plane=PlaneXY(0, 0, 0), Radius=number_slider_5)  # disabled
evaluate_curve_2 = EvaluateCurve(Curve=reparameterize(circle_6), Parameter=ghpython_script_2.a)  # -> Point, Tangent, Angle; disabled
unit_z_4 = UnitZ(Factor=range_4)  # disabled
negative_4 = Negative(Value=unit_z_4)  # disabled
move_7 = Move(Geometry=evaluate_curve_2.Point, Motion=negative_4)  # -> Geometry, Transform; disabled
panel_34 = Panel("0")  # disabled

move_8 = Move(Geometry=evaluate_curve_2.Point, Motion=unit_z_4)  # -> Geometry, Transform; disabled

line_2 = Line(StartPoint=move_8.Geometry, EndPoint=move_7.Geometry)  # disabled
cull_index_3 = CullIndex(List=line_2, Indices=panel_34, Wrap=True)  # disabled
loft_7 = Loft(Curves=cull_index_3, Options={Adjust=False, Closed=False, LoftEnds=0, LoftSimp=0, LoftType=0, Rebuild=10, Refit=0.01})  # disabled

# ==== cluster GHPythonRemote: Connects the Grasshopper Python component to an external Python instance.
python = PythonScript()  # -> gh_parent_doc_dir
# ---------- python: Python ----------
from os import path

gh_parent_doc_dir = path.abspath(path.dirname(ghenv.Component.OnPingDocument().Owner.OnPingDocument().FilePath))
# ---------- end python ----------
# GH to python remote example.
# Pierre Cuvilliers, 2017-2018
# Released under the MIT license
# github.com/pilcru/ghpythonremote
# Runs and connects to an external python engine, and
# assigns imported modules to scriptcontext.sticky variables.
# 
# Arguments:
#       code (str): Path to the GH_to_python_sticky.py code file.
#       location (str): Path to a python executable, or to a folder
#             containing `python.exe`, or the name of a conda-created
#             virtual environment prefixed by `conda://` (`conda://env_name`).
#             If empty, finds python from your windows %PATH%.
#       run (boolean): Creates the connection, and imports new
#             modules, when turned to True. Kills the connection,
#             and deletes the references to the imports, when turned
#             to False.
#       modules (str list): List of module names to import in the
#             remote python. They will be added to the
#             scriptcontext.sticky dictionary, allowing them to be
#             reused from other python components in the same
#             Grasshopper document. Submodules (for example
#             `numpy.linalg` have to be added explicitly to this list
#             to be available later.
#       log_level (str from ['NOTSET', 'DEBUG', 'INFO', 'WARNING', 'ERROR', 'CRITICAL']):
#             Logging level to use for the local IronPython and the
#             remote python instance.
#       working_dir (str): Working directory for the remote python
#             instance.
# 
# Returns:
#       out (str): Console output with DEBUG information.
#       linked_modules (str list): list of imported module names.
#       rpy (rpyc connection object): The object representing the
#             remote Python interpreter.
location = ClusterInput()  # location (str): Path to a python executable, or to a folder containing `python.exe`, or the name of a conda-created virtual environment prefixed by `conda://` (`conda://env_name`). If empty, finds python from your windows %PATH%.
run = ClusterInput()  # run (boolean): Creates the connection, and imports new modules, when turned to True. Kills the connection,and deletes the references to the imports, when turned to False.
modules = ClusterInput()  # modules (str list): List of module names to import in the remote python. They will be added to the scriptcontext.sticky dictionary, allowing them to be reused from other python components in the same Grasshopper document. Submodules (for example `numpy.linalg` have to be added explicitly to this list to be available later.
list = ValueList({"CRITICAL", "ERROR", "WARNING", "INFO", "DEBUG", "NOTSET"}, selected="DEBUG")
panel = Panel(python)
ghpythonremote = GHPythonRemote(location=location, run=run, modules=modules, log_level=list, working_dir=panel)  # -> out, linked_modules, rpy; inputs run: Boolean, modules: list
# ---------- ghpythonremote: Python ----------
import inspect
import logging
from os import path
import sys
from time import sleep

import scriptcontext

import ghpythonremote
from ghpythonremote.connectors import GrasshopperToPythonRemote

local_log_level = getattr(logging, log_level, logging.WARNING)
logger = logging.getLogger("ghpythonremote")
logger.setLevel(local_log_level)
ch = logging.StreamHandler()
ch.setLevel(local_log_level)
formatter = logging.Formatter("%(levelname)s: %(name)s:\n%(message)s")
ch.setFormatter(formatter)
logger.handlers = []
logger.addHandler(ch)
logger = logging.getLogger("ghpythonremote.GH_to_python")

ROOT = path.abspath(path.dirname(inspect.getfile(ghpythonremote)))
rpyc_server_py = path.join(ROOT, "pythonservice.py")

# Set connection to CLOSED if this is the first run
# and initialize set of linked modules
try:
    remote_python_status
except NameError:
    remote_python_status = "CLOSED"
    lkd_modules = set()

# Wait for connection to connect or terminate
timer = 0
while remote_python_status == "CONNECTING" or remote_python_status == "CLOSING":
    sleep(1)
    timer += 1
    if timer == 10:
        try:
            gh2py_manager.__exit__(*sys.exc_info())
        except Exception:
            pass
        remote_python_status = "CLOSED"
        lkd_modules = set()
        raise RuntimeError(
            "Connection left in an inconsistent state and not returning. Reset "
            "everything."
        )

if run:
    if not remote_python_status == "OPEN":
        remote_python_status = "CONNECTING"
        gh2py_manager = GrasshopperToPythonRemote(
            rpyc_server_py,
            location=location,
            timeout=10,
            port=None,
            log_level=log_level,
            working_dir=working_dir,
        )
        gh2py = gh2py_manager.__enter__()
        remote_python_status = "OPEN"

    # Stuff that we can reach
    rpymod = gh2py.py_remote_modules  # A getter function for a named python module
    rpy = gh2py.connection  # Represents the remote instance root object
    scriptcontext.sticky["rpy"] = rpy
    # Add modules
    for mod in modules:
        try:
            scriptcontext.sticky[mod] = rpymod(mod)
            lkd_modules.add(mod)
        except ImportError:
            gh2py_manager.__exit__(*sys.exc_info())
            raise

elif not remote_python_status == "CLOSED":
    remote_python_status = "CLOSING"
    # Remove linked modules
    for mod in lkd_modules:
        del scriptcontext.sticky[mod]
    del scriptcontext.sticky["rpy"]
    gh2py_manager.__exit__(*sys.exc_info())
    lkd_modules = set()
    remote_python_status = "CLOSED"

# Change variable name because ghpython resets outputs to None before each run
linked_modules = lkd_modules

logger.info("GH to python connection is {}".format(remote_python_status))
# ---------- end ghpythonremote ----------
out = ClusterOutput(ghpythonremote.out)  # Console output.
linked_modules = ClusterOutput(ghpythonremote.linked_modules)  # Names of modules that were successfully added to the scriptcontext.sticky dictionary.
rpy = ClusterOutput(ghpythonremote.rpy)  # The object representing the remote python instance
python_2 = PythonScript(module_names=ghpythonremote.linked_modules)  # -> import_statements; inputs module_names: list
# ---------- python_2: Python ----------
import_statements = ["import scriptcontext as sc"]
for module_name in module_names:
    import_statements.append("{0} = sc.sticky['{0}']".format(module_name))

if len(module_names) == 0:
    import_statements = []
# ---------- end python_2 ----------
import_statements = ClusterOutput(python_2)  # Useful import statements to use the imported modules in your scripts.
