# Grasshopper definition INTERMEDIATE__MASTER_032.gh (Grasshopper 1.0.7)
# Copyright: © 2017-2018 Pierre Cuvilliers, Caitlin Mueller, Massachusetts Institute of Technology
# plug-ins: Bifocals

# ----
# treehelpers
number_slider = Slider(2, range=0..10)
number_slider_2 = Slider(4, range=0..10)
multiplication = Multiplication(A=number_slider, B=number_slider_2)
oneloner_intermediate_treehelper_002 = OneLoner_Intermediate_treehelper_002(range=multiplication, x=number_slider, y=number_slider_2)  # -> out, a; inputs range: Int32, x: Int32, y: Int32
# ---------- oneloner_intermediate_treehelper_002: Python ----------
__author__ = "Sculpture"
__version__ = "2021.05.29"

import rhinoscriptsyntax as rs

import scriptcontext as sc
import ghpythonremote
from ghpythonlib.treehelpers import list_to_tree  # Rhino 6 only!
np = sc.sticky['numpy']

a = np.arange(range).reshape((x,y))
a = ghpythonremote.obtain(a.tolist())
a = list_to_tree(a, source=[0,0])
# ---------- end oneloner_intermediate_treehelper_002 ----------
panel = Panel(oneloner_intermediate_treehelper_002.a)

# ----
# oneLiners_Basic_Intermediate
# GH Python Remote Node Setup
panel_2 = Panel("""numpy
scipy
numpy.linalg
matplotlib
matplotlib.pyplot
pandas""")
# GH Python Remote
# Node Setup
panel_3 = Panel("C:\Users\Sculpture\.conda\envs\rhinoremote")
gh_python_remote = GHPythonRemote(location=panel_3, run=Toggle(True), modules=panel_2)  # -> out, linked_modules, rpy, import_statements
panel_4 = Panel(gh_python_remote.import_statements)
panel_5 = Panel(gh_python_remote.linked_modules)

# ----
# DATA SCIENCE: NumPy, Pandas, scikit-learn, TensorFlow
# test Range
oneliners_intermediate_testrange_001 = OneLiners_Intermediate_testRange_001()  # -> out, a
# ---------- oneliners_intermediate_testrange_001: Python ----------
__author__ = "Sculpture"
__version__ = "2021.05.29"

import rhinoscriptsyntax as rs
import scriptcontext as sc
import ghpythonremote

np = sc.sticky['numpy']
rpy = sc.sticky['rpy']

r_range = ghpythonremote.deliver(rpy, range(100))
print(np.array(r_range))
# ---------- end oneliners_intermediate_testrange_001 ----------
panel_6 = Panel(oneliners_intermediate_testrange_001.out)

# ---- group: All that JAZZ
# Base Script Jazz
ghpython_script = GhPythonScript()  # -> out, a
# ---------- ghpython_script: Python ----------
__author__ = "Sculpture"
__version__ = "2021.05.30"

import rhinoscriptsyntax as rs

#import and do all this JAZZ!
import rhinoscriptsyntax as rs
import scriptcontext as sc
import ghpythonremote
np = sc.sticky['numpy']
# ---------- end ghpython_script ----------

# ----
# Create Dimensional Array
# Create Dimensional Array
# Create Three Dimensional Array
number_slider_3 = Slider(2, range=0..10)
oneliner_onedimensionalarray_003 = Oneliner_oneDimensionalArray_003(x=number_slider_3, y=Slider(5, range=0..10), z=Slider(8, range=0..10))  # -> out, a; inputs x: Int32, y: Int32, z: Int32
# ---------- oneliner_onedimensionalarray_003: Python ----------
__author__ = "Sculpture"
__version__ = "2021.05.30"

import rhinoscriptsyntax as rs
#import these libraries and set variable np
import scriptcontext as sc
import ghpythonremote
np = sc.sticky['numpy']

#NumPy is a wildly important library for numerical computations and data science
#arrays hold the data that you want to manipulate, analyze and visualize
#multidimensional data
#an array with two axes is a two-dimensional array
#more access functionality, such as broadcasting

#creating a 1D array from a list with np is faster (less memory)

a = np.array([x, y, z])
print(a)
print(type(a))
# ---------- end oneliner_onedimensionalarray_003 ----------
oneliners_twodimensionalarray_004 = Oneliners_twoDimensionalArray_004(x=Slider(2, range=0..10), y=Slider(5, range=0..10), z=Slider(10, range=0..10), u=Slider(7, range=0..10))  # -> out, b; inputs x: Int32, y: Int32, z: Int32, u: Int32
# ---------- oneliners_twodimensionalarray_004: Python ----------
__author__ = "Sculpture"
__version__ = "2021.05.30"

import rhinoscriptsyntax as rs
#import these libraries and set variable np
import scriptcontext as sc
import ghpythonremote
np = sc.sticky['numpy']

#NumPy is a wildly important library for numerical computations and data science
#arrays hold the data that you want to manipulate, analyze and visualize
#multidimensional data
#an array with two axes is a two-dimensional array
#more access functionality, such as broadcasting

#creating a 2D array from a list of lists with np is faster (less memory)

b = np.array(  [[x, y],
                [z, u]])
print(b)
print(type(b))
# ---------- end oneliners_twodimensionalarray_004 ----------
oneliners_threedimensionalarray_005 = Oneliners_threeDimensionalArray_005(
    x=Slider(2, range=0..10),
    y=Slider(4, range=0..10),
    z=Slider(10, range=0..10),
    u=Slider(7, range=0..10),
    v=Slider(5, range=0..10),
    w=Slider(6, range=0..10))  # -> out, c; inputs x: Int32, y: Int32, z: Int32, u: Int32, v: Int32, w: Int32
# ---------- oneliners_threedimensionalarray_005: Python ----------
__author__ = "Sculpture"
__version__ = "2021.05.30"

import rhinoscriptsyntax as rs
#import these libraries and set variable np
import scriptcontext as sc
import ghpythonremote
np = sc.sticky['numpy']

#NumPy is a wildly important library for numerical computations and data science
#arrays hold the data that you want to manipulate, analyze and visualize
#multidimensional data
#an array with two axes is a two-dimensional array
#more access functionality, such as broadcasting

#creating a 2D array from a list of lists of lists
#with np is faster (less memory)

c = np.array(  [[x, y],
                [z, u],
                [v, w]])
print(c)
print(type(c))
# ---------- end oneliners_threedimensionalarray_005 ----------
panel_7 = Panel(oneliners_twodimensionalarray_004.out)
panel_8 = Panel(oneliner_onedimensionalarray_003.out)
panel_9 = Panel(oneliner_onedimensionalarray_003.a)
panel_10 = Panel(oneliners_twodimensionalarray_004.b)
panel_11 = Panel(oneliners_threedimensionalarray_005.out)
panel_12 = Panel(oneliners_threedimensionalarray_005.c)

# ----
# oneLiners_Intermediate
# Three Dimensional
# Array Arithmetic
# NUMPY
# FEEL THE POWER!
number_slider_4 = Slider(3, range=0..10)
oneliners_mutlidimensionalarrayarithmeti = OneLiners_mutliDimensionalArrayArithmetic_006(x=number_slider_4, y=Slider(5, range=1..10))  # -> out, a; inputs x: Int32, y: Int32
# ---------- oneliners_mutlidimensionalarrayarithmeti: Python ----------
__author__ = "Sculpture"
__version__ = "2021.05.30"

import rhinoscriptsyntax as rs

#import and do all this JAZZ!
import rhinoscriptsyntax as rs
import scriptcontext as sc
import ghpythonremote
np = sc.sticky['numpy']

"""
NumPy has other data types but we will use numbers
use list, list of lists, lists of lists of lists
more poserful +, -, *, / 
use these on two arrays
aggregates two elements that are in the same position
"""

a = np.array   ([[1, 0, 0],
                 [1, x, 1],
                 [2, 0, 0]])
                 
b = np.array   ([[1, 1, 1],
                 [1, 1, 2],
                 [1, 1, y]])
                 
print(a + b)
print(a - b)
print(a * b)
print(a / b)

#can you feel the power!
# ---------- end oneliners_mutlidimensionalarrayarithmeti ----------
panel_13 = Panel(oneliners_mutlidimensionalarrayarithmeti.out)

# ----
# oneLiner Solution
# using Basic
# Array Arithmetic
minus_the_sidecar = Slider(0.335, range=0..1)
oneliners_solutionusingarrayarithmetic_0 = OneLiners_solutionUsingArrayArithmetic_008(x=minus_the_sidecar)  # -> out, a; inputs x: Int32
# ---------- oneliners_solutionusingarrayarithmetic_0: Python ----------
__author__ = "Sculpture"
__version__ = "2021.05.30"

import rhinoscriptsyntax as rs

#import and do all this JAZZ!
import rhinoscriptsyntax as rs
import scriptcontext as sc
import ghpythonremote
np = sc.sticky['numpy']

#how to find maximum juice in a group given bottles and sidecars
# biggest bottle isn't always the most "juice"

#dependencies
#data: main bottle in millelitres for 3 different smaller sidecar bottles

coke = [10, 120, 161]
pepsi = [80, 120, 160]
drPepper = [40, 141, 142]

sizes = np.array([coke, pepsi, drPepper])
"""
sidecars = ([[.2, 0.25, 0.22],
            [0.4, 0.5, 0.5],
            [0.1, 0.2, 0.1]])
"""
sidecars = ([[0.0, 0.0, 0.0],
            [0.0, 0.0, 0.0],
            [0.0, 0.0, 0.0]])
"""
sidecars = ([[x, 0.25, 0.22],
            [0.4, x, 0.5],
            [0.1, 0.2, x]])
"""
#oneLiner
max_juice = np.max(sizes + sizes * sidecars)
#called the Hadamard product
print(max_juice)
print(sizes - sizes * sidecars)
# ---------- end oneliners_solutionusingarrayarithmetic_0 ----------
panel_14 = Panel(oneliners_solutionusingarrayarithmetic_0.out)

# ----
# Calculating Min, Max and Average
# of NumPy Array
number_slider_5 = Slider(6, range=0..10)
oneliners_maxminaveragearray_007 = OneLiners_maxMinAverageArray_007(x=number_slider_5, y=Slider(8, range=0..10))  # -> out, a; inputs x: Int32, y: Int32
# ---------- oneliners_maxminaveragearray_007: Python ----------
__author__ = "Sculpture"
__version__ = "2021.05.30"

import rhinoscriptsyntax as rs

#import and do all this JAZZ!
import rhinoscriptsyntax as rs
import scriptcontext as sc
import ghpythonremote
np = sc.sticky['numpy']

#floats have an interesting output, 1., 3., 0.5, etc...
#check out mp.max() and np.min() and the no.average() functions

a = np.array   ([[1, 0, 0],
                 [1, x, 1],
                 [2, 0, y]])
                 
print(np.max(a))
print(np.min(a))
print(np.average(a))
# ---------- end oneliners_maxminaveragearray_007 ----------
panel_15 = Panel(oneliners_maxminaveragearray_007.out)

# ----
# Tuple elements
# and Dimensionality
oneliners_tupleelementsanddimensionality = OneLiners_tupleElementsAndDimensionality_012()  # -> out, a, b, c
# ---------- oneliners_tupleelementsanddimensionality: Python ----------
__author__ = "Sculpture"
__version__ = "2021.05.30"

import rhinoscriptsyntax as rs

#import and do all this JAZZ!
import rhinoscriptsyntax as rs
import scriptcontext as sc
import ghpythonremote
np = sc.sticky['numpy']

# NOTE: if you increase the dimensionality of an array, the new axis becomes axis 0,
# and the i-th axis of the low-dim array becomes the (i + 1)-th axis of the high_dim array

a = np.array([11, 22, 33])
print(a)
print(a.shape) 

b = np.array([[11, 22, 33], [44, 55, 66], [77, 88, 99]])
print(b)
print(b.shape)

c = np.array(  [[[11, 22, 33], [44, 55, 66], [77, 88, 99]],
               [[111, 222, 333], [444, 555, 666], [777, 888, 999]]])
print(c)
print(c.shape)
# ---------- end oneliners_tupleelementsanddimensionality ----------
panel_16 = Panel(oneliners_tupleelementsanddimensionality.out)
# Broadcasting is the act of converting a low-
# dim array into a higher-dim array to perform
# element-wise operations
panel_17 = Panel([oneliners_tupleelementsanddimensionality.a, oneliners_tupleelementsanddimensionality.b, oneliners_tupleelementsanddimensionality.c])

# ----
# NumPy Concepts
# Slicing and Broadcasting
# and Array Types
oneliners_slicingindexing_009 = OneLiners_slicingIndexing_009()  # -> out, a
# ---------- oneliners_slicingindexing_009: Python ----------
__author__ = "Sculpture"
__version__ = "2021.05.30"

import rhinoscriptsyntax as rs

#import and do all this JAZZ!
import rhinoscriptsyntax as rs
import scriptcontext as sc
import ghpythonremote
np = sc.sticky['numpy']

#we will try and adjust just some particular values in the example
#we just want to change specific values in a NumPy array with many rows

#slicing and indexing
a = np.array([55, 56, 57, 58, 59, 60, 61])
print(a)
print(a[:])
print(a[2:])
print(a[1:4])
print(a[2:-2])
print(a[::2])
print(a[1::2])
print(a[::-1])
print(a[:1:-2])
print(a[-2:1:-1])
#try some more negatives, [::0] error , can't step by 0
# ---------- end oneliners_slicingindexing_009 ----------
# oneLiners_Intermediate continued
# Homogenous Values
# NumPy Arrays all have the same type
# 
# Here shows how to create
# NumPy arrays with different types:
# bool 1 byte
# int 4 or 8 bytes
# float 8 bytes
# complex 16 bytes
# np.int8 1 byte
# np.int16 2 bytes
# np.int32 4 bytes
# np.int64 8 bytes
# np.float16 2 bytes
# np.float32 4 bytes
# np.float64 8 bytes
panel_18 = Panel(oneliners_slicingindexing_009.out)

# ----
# Broadcasting
# shape attribute
# axes, shapes and broadcasting
oneliners_axisshapebroadcasting_011 = OneLiners_axisShapeBroadcasting_011()  # -> out, a, b, c
# ---------- oneliners_axisshapebroadcasting_011: Python ----------
__author__ = "Sculpture"
__version__ = "2021.05.30"

import rhinoscriptsyntax as rs

#import and do all this JAZZ!
import rhinoscriptsyntax as rs
import scriptcontext as sc
import ghpythonremote
np = sc.sticky['numpy']

# attributes
#axes, shapes, and broadcasting

a = np.array([11, 22, 33])
print(a.ndim) #array attribute ndim stores number of axes
# the number of tuple values specifies the dimensionality of the NumPy array

b = np.array([[11, 22, 33], [44, 55, 66], [77, 88, 99]])
print(b.ndim)

c = np.array(   [[[11, 22, 33], [44, 55, 66], [77, 88, 99]],
                [[111, 222, 333], [444, 555, 666], [777, 888, 999]]])
print(c.ndim)
# ---------- end oneliners_axisshapebroadcasting_011 ----------
panel_19 = Panel(oneliners_axisshapebroadcasting_011.out)
panel_20 = Panel([oneliners_axisshapebroadcasting_011.a, oneliners_axisshapebroadcasting_011.b, oneliners_axisshapebroadcasting_011.c])

# ----
# NumPy Concepts Multidimensional Slicing
oneliners_multidimensionalslicing_010 = OneLiners_multidimensionalSlicing_010()  # -> out, a
# ---------- oneliners_multidimensionalslicing_010: Python ----------
__author__ = "Sculpture"
__version__ = "2021.05.30"

import rhinoscriptsyntax as rs

#import and do all this JAZZ!
import rhinoscriptsyntax as rs
import scriptcontext as sc
import ghpythonremote
np = sc.sticky['numpy']

#understanding multidimensional slicing
#apply one-dimensional slicing separately for each axis to select range of elements along the axis
#fully understand this...

a = np.array([[10, 11, 12, 13],
                [14, 15, 16, 17],
                [18, 19, 20, 21]])
                
print(a[:,2]) #prints third column
print(a[2,:]) #prints third row

print(a[1, ::2]) #prints second row, every other element
print(a[:, :-1]) #prints all columns except the last one
print(a[:-2]) #prints same as a[:-2, :] first row

#try some more and guess outcome
#start, stop slicing is the same as start, stop, step slicing
#if you understand the basic idea, multidimensional slicing is trivial
# ---------- end oneliners_multidimensionalslicing_010 ----------
panel_21 = Panel(oneliners_multidimensionalslicing_010.out)

# ----
# Conditional Array Search
# Filtering and Broadcasting
# to Detect Outliers EXAMPLE
number_slider_6 = Slider(31, range=30..31)
oneliners_conditionalfilteringdetectoutl = OneLiners_conditionalFilteringDetectOutliers_016(age=number_slider_6)  # -> out, a; inputs age: Int32
# ---------- oneliners_conditionalfilteringdetectoutl: Python ----------
__author__ = "Sculpture"
__version__ = "2021.05.30"

import rhinoscriptsyntax as rs

#import and do all this JAZZ!
import rhinoscriptsyntax as rs
import scriptcontext as sc
import ghpythonremote
np = sc.sticky['numpy']

#Dependencies

#data: age index data (ages = person)
X = np.array(
    [[12, 24, 35, 46, 57], #Mike
    [21, 32, 43, 54, 65], #Beth
    [age, age, age, age, age], #Oscar
    [11, 12, 13, 14, 15]]) #Ella

people = np.array(["Mike", "Beth", "Oscar", "Ella"])

#oneLiner
older = set(people[np.nonzero(X > np.average(X))[0]])
#very cool
#check is above average to true
#checks if nonzero and creates two tuples (rows and columns)
#just need rows for names
#python set() removes duplicates 

#result
print(older)
# ---------- end oneliners_conditionalfilteringdetectoutl ----------
panel_22 = Panel(oneliners_conditionalfilteringdetectoutl.out)

# ----
# Conditional Array Search
# Filtering and Broadcasting
# to Detect Outliers
oneliners_conditionalfilteringdetectoutl_2 = OneLiners_conditionalFilteringDetectOutliers_015()  # -> out, a
# ---------- oneliners_conditionalfilteringdetectoutl_2: Python ----------
__author__ = "Sculpture"
__version__ = "2021.05.30"

import rhinoscriptsyntax as rs

#import and do all this JAZZ!
import rhinoscriptsyntax as rs
import scriptcontext as sc
import ghpythonremote
np = sc.sticky['numpy']

#finding outliers in data sets
#find elements in NumPy array that meet certain conditions
# offer the function nonzero(), finds elements in array that != 0

x = np.array([[1, 0, 0],
            [0, 2, 2],
            [3, 0, 0]])
# found in positions X[0,0], X[1,1], X[1,2] and X[2,0]
print(np.nonzero(x))

#use another great NumPy feature: Boolean array operators with broadcasting
# boolean operator "=="
print(x == 2)
# ---------- end oneliners_conditionalfilteringdetectoutl_2 ----------
panel_23 = Panel(oneliners_conditionalfilteringdetectoutl_2.out)

# ----
# Homogenous Values Example
# slicing, broadcasting, array types
oneliners_homogenousvaluesexample_014 = OneLiners_homogenousValuesExample_014()  # -> out, a
# ---------- oneliners_homogenousvaluesexample_014: Python ----------
__author__ = "Sculpture"
__version__ = "2021.05.30"

import rhinoscriptsyntax as rs

#import and do all this JAZZ!
import rhinoscriptsyntax as rs
import scriptcontext as sc
import ghpythonremote
np = sc.sticky['numpy']

#solution using slicing and slice assignment

#data: daily wage [2001, 2002, 2003]
Pope =      [111,222,333]
Cardinal=   [123, 234, 345]
Fisherman=  [321, 211, 121]
Peasant=    [12, 34, 45]

members = np.array([Pope,
                    Cardinal,
                    Fisherman,
                    Peasant])

#oneLiner
members[0,::2] = members[0,::2] * 1.25

#result uses slicing, broadcasting, and Array Type
# broadcasting actually does: np.array([111,333])*np.array([1.25,1.25])
# Array Types: actually rounds down to the int value your started with
# try having a float in the initial array and watch the change
print(members)
print(members.dtype)
# ---------- end oneliners_homogenousvaluesexample_014 ----------
panel_24 = Panel(oneliners_homogenousvaluesexample_014.out)

# ----
# Homogenous Values
oneliners_homogenousvalues_013 = OneLiners_homogenousValues_013()  # -> out, a
# ---------- oneliners_homogenousvalues_013: Python ----------
__author__ = "Sculpture"
__version__ = "2021.05.30"

import rhinoscriptsyntax as rs

#import and do all this JAZZ!
import rhinoscriptsyntax as rs
import scriptcontext as sc
import ghpythonremote
np = sc.sticky['numpy']

a = np.array([1, 2, 3, 5])
b = np.array([1, 2, 3, 4], dtype=np.int16)
c = np.array([1, 2, 3, 3], dtype=np.float64)
print(a)
print(a.dtype)
print(b)
print(b.dtype)
print(c)
print(c.dtype)

#takeaway, NumPy gives you control over the datatype
#a NumPy array is homogenous
# ---------- end oneliners_homogenousvalues_013 ----------
panel_25 = Panel(oneliners_homogenousvalues_013.out)

# ----
# Boolean Indexing to Filter
# Two-Dimensional Arrays
# Boolean Indexing to Filter
# Two-Dimensional Arrays
# EXAMPLE - Pandas error
oneliner_booleanindexingfilter2darray_01 = OneLiner_booleanIndexingFilter2DArray_017()  # -> out, a
# ---------- oneliner_booleanindexingfilter2darray_01: Python ----------
__author__ = "Sculpture"
__version__ = "2021.05.30"

import rhinoscriptsyntax as rs

#import and do all this JAZZ!
import rhinoscriptsyntax as rs
import scriptcontext as sc
import ghpythonremote
np = sc.sticky['numpy']

#strengthen multidimensional slicing and indexing

#data array
a = np.array([[1, 2, 3],
            [4, 5, 6],
            [7, 8, 9]])
#index array
indices = np.array([[False, False, True],
                    [False, False, False],
                    [True, True, False]])
# if indices[i,j]==True, the new array contains the value a[i,j], else it does not

print(a[indices])
# ---------- end oneliner_booleanindexingfilter2darray_01 ----------
panel_26 = Panel(oneliner_booleanindexingfilter2darray_01.out)

# ----
# the Axis Argument EXAMPLE
oneliners_theaxisargumentexample_021 = OneLiners_theAxisArgumentEXAMPLE_021()  # -> out, a
# ---------- oneliners_theaxisargumentexample_021: Python ----------
__author__ = "Sculpture"
__version__ = "2021.05.30"

import rhinoscriptsyntax as rs

#import and do all this JAZZ!
import rhinoscriptsyntax as rs
import scriptcontext as sc
import ghpythonremote
np = sc.sticky['numpy']

#replace every 7th element with the average of the last 7 days including the 7th day

# Sensor data (m, t, w, th, f, sa, su)
tmp = np.array([1, 2, 3, 4, 2, 3, 4, 5, 3, 5, 2, 3, 4, 5, 6, 5, 3, 4, 5, 3, 1])
#oneLiner
tmp[6::7] = np.average(tmp.reshape((-1,7)), axis=1)

#result
print(tmp)
print(tmp.reshape((-1,7)))
print(np.average(tmp.reshape((-1,7)), axis=1))
# ---------- end oneliners_theaxisargumentexample_021 ----------
panel_27 = Panel(oneliners_theaxisargumentexample_021.out)

# ----
# the Axis Argument
oneliners_theaxisargument_020 = OneLiners_theAxisArgument_020()  # -> out, a
# ---------- oneliners_theaxisargument_020: Python ----------
__author__ = "Sculpture"
__version__ = "2021.05.30"

import rhinoscriptsyntax as rs

#import and do all this JAZZ!
import rhinoscriptsyntax as rs
import scriptcontext as sc
import ghpythonremote
np = sc.sticky['numpy']

#calculate the average at three different times

#daily numbers [early, mid, late]
stocks = np.array(
        [[1, 2, 3], #monday
        [2, 3, 4]]) #friday
        
#mid - weighted average
print(np.average(stocks, axis=0)) #collapse everything along axis 0
# ---------- end oneliners_theaxisargument_020 ----------
panel_28 = Panel(oneliners_theaxisargument_020.out)

# ----
# Broadcasting, Slice Assignment,
# and Reshaping to Clean
# Every i-th Array Element
oneliners_broadcastingsliceassreshapecle = OneLiners_broadcastingSliceAssReshapeCleanElements_019()  # -> out, a
# ---------- oneliners_broadcastingsliceassreshapecle: Python ----------
__author__ = "Sculpture"
__version__ = "2021.05.30"

import rhinoscriptsyntax as rs

#import and do all this JAZZ!
import rhinoscriptsyntax as rs
import scriptcontext as sc
import ghpythonremote
np = sc.sticky['numpy']

#clean and eliminate erroneous data points
#slice assignment

a = np.array([4] * 16)
print(a)

a[1::] = [55] * 15
print(a)

a[1:8:2] = 16
print(a)

#need to learn about function: the x.reshape((a,b))
#turns array x into a new NumPy array with a rows and b columns with a shape (a,b)

a = np.array([1, 2, 3, 4, 5, 6])
print(a.reshape((2,3)))
#figures the amount of columns out for you, nice
print(a.reshape((2,-1)))
# ---------- end oneliners_broadcastingsliceassreshapecle ----------
panel_29 = Panel(oneliners_broadcastingsliceassreshapecle.out)

# ----
# How to Create Advanced Array Filters
# with Statistics, Math, and Logic
# matplotlib.pyplot as plt
oneliners_matplotlibstatsmathlogic_024 = OneLiners_MATPLOTLIBstatsMathLogic_024()  # -> out, a
# ---------- oneliners_matplotlibstatsmathlogic_024: Python ----------
__author__ = "Sculpture"
__version__ = "2021.05.30"

import rhinoscriptsyntax as rs

#import and do all this JAZZ!
import rhinoscriptsyntax as rs
import scriptcontext as sc
import ghpythonremote

np = sc.sticky['numpy']
scipy = sc.sticky['scipy']
mpl = sc.sticky['matplotlib']
plt = mpl.pyplot
rpy = sc.sticky['rpy']

"""
plt = sc.sticky['matplotlib']
when plt.show() is executed a graph window will show up
statement will only return when the plot is closed by pressing “q” 
"""

sequence = np.random.normal(10.0, 1.0, 500)
print(sequence)

plt.xkcd()
#the name of the xkcd plot is taken from the popular web comic page
#http://xkcd.com/
plt.hist(sequence)
plt.annotate(r"$\omega_1=9$", (9,70))
#plt.annotate(r"$\omega_2=11$", (11,70))
#plt.annotate(r"$\mu=10$", (10,90))

#plt.savefig("plot.jpg") NOT WORKING

plt.show()
# ---------- end oneliners_matplotlibstatsmathlogic_024 ----------
panel_30 = Panel(oneliners_matplotlibstatsmathlogic_024.out)

# ----
# sort() and argsort()
number_slider_7 = Slider(0, range=0..1)
oneliners_sort_argsort__023 = OneLiners_sortArgsort_023(x=number_slider_7)  # -> out, a; inputs x: Int32
# ---------- oneliners_sort_argsort__023: Python ----------
__author__ = "Sculpture"
__version__ = "2021.05.30"

import rhinoscriptsyntax as rs

#import and do all this JAZZ!
import rhinoscriptsyntax as rs
import scriptcontext as sc
import ghpythonremote
np = sc.sticky['numpy']

#sorting along the axis

a = np.array([[131, 313, 414],
               [322, 133, 242],
               [616, 424, 671]])

print(np.sort(a, axis=x))
print(np.argsort(a, axis=x))
# ---------- end oneliners_sort_argsort__023 ----------
panel_31 = Panel(oneliners_sort_argsort__023.out)

# ---- group: All that JAZZ
# oneLiners_Intermediate continued
# Base Script Jazz
ghpython_script_2 = GhPythonScript()  # -> out, a
# ---------- ghpython_script_2: Python ----------
__author__ = "Sculpture"
__version__ = "2021.05.30"

import rhinoscriptsyntax as rs

#import and do all this JAZZ!
import rhinoscriptsyntax as rs
import scriptcontext as sc
import ghpythonremote

np = sc.sticky['numpy']
scipy = sc.sticky['scipy']
mpl = sc.sticky['matplotlib']
plt = mpl.pyplot
rpy = sc.sticky['rpy']
pandas = sc.sticky['pandas']

"""
when plt.show() is executed a graph window will show up
statement will only return when the plot is closed by pressing “q” 
"""
# ---------- end ghpython_script_2 ----------

# ----
# Use Lambda Functions
# and Boolean Indexing to
# Filter Arrays
oneliners_lambdafunctionsbooleanindexing = OneLiners_lambdaFunctionsBooleanIndexingFilter_024()  # -> out, a
# ---------- oneliners_lambdafunctionsbooleanindexing: Python ----------
__author__ = "Sculpture"
__version__ = "2021.05.30"

import rhinoscriptsyntax as rs

#import and do all this JAZZ!
import rhinoscriptsyntax as rs
import scriptcontext as sc
import ghpythonremote
np = sc.sticky['numpy']

#get rid of noise, make data accessible and create meaning
#create a minimal filter function
#lambda arguments : expression

#data (row - [title, rating])
"""
books = np.array([["Happy Days", 3.6],
                    ["Bilbo", 2.6],
                    ["Tocoman", 6.5],
                    ["Sally Beans", 9.3],
                    ["Frog Pockets", 4.5]])
"""
books = np.array([[111, 3.6],
                    [222, 2.6],
                    [333, 6.5],
                    [444, 9.3],
                    [555, 4.5]])

#oneLiners
#prediction = lambda x, y : x[x[:,1].astype(float) > y]
prediction = lambda x, y : x[x[:,1] > y]

#results
print(prediction(books, 4.5))
#we look at books and focus on column 1 that are > y, return a smaller array
# ---------- end oneliners_lambdafunctionsbooleanindexing ----------

# ----
# sorting in NumPy
oneliners_soritng_022 = OneLiners_soritng_022()  # -> out, a; inputs x: Int32
# ---------- oneliners_soritng_022: Python ----------
__author__ = "Sculpture"
__version__ = "2021.05.30"

import rhinoscriptsyntax as rs

#import and do all this JAZZ!
import rhinoscriptsyntax as rs
import scriptcontext as sc
import ghpythonremote
np = sc.sticky['numpy']

#when to Use the sort() Function
#and When to Use the argsort() Function
#in NumPy

#how to sort in a single oneLiner

#priority queues and search algorithms
#the popular Quicksort algorithm
#higher level approach, sort function as a black box and get out a sorted NumPy array
#unsorted array of indices into sorted indices
#sorted array is SORT, sorted indices is ARGSORT

a = np.array([10, 6, 8, 2, 5, 4, 9, 1])

print(np.sort(a)) #sorts data
print(np.argsort(a)) #sorts indices and works on multidimensional arrays too!
# ---------- end oneliners_soritng_022 ----------
panel_32 = Panel(oneliners_soritng_022.out)

# ----
# sort() and argsort() EXAMPLE
oneliners_sort_argsort__023_2 = OneLiners_sortArgsort_023()  # -> out, a; inputs x: Int32; same code as oneliners_sort_argsort__023
panel_33 = Panel(oneliners_sort_argsort__023_2.out)

panel_34 = Panel(oneliners_lambdafunctionsbooleanindexing.out)

# ----
# Out-Liner, Absolute Value
oneliners_outliersabsolutevalue_025 = OneLiners_outliersAbsoluteValue_025()  # -> out, a
# ---------- oneliners_outliersabsolutevalue_025: Python ----------
__author__ = "Sculpture"
__version__ = "2021.05.30"

import rhinoscriptsyntax as rs

#import and do all this JAZZ!
import rhinoscriptsyntax as rs
import scriptcontext as sc
import ghpythonremote

np = sc.sticky['numpy']
scipy = sc.sticky['scipy']
mpl = sc.sticky['matplotlib']
plt = mpl.pyplot
rpy = sc.sticky['rpy']

"""
when plt.show() is executed a graph window will show up
statement will only return when the plot is closed by pressing “q” 
"""

#abs turns neg # into pos #

a = np.array([1, -1, 2, -2, 3, -3])
print(a)
print(np.abs(a))
# ---------- end oneliners_outliersabsolutevalue_025 ----------
panel_35 = Panel(oneliners_outliersabsolutevalue_025.out)

# ----
# Performing the Logical and Operation
# EXAMPLE
oneliners_logicaloperationexample_027 = OneLiners_logicalOperationEXAMPLE_027()  # -> out, a
# ---------- oneliners_logicaloperationexample_027: Python ----------
__author__ = "Sculpture"
__version__ = "2021.05.30"

import rhinoscriptsyntax as rs

#import and do all this JAZZ!
import rhinoscriptsyntax as rs
import scriptcontext as sc
import ghpythonremote

np = sc.sticky['numpy']
scipy = sc.sticky['scipy']
mpl = sc.sticky['matplotlib']
plt = mpl.pyplot
rpy = sc.sticky['rpy']
pandas = sc.sticky['pandas']

"""
when plt.show() is executed a graph window will show up
statement will only return when the plot is closed by pressing “q” 
"""

#FINDS OUTLIERS THAT DEVIATE MORE THAN THE STANDARD DEVIATION FROM 
#THEIR MEAN STATISICS

#web analytics data
# (row = day), (col = users, bounce, duration)

a = np.array  ([[800, 70, 100],
                [700, 80, 50],
                [900, 75, 77],
                [1000, 65, 44],
                [500, 90, 70]])

mean, stdev = np.mean(a, axis=0), np.std(a, axis=0)
print(mean)
print(stdev)

#oneLiner
outliers = ((np.abs(a[:,0] - mean[0] > stdev[0])
            * (np.abs(a[:,1] - mean[1]) > stdev[1])
            * (np.abs(a[:,2] - mean[2]) > stdev[2])))

#results
print(a[outliers]) #if all are outliers, hence combine all three with * operator
# ---------- end oneliners_logicaloperationexample_027 ----------
panel_36 = Panel(oneliners_logicaloperationexample_027.out)

# ----
# Association Analysis: Find Best Seller Bundles
# SUMMARY
# Elementary NumPy basics:
# array, shape, axis, type, broadcasting,
# advanced indexing, slicing, sorting,
# searching, aggregating, and statistics.
# 
# Imporved basic Python skills:
# list comprehension, logics, lambda functions
# 
# Read, write and understand:
# concise code quickly while
# mastering fundamental data science problems
# 
# Now onto:
# scikit-learn library
# 
# MACHINE LEARNING!!!
oneliners_associationanalysisexample_031 = OneLiners_associationAnalysisEXAMPLE_031()  # -> out, a
# ---------- oneliners_associationanalysisexample_031: Python ----------
__author__ = "Sculpture"
__version__ = "2021.05.30"

import rhinoscriptsyntax as rs

#import and do all this JAZZ!
import rhinoscriptsyntax as rs
import scriptcontext as sc
import ghpythonremote

np = sc.sticky['numpy']
scipy = sc.sticky['scipy']
mpl = sc.sticky['matplotlib']
plt = mpl.pyplot
rpy = sc.sticky['rpy']
pandas = sc.sticky['pandas']

"""
when plt.show() is executed a graph window will show up
statement will only return when the plot is closed by pressing “q” 
"""

#Association analysis is "social proof"
#psychological safety
#collaborative filtering
#what fraction bought two, offer bundle to single purchases

#data: row is customer basket
# row = [course 1, course 2, ebook 1, ebook 2]
# value 1 indicates that an item was bought
basket = np.array ([[0, 1, 1, 0],
                    [0, 0, 0, 1],
                    [1, 1, 0, 0],
                    [0, 1, 1, 1],
                    [1, 1, 1, 0],
                    [0, 1, 1, 0],
                    [1, 1, 0, 1],
                    [1, 1, 1, 1]])

#oneLiners (broken down in two lines;)
copurchases = [(i,j,np.sum(basket[:,i] + basket[:,j] == 2))
                for i in range(4) for j in range(i+1,4)]
                
print(copurchases)

print[(i,j) for i in range(4) for j in range(i+1,4)]

#result
print(max(copurchases, key=lambda x:x[2]))

#this is a tricky one to fully understand so take your time and break it down
# ---------- end oneliners_associationanalysisexample_031 ----------
panel_37 = Panel(oneliners_associationanalysisexample_031.out)

# ----
# Performing the Logical and Operation
oneliners_logicaloperation_026 = OneLiners_logicalOperation_026()  # -> out, a
# ---------- oneliners_logicaloperation_026: Python ----------
__author__ = "Sculpture"
__version__ = "2021.05.30"

import rhinoscriptsyntax as rs

#import and do all this JAZZ!
import rhinoscriptsyntax as rs
import scriptcontext as sc
import ghpythonremote

np = sc.sticky['numpy']
scipy = sc.sticky['scipy']
mpl = sc.sticky['matplotlib']
plt = mpl.pyplot
rpy = sc.sticky['rpy']
pandas = sc.sticky['pandas']

"""
when plt.show() is executed a graph window will show up
statement will only return when the plot is closed by pressing “q” 
"""

#element-wise logical and operation
#combine two Boolean arrays a and b
#give back an array that combines the individual Boolean values
#using logical operations

a = np.array([True, True, True, False])
b = np.array([False, True, True, False])

print(np.logical_and(a, b))
#a[i] and b[i] must both be True

#you can also multipy two boolean arrays
#if any interger value not equal to 0 False
# ---------- end oneliners_logicaloperation_026 ----------
panel_38 = Panel(oneliners_logicaloperation_026.out)

# ----
# Association Analysis: People who bought X also bought Y
oneliners_associationanalysisxbuysy_030 = OneLiners_associationAnalysisXBuysY_030()  # -> out, a
# ---------- oneliners_associationanalysisxbuysy_030: Python ----------
__author__ = "Sculpture"
__version__ = "2021.05.30"

import rhinoscriptsyntax as rs

#import and do all this JAZZ!
import rhinoscriptsyntax as rs
import scriptcontext as sc
import ghpythonremote

np = sc.sticky['numpy']
scipy = sc.sticky['scipy']
mpl = sc.sticky['matplotlib']
plt = mpl.pyplot
rpy = sc.sticky['rpy']
pandas = sc.sticky['pandas']

"""
when plt.show() is executed a graph window will show up
statement will only return when the plot is closed by pressing “q” 
"""

#Association analysis is "social proof"
#psychological safety
#collaborative filtering
#what fraction bought two, offer bundle to single purchases

#data: row is customer basket
# row = [course 1, course 2, ebook 1, ebook 2]
# value 1 indicates that an item was bought
basket = np.array([[0, 1, 1, 0],
                    [0, 0, 0, 1],
                    [1, 1, 0, 1],
                    [0, 1, 0, 1],
                    [0, 0, 0, 0],
                    [0, 0, 1, 1],
                    [0, 1, 0, 0],
                    [0, 0, 1, 1]])

copurchases = np.sum(np.all(basket[:,2:], axis = 1)) / basket.shape[0]

#result
print(copurchases)
print(basket[:,2:])

#find out who has bought both ebooks
print(np.all(basket[:,2:], axis = 1))
# ---------- end oneliners_associationanalysisxbuysy_030 ----------
panel_39 = Panel(oneliners_associationanalysisxbuysy_030.out)

ghpython_script_3 = GhPythonScript(num=Slider(173, range=0..1000))  # -> out, a; inputs num: Int32
# ---------- ghpython_script_3: Python ----------
__author__ = "Sculpture"
__version__ = "2021.05.30"

import rhinoscriptsyntax as rs

#import and do all this JAZZ!
import rhinoscriptsyntax as rs
import scriptcontext as sc
import ghpythonremote

np = sc.sticky['numpy']
scipy = sc.sticky['scipy']
mpl = sc.sticky['matplotlib']
plt = mpl.pyplot
rpy = sc.sticky['rpy']
pandas = sc.sticky['pandas'] #figure out DataFrame Series?

"""
when plt.show() is executed a graph window will show up
statement will only return when the plot is closed by pressing “q” 
"""


#data: popular Facebood groups (followers)
#"""
FBG = np.array([[3800, "ghpython"],
                [500, "C#"],
                [350, "Generative"],
                [200, "scratching"],
                [50, "touchdesigner"],
                [25, "backyard"]])
                #"""
"""
FBG = np.array([[3800, 1000],
                [500, 2000],
                [350, 3000],
                [200, 4000],
                [50, 5000],
                [25, 6000]])
                """
print(FBG)
#oneLiner
#BestGroups = FBG[FBG[:,0].astype(float) > num, 1]
#BestGroups = FBG[FBG[:,0].astype(int) > num, 1]
#BestGroups = FBG[FBG[:,0] > num, 1]

#print(FBG.astype(float) > num)

#results
#print(BestGroups)

#x = np.array([1, 2, 2.5], dtype = np.int)
#x = np.array([1, 2, 2.5], dtype = np.str)
#x = x.dtype(int)
#print (x)

#CAN'T GET .astype() to work with anything but int
# ---------- end ghpython_script_3 ----------

panel_40 = Panel(ghpython_script_3.out)

# ==== cluster GHPythonRemote: Connects the Grasshopper Python component to an external Python instance.
python = PythonScript()  # -> gh_parent_doc_dir
# ---------- python: Python ----------
from os import path

gh_parent_doc_dir = path.abspath(path.dirname(ghenv.Component.OnPingDocument().Owner.OnPingDocument().FilePath))
# ---------- end python ----------
# GH to python remote example.
# Pierre Cuvilliers, 2017-2018
# Released under the MIT license
# github.com/pilcru/ghpythonremote
# Runs and connects to an external python engine, and
# assigns imported modules to scriptcontext.sticky variables.
# 
# Arguments:
#       code (str): Path to the GH_to_python_sticky.py code file.
#       location (str): Path to a python executable, or to a folder
#             containing `python.exe`, or the name of a conda-created
#             virtual environment prefixed by `conda://` (`conda://env_name`).
#             If empty, finds python from your windows %PATH%.
#       run (boolean): Creates the connection, and imports new
#             modules, when turned to True. Kills the connection,
#             and deletes the references to the imports, when turned
#             to False.
#       modules (str list): List of module names to import in the
#             remote python. They will be added to the
#             scriptcontext.sticky dictionary, allowing them to be
#             reused from other python components in the same
#             Grasshopper document. Submodules (for example
#             `numpy.linalg` have to be added explicitly to this list
#             to be available later.
#       log_level (str from ['NOTSET', 'DEBUG', 'INFO', 'WARNING', 'ERROR', 'CRITICAL']):
#             Logging level to use for the local IronPython and the
#             remote python instance.
#       working_dir (str): Working directory for the remote python
#             instance.
# 
# Returns:
#       out (str): Console output with DEBUG information.
#       linked_modules (str list): list of imported module names.
#       rpy (rpyc connection object): The object representing the
#             remote Python interpreter.
location = ClusterInput()  # location (str): Path to a python executable, or to a folder containing `python.exe`, or the name of a conda-created virtual environment prefixed by `conda://` (`conda://env_name`). If empty, finds python from your windows %PATH%.
run = ClusterInput()  # run (boolean): Creates the connection, and imports new modules, when turned to True. Kills the connection,and deletes the references to the imports, when turned to False.
modules = ClusterInput()  # modules (str list): List of module names to import in the remote python. They will be added to the scriptcontext.sticky dictionary, allowing them to be reused from other python components in the same Grasshopper document. Submodules (for example `numpy.linalg` have to be added explicitly to this list to be available later.
list = ValueList({"CRITICAL", "ERROR", "WARNING", "INFO", "DEBUG", "NOTSET"}, selected="DEBUG")
panel = Panel(python)
ghpythonremote = GHPythonRemote(location=location, run=run, modules=modules, log_level=list, working_dir=panel)  # -> out, linked_modules, rpy; inputs run: Boolean, modules: list
# ---------- ghpythonremote: Python ----------
import inspect
import logging
from os import path
import sys
from time import sleep

import scriptcontext

import ghpythonremote
from ghpythonremote.connectors import GrasshopperToPythonRemote

local_log_level = getattr(logging, log_level, logging.WARNING)
logger = logging.getLogger("ghpythonremote")
logger.setLevel(local_log_level)
ch = logging.StreamHandler()
ch.setLevel(local_log_level)
formatter = logging.Formatter("%(levelname)s: %(name)s:\n%(message)s")
ch.setFormatter(formatter)
logger.handlers = []
logger.addHandler(ch)
logger = logging.getLogger("ghpythonremote.GH_to_python")

ROOT = path.abspath(path.dirname(inspect.getfile(ghpythonremote)))
rpyc_server_py = path.join(ROOT, "pythonservice.py")

# Set connection to CLOSED if this is the first run
# and initialize set of linked modules
try:
    remote_python_status
except NameError:
    remote_python_status = "CLOSED"
    lkd_modules = set()

# Wait for connection to connect or terminate
timer = 0
while remote_python_status == "CONNECTING" or remote_python_status == "CLOSING":
    sleep(1)
    timer += 1
    if timer == 10:
        try:
            gh2py_manager.__exit__(*sys.exc_info())
        except Exception:
            pass
        remote_python_status = "CLOSED"
        lkd_modules = set()
        raise RuntimeError(
            "Connection left in an inconsistent state and not returning. Reset "
            "everything."
        )

if run:
    if not remote_python_status == "OPEN":
        remote_python_status = "CONNECTING"
        gh2py_manager = GrasshopperToPythonRemote(
            rpyc_server_py,
            location=location,
            timeout=10,
            port=None,
            log_level=log_level,
            working_dir=working_dir,
        )
        gh2py = gh2py_manager.__enter__()
        remote_python_status = "OPEN"

    # Stuff that we can reach
    rpymod = gh2py.py_remote_modules  # A getter function for a named python module
    rpy = gh2py.connection  # Represents the remote instance root object
    scriptcontext.sticky["rpy"] = rpy
    # Add modules
    for mod in modules:
        try:
            scriptcontext.sticky[mod] = rpymod(mod)
            lkd_modules.add(mod)
        except ImportError:
            gh2py_manager.__exit__(*sys.exc_info())
            raise

elif not remote_python_status == "CLOSED":
    remote_python_status = "CLOSING"
    # Remove linked modules
    for mod in lkd_modules:
        del scriptcontext.sticky[mod]
    del scriptcontext.sticky["rpy"]
    gh2py_manager.__exit__(*sys.exc_info())
    lkd_modules = set()
    remote_python_status = "CLOSED"

# Change variable name because ghpython resets outputs to None before each run
linked_modules = lkd_modules

logger.info("GH to python connection is {}".format(remote_python_status))
# ---------- end ghpythonremote ----------
out = ClusterOutput(ghpythonremote.out)  # Console output.
linked_modules = ClusterOutput(ghpythonremote.linked_modules)  # Names of modules that were successfully added to the scriptcontext.sticky dictionary.
rpy = ClusterOutput(ghpythonremote.rpy)  # The object representing the remote python instance
python_2 = PythonScript(module_names=ghpythonremote.linked_modules)  # -> import_statements; inputs module_names: list
# ---------- python_2: Python ----------
import_statements = ["import scriptcontext as sc"]
for module_name in module_names:
    import_statements.append("{0} = sc.sticky['{0}']".format(module_name))

if len(module_names) == 0:
    import_statements = []
# ---------- end python_2 ----------
import_statements = ClusterOutput(python_2)  # Useful import statements to use the imported modules in your scripts.
