# Grasshopper definition MASTER_BASIC_015.gh (Grasshopper 1.0.7)
# plug-ins: Bifocals

# ----
# oneLiners_Basic
number_slider = Slider(0.3, range=0..1)
geometry = Geometry([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])
pipe = Pipe(Curve=reparameterize(geometry), Radius=number_slider, Caps=2)
dispatch = Dispatch(List=flatten(pipe), DispatchPattern=[True, False])  # -> ListA, ListB
geometry_2 = Geometry(dispatch.ListA)

oneliner_datastructures = OneLiner_dataStructures()  # -> out, add, minus, times, divide, divideDown, modulus, negative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; inputs x: Int32, y: Int32
# ---------- oneliner_datastructures: Python ----------
__author__ = "Sculpture"
__version__ = "2021.05.23"

import rhinoscriptsyntax as rs

add = x + y
minus = x - y
times = x * y
divide = x / y
divideDown = x // y
modulus = x % y
negative = -x
castInt = int(3.9)
castFloat = float(x)
exponent = x ** y
# ---------- end oneliner_datastructures ----------
oneliner_squares = OneLiner_squares()  # -> out, squares; inputs x: Int32, y: Int32
# ---------- oneliner_squares: Python ----------
__author__ = "Sculpture"
__version__ = "2021.05.23"

import rhinoscriptsyntax as rs

#before
squares = []
        
for i in range(10):
    squares.append(i**x) 
        
#after oneliner
print([i**y for i in range(10)])
# ---------- end oneliner_squares ----------
oneliner_booleans_002 = OneLiner_booleans_002()  # -> out, a, b, e, f, g; inputs x: Int32, y: Int32, c: Boolean, d: Boolean
# ---------- oneliner_booleans_002: Python ----------
__author__ = "Sculpture"
__version__ = "2021.05.24"

import rhinoscriptsyntax as rs

a = x < y
b = x > y

#c, d = True, False

e = (c or d) == True
f = (c and d) == False
g = (not d) == True

print(e)
print(f)
print(g)
# ---------- end oneliner_booleans_002 ----------
oneliner_booleans = OneLiner_booleans()  # -> out, a, b, e, f, g; inputs x: Int32, y: Int32
# ---------- oneliner_booleans: Python ----------
__author__ = "Sculpture"
__version__ = "2021.05.24"

import rhinoscriptsyntax as rs

a = x < y
b = x > y

c, d = True, False

e = (c or d) == True
f = (c and d) == False
g = (not d) == True

print(e)
print(f)
print(g)
# ---------- end oneliner_booleans ----------
oneliner_booleans_003 = OneLiner_booleans_003()  # -> out, a, b; inputs x: Boolean, y: Boolean
# ---------- oneliner_booleans_003: Python ----------
__author__ = "Sculpture"
__version__ = "2021.05.24"

import rhinoscriptsyntax as rs

#order of precedence not, and, or
a = x and not y
b = not x and y or x

# if condition evaluates to False
if None or 0 or 0.0 or '' or [] or {} or set():
    print("Dead Code") #Not Reached
else:
    print("yeah")
# ---------- end oneliner_booleans_003 ----------
oneliners_strings_004 = OneLiners_Strings_004()  # -> out, a, b, c, d, e, f, g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
# ---------- oneliners_strings_004: Python ----------
__author__ = "Sculpture"
__version__ = "2021.05.24"

import rhinoscriptsyntax as rs

"""
\n new line
\s new space
\t new tab
"""

a = "    This is lazy\t\n    "
b = a.strip()
c = x.lower()
d = y.upper()
e = "smartphone".startswith("smart")
f = "smartphone".endswith("phone")
g = "another".find("other")
h = "cheat".replace("ch", "m")
i = ",".join(["F", "B", "I"])
j = len("Rumpelstiltskin")
k = "ear" in "earth"
# ---------- end oneliners_strings_004 ----------
oneliners_keywordnone_005 = Oneliners_keywordNone_005()  # -> out, a, b, c
# ---------- oneliners_keywordnone_005: Python ----------
__author__ = "Sculpture"
__version__ = "2021.05.24"

import rhinoscriptsyntax as rs

def f():
    x = 2
    # if you do not return a value for a function
    
a = f() is None
b = "" == None
c = 0 == None
# ---------- end oneliners_keywordnone_005 ----------

# ----
# squares
number_slider_2 = Slider(2, range=0..5)
oneliner_squares_2 = OneLiner_squares(x=number_slider_2, y=Slider(3, range=0..5))  # -> out, squares; inputs x: Int32, y: Int32; same code as oneliner_squares
panel = Panel(oneliner_squares_2.squares)
panel_2 = Panel(oneliner_squares_2.out)

oneliner_booleans_003_2 = OneLiner_booleans_003(x=Toggle(True), y=Toggle(False))  # -> out, a, b; inputs x: Boolean, y: Boolean
# ---------- oneliner_booleans_003_2: Python ----------
__author__ = "Sculpture"
__version__ = "2021.05.24"

import rhinoscriptsyntax as rs

#order of precedence not, and, or
a = x and not y
b = not x and y or x

# if condition evaluates to False
if None or 0 or 0.0 or '' or [] or {} or set():
    print("Dead Code") #Not Reached
else:
    print("oh, yeah!")
# ---------- end oneliner_booleans_003_2 ----------
panel_3 = Panel(oneliner_booleans_003_2.a)
panel_4 = Panel(oneliner_booleans_003_2.out)
panel_5 = Panel(oneliner_booleans_003_2.b)

# ----
# strings
panel_6 = Panel("MICHAEL")
oneliners_strings_004_2 = OneLiners_Strings_004(x=panel_6, y="wickerson")  # -> out, a, b, c, d, e, f, g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; same code as oneliners_strings_004
panel_7 = Panel([oneliners_strings_004_2.a, oneliners_strings_004_2.b, oneliners_strings_004_2.c, oneliners_strings_004_2.d, oneliners_strings_004_2.e, oneliners_strings_004_2.f, oneliners_strings_004_2.g, oneliners_strings_004_2.h, oneliners_strings_004_2.i, oneliners_strings_004_2.j, oneliners_strings_004_2.k])

# ----
# data structures
number_slider_3 = Slider(3, range=0..10)
oneliner_datastructures_2 = OneLiner_dataStructures(x=number_slider_3, y=Slider(5, range=0..10))  # -> out, add, minus, times, divide, divideDown, modulus, negative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; inputs x: Int32, y: Int32
# ---------- oneliner_datastructures_2: Python ----------
__author__ = "Sculpture"
__version__ = "2021.05.23"

import rhinoscriptsyntax as rs

add = x + y
minus = x - y
times = x * y
divide = x / y
divideDown = x // y
modulus = x % y
negative = -x
castInt = int(3.9)
castFloat = float(x) #strange, works in output but not in castFloat output
print(x)
print(float(x))

exponent = x ** y
# ---------- end oneliner_datastructures_2 ----------
panel_8 = Panel(oneliner_datastructures_2.castFloat)
panel_9 = Panel(oneliner_datastructures_2.out)
panel_10 = Panel(oneliner_datastructures_2.add)
panel_11 = Panel(oneliner_datastructures_2.times)
panel_12 = Panel(oneliner_datastructures_2.divideDown)
panel_13 = Panel(oneliner_datastructures_2.negative)
panel_14 = Panel(oneliner_datastructures_2.minus)
panel_15 = Panel(oneliner_datastructures_2.modulus)
panel_16 = Panel(oneliner_datastructures_2.castInt)
panel_17 = Panel(oneliner_datastructures_2.exponent)
panel_18 = Panel(oneliner_datastructures_2.divide)

# ----
# booleans
number_slider_4 = Slider(3, range=0..10)
number_slider_5 = Slider(5, range=0..10)
oneliner_booleans_2 = OneLiner_booleans(x=number_slider_4, y=number_slider_5)  # -> out, a, b, e, f, g; inputs x: Int32, y: Int32; same code as oneliner_booleans
panel_19 = Panel(oneliner_booleans_2.out)
panel_20 = Panel([oneliner_booleans_2.a, oneliner_booleans_2.b])
panel_21 = Panel([oneliner_booleans_2.e, oneliner_booleans_2.f, oneliner_booleans_2.g])

# ----
# keyword: None
oneliners_keywordnone_005_2 = Oneliners_keywordNone_005()  # -> out, a, b, c; same code as oneliners_keywordnone_005
panel_22 = Panel([oneliners_keywordnone_005_2.a, oneliners_keywordnone_005_2.b, oneliners_keywordnone_005_2.c])

oneliner_booleans_002_2 = OneLiner_booleans_002(x=number_slider_4, y=number_slider_5, c=Toggle(False), d=Toggle(False))  # -> out, a, b, e, f, g; inputs x: Int32, y: Int32, c: Boolean, d: Boolean; same code as oneliner_booleans_002
panel_23 = Panel(oneliner_booleans_002_2.out)
panel_24 = Panel([oneliner_booleans_002_2.a, oneliner_booleans_002_2.b])
panel_25 = Panel([oneliner_booleans_002_2.e, oneliner_booleans_002_2.f, oneliner_booleans_002_2.g])

oneliners_reversingsortingindexing = OneLiners_reversingSortingIndexing()  # -> out, a, b, c, d; inputs dashCount: Int32
# ---------- oneliners_reversingsortingindexing: Python ----------
__author__ = "Sculpture"
__version__ = "2021.05.26"

import rhinoscriptsyntax as rs

a = [x, y, z]
a.remove(listObject) #modifies the exact object to save memory
b = a

numberList = [23,4534,213,5465,32,3]
numberList.sort()
c = ["-"*dashCount] + numberList

d = [9,8,7,6,5,4,3,2,1,0].index(iNum)
# ---------- end oneliners_reversingsortingindexing ----------
oneliner_addingelements = OneLiner_addingElements()  # -> out, a, b, c, d; inputs i: Int32, dash: Int32
# ---------- oneliner_addingelements: Python ----------
__author__ = "Sculpture"
__version__ = "2021.05.26"

import rhinoscriptsyntax as rs

a = [x,y,z]
b = a.append("Hot dog") 
c = a.insert(i, data)
d = ["_"*dash] + a + [12] #concatenation
# ---------- end oneliner_addingelements ----------
oneliners_listsandkeywordis = OneLiners_listsAndKeywordIs()  # -> out, a, b, c
# ---------- oneliners_listsandkeywordis: Python ----------
__author__ = "Sculpture"
__version__ = "2021.05.26"

import rhinoscriptsyntax as rs

a = [x, y, z]

p = q = x
b = p is q # True
c = [23] is [23] # False
# ---------- end oneliners_listsandkeywordis ----------

# ----
# removing elements in list
number_slider_6 = Slider(8, range=0..10)
number_slider_7 = Slider(2, range=0..10)
boolean_toggle = BooleanToggle(True)
list_item = ListItem(List=[number_slider_7, boolean_toggle, "Wickerson"], Index=Slider(2, range=0..10), Wrap=True)
oneliners_reversingsortingindexing_2 = OneLiners_reversingSortingIndexing(
    x=number_slider_7,
    y=boolean_toggle,
    z="Wickerson",
    listObject=list_item,
    dashCount=number_slider_6,
    iNum=Slider(3, range=0..10))  # -> out, a, b, c, d; inputs dashCount: Int32; same code as oneliners_reversingsortingindexing
panel_26 = Panel(list_item)
merge = Merge(
    Data1=oneliners_reversingsortingindexing_2.a,
    Data2=oneliners_reversingsortingindexing_2.b,
    Data3=oneliners_reversingsortingindexing_2.c,
    Data4=oneliners_reversingsortingindexing_2.d)
panel_27 = Panel(merge)

# ----
# adding elements to list
number_slider_8 = Slider(5, range=0..10)
oneliner_addingelements_2 = OneLiner_addingElements(
    x=Slider(2, range=0..10),
    y=Toggle(True),
    z="Wickerson",
    data="New data",
    i=number_slider_8,
    dash=Slider(14, range=0..100))  # -> out, a, b, c, d; inputs i: Int32, dash: Int32
# ---------- oneliner_addingelements_2: Python ----------
__author__ = "Sculpture"
__version__ = "2021.05.26"

import rhinoscriptsyntax as rs

a = [x,y,z]
a.append("Hot dog")
b = ["_"*dash] + a 
b.insert(i, data)
c = b
d = ["_"*dash] + a + [12] #concatenation
# ---------- end oneliner_addingelements_2 ----------
merge_2 = Merge(
    Data1=oneliner_addingelements_2.a,
    Data2=oneliner_addingelements_2.b,
    Data3=oneliner_addingelements_2.c,
    Data4=oneliner_addingelements_2.d)
panel_28 = Panel(merge_2)

# ----
# container data structures
# lists
number_slider_9 = Slider(2, range=0..10)
oneliners_listsandkeywordis_2 = OneLiners_listsAndKeywordIs(x=number_slider_9, y=Toggle(True), z="Wickerson")  # -> out, a, b, c; same code as oneliners_listsandkeywordis
merge_3 = Merge(Data1=oneliners_listsandkeywordis_2.a, Data2=oneliners_listsandkeywordis_2.b, Data4=oneliners_listsandkeywordis_2.c)
panel_29 = Panel(merge_3)

oneliners_dictskeysvaluesitems_010 = OneLiners_dictsKeysValuesItems_010()  # -> out, ages, a, b, c, d, e, f; inputs age: Int32
# ---------- oneliners_dictskeysvaluesitems_010: Python ----------
__author__ = "Sculpture"
__version__ = "2021.05.26"

import rhinoscriptsyntax as rs

ages = {'bob' : 15, 'mary' : 25, 'oscar' : 35}
a = ages['bob']
b = ages['mary'] < ages['oscar']

ages['Jimmy'] = 45
c = ages['Jimmy'] < ages['bob']

d = 'mary' in ages.keys()
e = 'oscar' in ages.values()
f = 'fred' in ages.keys()

#item() method
for k, v in ages.items():
    print(k) if v > age else None
# ---------- end oneliners_dictskeysvaluesitems_010 ----------
oneliners_setscollections_008 = OneLiners_setsCollections_008()  # -> out, a, b, players, party, NPC, everyone
# ---------- oneliners_setscollections_008: Python ----------
__author__ = "Sculpture"
__version__ = "2021.05.26"

import rhinoscriptsyntax as rs

prince = "Harry"
DM = "Duchame"
Lord = "Mordus"
a = hash(prince)
b = hash(DM)
players = {prince, DM, Lord}
party = {prince, Lord}

NPC = ["orc", "kobold"]

#everyone = {party, NPC} 
#TypeError: unhashable type: 'list'
# ---------- end oneliners_setscollections_008 ----------
oneliners_setsunorderedunique_009 = OneLiners_setsUnorderedUnique_009()  # -> out, players, mob
# ---------- oneliners_setsunorderedunique_009: Python ----------
__author__ = "Sculpture"
__version__ = "2021.05.26"

import rhinoscriptsyntax as rs

prince = "Harry"
DM = "Duchame"
Lord = "Mordus"
players = {prince, DM, Lord} #UNORDERED in sets


#all elements in the set must be UNIQUE
mob = {"orc", "orc", "orc", "orc", DM}
# ---------- end oneliners_setsunorderedunique_009 ----------
oneliners_comprehensionlistandsets_012 = OneLiners_comprehensionListAndSets_012()  # -> out, old, kids
# ---------- oneliners_comprehensionlistandsets_012: Python ----------
__author__ = "Sculpture"
__version__ = "2021.05.26"

import rhinoscriptsyntax as rs

#(name, age)
family = [("mike", 49), ("beth", 43), ("oscar", 11), ("max", 9), ("ella", 4)]

#EXPRESSION AND CONTEXT
old = [x for x, y in family if y > 39]
kids = [x for x, y in family if y < 19]
# ---------- end oneliners_comprehensionlistandsets_012 ----------
oneliners_stacks_007 = OneLiners_stacks_007()  # -> out, a
# ---------- oneliners_stacks_007: Python ----------
__author__ = "Sculpture"
__version__ = "2021.05.26"

import rhinoscriptsyntax as rs

a = stack = [x]
stack.append(y) #[x, y]
stack.pop() #removes last element
#stack.pop()
# ---------- end oneliners_stacks_007 ----------
oneliners_membership_011 = OneLiners_membership_011()  # -> out, a, b, c
# ---------- oneliners_membership_011: Python ----------
__author__ = "Sculpture"
__version__ = "2021.05.26"

import rhinoscriptsyntax as rs

a = 33 in [11, 22, 33, 44] #list
b = '33' in {'11', '22', '33', '44'} #set *MUCH FASTER THAN LIST MEMBERSHIP*
c = "mike" in {"mike" : 49, "ella" : 4, "Oscar" : 11} #dictionary
# ---------- end oneliners_membership_011 ----------

# ----
# dictionaries
number_slider_10 = Slider(33, range=0..100)
oneliners_dictskeysvaluesitems_010_2 = OneLiners_dictsKeysValuesItems_010(age=number_slider_10)  # -> out, ages, a, b, c, d, e, f, g; inputs age: Int32; same code as oneliners_dictskeysvaluesitems_010
panel_30 = Panel(oneliners_dictskeysvaluesitems_010_2.ages)
panel_31 = Panel([oneliners_dictskeysvaluesitems_010_2.a, oneliners_dictskeysvaluesitems_010_2.b, oneliners_dictskeysvaluesitems_010_2.c, oneliners_dictskeysvaluesitems_010_2.d, oneliners_dictskeysvaluesitems_010_2.e, oneliners_dictskeysvaluesitems_010_2.f])
panel_32 = Panel(oneliners_dictskeysvaluesitems_010_2.out)

# ----
# stacks
number_slider_11 = Slider(3, range=0..10)
oneliners_stacks_007_2 = OneLiners_stacks_007(x=number_slider_11, y=Slider(8, range=0..10))  # -> out, a; same code as oneliners_stacks_007
panel_33 = Panel(oneliners_stacks_007_2.a)

# ----
# membership
oneliners_membership_011_2 = OneLiners_membership_011()  # -> out, a, b, c; same code as oneliners_membership_011
merge_4 = Merge(Data1=oneliners_membership_011_2.a, Data2=oneliners_membership_011_2.b, Data3=oneliners_membership_011_2.c)
panel_34 = Panel(merge_4)

# ----
# sets
# collections
# unordered and unique
oneliners_setscollections_008_2 = OneLiners_setsCollections_008()  # -> out, a, b, players, party, NPC, everyone; same code as oneliners_setscollections_008
panel_35 = Panel([oneliners_setscollections_008_2.a, oneliners_setscollections_008_2.b])
panel_36 = Panel(oneliners_setscollections_008_2.players)
panel_37 = Panel(oneliners_setscollections_008_2.party)
panel_38 = Panel(oneliners_setscollections_008_2.NPC)
panel_39 = Panel(oneliners_setscollections_008_2.everyone)
oneliners_setsunorderedunique_009_2 = OneLiners_setsUnorderedUnique_009()  # -> out, players, mob; same code as oneliners_setsunorderedunique_009
panel_40 = Panel(oneliners_setsunorderedunique_009_2.players)
panel_41 = Panel(oneliners_setsunorderedunique_009_2.mob)

# ----
# comprehension
oneliners_comprehensionlistandsets_012_2 = OneLiners_comprehensionListAndSets_012()  # -> out, old, kids; same code as oneliners_comprehensionlistandsets_012
panel_42 = Panel(oneliners_comprehensionlistandsets_012_2.old)
panel_43 = Panel(oneliners_comprehensionlistandsets_012_2.kids)

oneliners_ifelifelse_013 = OneLiners_ifElifElse_013()  # -> out, a; inputs x: Int32
# ---------- oneliners_ifelifelse_013: Python ----------
__author__ = "Sculpture"
__version__ = "2021.05.27"

import rhinoscriptsyntax as rs

if x > 3:
    a = 'Big'
elif x == 3:
    a = 'Medium'
else:
    a = 'Small'
# ---------- end oneliners_ifelifelse_013 ----------
oneliner_forloop_014 = OneLiner_forLoop_014()  # -> out, a
# ---------- oneliner_forloop_014: Python ----------
__author__ = "Sculpture"
__version__ = "2021.05.27"

import rhinoscriptsyntax as rs

a = []

for i in [x, y, z]:
    print(i)
    a.append(i)
# ---------- end oneliner_forloop_014 ----------
oneliners_functionsreturndeclaration_015 = OneLiners_FunctionsReturnDeclaration_015()  # -> out, a; inputs x: Int32
# ---------- oneliners_functionsreturndeclaration_015: Python ----------
__author__ = "Sculpture"
__version__ = "2021.05.27"

import rhinoscriptsyntax as rs

a = 0.0 #needs ot be declared as a float to work

def increase(x, percent):
    return x + x * percent / 100

print(increase(x, 5)) 
a = (increase(x, 5))

print(type(increase(10000, 5)))
# ---------- end oneliners_functionsreturndeclaration_015 ----------
oneliners_lambdas_016 = OneLinersLAMBDAS_016()  # -> out, a
# ---------- oneliners_lambdas_016: Python ----------
__author__ = "Sculpture"
__version__ = "2021.05.27"

import rhinoscriptsyntax as rs

#they are functions without names to be used for single use
#lambda <arguments> : <return expression>

print((lambda x: x + y)(z))
# ---------- end oneliners_lambdas_016 ----------
oneliners_whileloopbreakcontinue_015 = OneLiners_whileLoopBreakContinue_015()  # -> out, a
# ---------- oneliners_whileloopbreakcontinue_015: Python ----------
__author__ = "Sculpture"
__version__ = "2021.05.27"

import rhinoscriptsyntax as rs

a = [] #create an empty list

x = 0 #initialize to 0 to prevent infinite loop
while x < 3:
    print(x)
    x = x + 1
    a.append(x)

while True:
    break # prevents infinite loop
    
print("hello Wickerson")

"""
DO NOT UNCOMMENT
while True:
    continue
    print("dead code") #dead code CRASH!
"""
# ---------- end oneliners_whileloopbreakcontinue_015 ----------

# ----
# loops
# for
number_slider_12 = Slider(28.99, range=0..100)
panel_44 = Panel()
oneliner_forloop_014_2 = OneLiner_forLoop_014(x=panel_44, y=Toggle(True), z=number_slider_12)  # -> out, a; same code as oneliner_forloop_014
panel_45 = Panel(oneliner_forloop_014_2.a)
panel_46 = Panel(oneliner_forloop_014_2.out)

# ----
# Control flow
# if, else, and elif
number_slider_13 = Slider(0, range=0..10)
oneliners_ifelifelse_013_2 = OneLiners_ifElifElse_013(x=number_slider_13)  # -> out, a; inputs x: Int32; same code as oneliners_ifelifelse_013
panel_47 = Panel(oneliners_ifelifelse_013_2.a)

# ----
# Functions
number_slider_14 = Slider(309, range=0..1000)
oneliners_functionsreturndeclaration_015_2 = OneLiners_FunctionsReturnDeclaration_015(x=number_slider_14)  # -> out, a; inputs x: Int32; same code as oneliners_functionsreturndeclaration_015
panel_48 = Panel(oneliners_functionsreturndeclaration_015_2.out)
panel_49 = Panel(oneliners_functionsreturndeclaration_015_2.a)

# ----
# LAMBDAS
number_slider_15 = Slider(4, range=0..10)
oneliners_lambdas_016_2 = OneLinersLAMBDAS_016(x=number_slider_15, y=Slider(6, range=0..10), z=Slider(5, range=0..10))  # -> out, a; same code as oneliners_lambdas_016
panel_50 = Panel(oneliners_lambdas_016_2.out)

# ----
# while and break
oneliners_whileloopbreakcontinue_015_2 = OneLiners_whileLoopBreakContinue_015()  # -> out, a; same code as oneliners_whileloopbreakcontinue_015
panel_51 = Panel(oneliners_whileloopbreakcontinue_015_2.a)
panel_52 = Panel(oneliners_whileloopbreakcontinue_015_2.out)
