# Grasshopper definition MASTER_INTERMEDIATE_ADVANCED__MACHINE_LEARNING_PART_2of2.gh (Grasshopper 1.0.7)
# Copyright: © 2017-2018 Pierre Cuvilliers, Caitlin Mueller, Massachusetts Institute of Technology
# plug-ins: Bifocals, Fologram For Grasshopper Utilities, Kangaroo2 Components

# ----
# ghPython oneLiners_Intermediate_Advanced
# Branch
# Managment
# Script
number_slider = Slider(5, range=0..10)
oneliners_intadvanced_branchmanagment_00 = OneLiners_intAdvanced_branchManagment_001(
    numPaths=number_slider,
    startBranch=Slider(3, range=0..10),
    stopBranch=Slider(7, range=0..10),
    stepBranch=Slider(3, range=0..10),
    numItems=Slider(6, range=0..10))  # -> out, nest, paths, a, b; inputs numPaths: Int32, startBranch: Int32, stopBranch: Int32, numItems: Int32
# ---------- oneliners_intadvanced_branchmanagment_00: Python ----------
##################################################
import random
import Grasshopper.Kernel.Data.GH_Path as ghpath
import Grasshopper.DataTree as datatree 
import System
import ghpythonlib.components as ghc
import rhinoscriptsyntax as rs
import Rhino.Geometry as rg
##################################################

nest = datatree[System.Object]() #the tree
paths = datatree[System.Object]()
for Alpha_path in range(numPaths): # numPaths Alpha paths
    for Beta_branch in range(random.randrange(startBranch,stopBranch,stepBranch)): #each gets random number of beta branchs
        paths.Add( (ghpath(Alpha_path,Beta_branch)),ghpath(Alpha_path))#add full_path name to Alph path
        for item in range(numItems):# each path has (numItems) numbers
            nest.Add(item, ghpath(Alpha_path,Beta_branch)) # assign number to given path

#how to call all Beta Branchs from Alpha path (zero) ??
for path in paths.Branch(0):
    print path
    print nest.Branch(ghpath(path))

a = nest
b = paths
# ---------- end oneliners_intadvanced_branchmanagment_00 ----------
panel = Panel(oneliners_intadvanced_branchmanagment_00.out)
panel_2 = Panel(oneliners_intadvanced_branchmanagment_00.paths)
viewer = ParamViewer(oneliners_intadvanced_branchmanagment_00.nest)

# ----
# 005
number_slider_2 = Slider(10, range=1..10)  # disabled
number_slider_3 = Slider(10, range=1..10)  # disabled
number_slider_4 = Slider(4, range=1..4)  # disabled
number_slider_5 = Slider(8, range=1..8)  # disabled
number_slider_6 = Slider(10, range=1..10)  # disabled
# 006
number_slider_7 = Slider(30, range=1..30)

# ---- group: sample_0
number_slider_8 = Slider(10, range=0..10)  # disabled
number_slider_9 = Slider(5, range=0..10)  # disabled
number_slider_10 = Slider(2, range=0..10)  # disabled

# ---- group: art
# Decision-Tree Learning
number_slider_11 = Slider(10, range=0..10)  # disabled
number_slider_12 = Slider(6, range=0..10)  # disabled
number_slider_13 = Slider(2, range=0..10)  # disabled

# ---- group: des
number_slider_14 = Slider(5, range=0..10)  # disabled
number_slider_15 = Slider(10, range=0..10)  # disabled
number_slider_16 = Slider(0, range=0..10)  # disabled

# ---- group: eng
number_slider_17 = Slider(10, range=0..10)  # disabled
number_slider_18 = Slider(0, range=0..10)  # disabled
number_slider_19 = Slider(6, range=0..10)  # disabled

# ---- group: sample_1
number_slider_20 = Slider(1, range=0..10)  # disabled
number_slider_21 = Slider(9, range=0..10)  # disabled
# Decision-Tree Learning
# Notes:
# These are human-readable
# Great for communicating with non-ML peons
# The Basics:
# Opens new breanches and make desicions
# in a flowchart kind of way
# Good for classification problems
# You finally reach a leaf node of the tree
# a node with no children
# This is the recommended class based
# on your feature selection
# First question carries the most weight
# These is a pruning process
number_slider_22 = Slider(10, range=0..10)  # disabled

# ----
# Neural Networks
# Analysis, EXAMPLE_2
range = Range(Domain=number_slider_3, Steps=number_slider_3)  # disabled
range_2 = Range(Domain=number_slider_4, Steps=number_slider_3)  # disabled
range_3 = Range(Domain=number_slider_4, Steps=number_slider_3)  # disabled
range_4 = Range(Domain=number_slider_5, Steps=number_slider_3)  # disabled
range_5 = Range(Domain=number_slider_6, Steps=number_slider_3)  # disabled
range_6 = Range(Domain=number_slider_7, Steps=number_slider_3)  # disabled
jitter = Jitter(List=range, Jitter=1, Seed=number_slider_2)  # -> Values, Indices; disabled
jitter_2 = Jitter(List=range_2, Jitter=1, Seed=number_slider_2)  # -> Values, Indices; disabled
jitter_3 = Jitter(List=range_3, Jitter=1, Seed=number_slider_2)  # -> Values, Indices; disabled
jitter_4 = Jitter(List=range_4, Jitter=1, Seed=number_slider_2)  # -> Values, Indices; disabled
jitter_5 = Jitter(List=range_5, Jitter=1, Seed=number_slider_2)  # -> Values, Indices; disabled
jitter_6 = Jitter(List=range_6, Jitter=1, Seed=number_slider_2)  # -> Values, Indices; disabled
oneliners_neuralnetworkanalysis_013 = OneLiners_neuralNetworkAnalysis_013(
    input1=jitter.Values,
    input2=jitter_2.Values,
    input3=jitter_3.Values,
    input4=jitter_4.Values,
    input5=jitter_5.Values,
    output6=jitter_6.Values,
    sample1=jitter.Values,
    sample2=jitter_2.Values,
    sample3=jitter_3.Values,
    sample4=jitter_4.Values,
    sample5=jitter_5.Values)  # -> out, a; inputs input1: list of Int32, input2: list of Int32, input3: list of Int32, input4: list of Int32, input5: list of Int32, output6: list of Int32, sample1: Int32, sample3: Int32, sample4: Int32; disabled
# ---------- oneliners_neuralnetworkanalysis_013: Python ----------
__author__ = "Sculpture"
__version__ = "2021.05.30"

import rhinoscriptsyntax as rs

#import and do all this JAZZ!
import rhinoscriptsyntax as rs
import scriptcontext as sc
import ghpythonremote

np = sc.sticky['numpy']
scipy = sc.sticky['scipy']
mpl = sc.sticky['matplotlib']
plt = mpl.pyplot
rpy = sc.sticky['rpy']
pandas = sc.sticky['pandas']
skl = sc.sticky['sklearn'] #machine linput5ing models
linm = sc.sticky['sklearn.linear_model']
cluster = sc.sticky['sklearn.cluster']
nb = sc.sticky['sklearn.neighbors']
MLP = sc.sticky['sklearn.neural_network']

#data (size / cost)
X = np.array([  [input1[0], input2[0], input3[0], input4[0], input5[0], output6[0]],
                [input1[1], input2[1], input3[1], input4[1], input5[1], output6[1]],
                [input1[2], input2[2], input3[2], input4[2], input5[2], output6[2]],
                [input1[3], input2[3], input3[3], input4[3], input5[3], output6[3]],
                [input1[4], input2[4], input3[4], input4[4], input5[4], output6[4]],
                [input1[5], input2[5], input3[5], input4[5], input5[5], output6[5]],
                [input1[6], input2[6], input3[6], input4[6], input5[6], output6[6]],
                [input1[7], input2[7], input3[7], input4[7], input5[7], output6[7]],
                [input1[8], input2[8], input3[8], input4[8], input5[8], output6[8]],
                [input1[9], input2[9], input3[9], input4[9], input5[9], output6[9]]])

#oneLiner
neural_net = MLP.MLPRegressor(max_iter=10000).fit(X[:,:-1], X[:,-1])

#result
res = neural_net.predict([[sample1,sample2,sample3,sample4,sample5]])
print(res)[0]
# ---------- end oneliners_neuralnetworkanalysis_013 ----------
panel_3 = Panel(oneliners_neuralnetworkanalysis_013.out)  # disabled

oneliners_decision_tree_015 = OneLiners_decisionTree_015(
    artA=number_slider_11,
    artB=number_slider_12,
    artC=number_slider_13,
    desA=number_slider_14,
    desB=number_slider_15,
    desC=number_slider_16,
    engA=number_slider_18,
    engB=number_slider_19,
    engC=number_slider_17,
    sample0A=number_slider_8,
    sample0B=number_slider_9,
    sample0C=number_slider_10,
    sample1A=number_slider_20,
    sample1B=number_slider_21,
    sample1C=number_slider_22)  # -> out, a; inputs artA: Int32, artB: Int32, artC: Int32, desA: Int32, desB: Int32, desC: Int32, engA: Int32, engB: Int32, engC: Int32, sample0A: Int32, sample0B: Int32, sample0C: Int32, sample1A: Int32, sample1B: Int32, sample1C: Int32; disabled
# ---------- oneliners_decision_tree_015: Python ----------
__author__ = "Sculpture"
__version__ = "2021.05.30"

import rhinoscriptsyntax as rs

#import and do all this JAZZ!
import rhinoscriptsyntax as rs
import scriptcontext as sc
import ghpythonremote

np = sc.sticky['numpy']
scipy = sc.sticky['scipy']
mpl = sc.sticky['matplotlib']
plt = mpl.pyplot
rpy = sc.sticky['rpy']
pandas = sc.sticky['pandas']
skl = sc.sticky['sklearn'] #machine linput5ing models
linm = sc.sticky['sklearn.linear_model']
cluster = sc.sticky['sklearn.cluster']
nb = sc.sticky['sklearn.neighbors']
MLP = sc.sticky['sklearn.neural_network']
TREE = sc.sticky['sklearn.tree']

"""
#data (size / cost)
X = np.array([  [input1[0], input2[0], input3[0], input4[0], input5[0], output6[0]],
                [input1[1], input2[1], input3[1], input4[1], input5[1], output6[1]],
                [input1[2], input2[2], input3[2], input4[2], input5[2], output6[2]],
                [input1[3], input2[3], input3[3], input4[3], input5[3], output6[3]],
                [input1[4], input2[4], input3[4], input4[4], input5[4], output6[4]],
                [input1[5], input2[5], input3[5], input4[5], input5[5], output6[5]],
                [input1[6], input2[6], input3[6], input4[6], input5[6], output6[6]],
                [input1[7], input2[7], input3[7], input4[7], input5[7], output6[7]],
                [input1[8], input2[8], input3[8], input4[8], input5[8], output6[8]],
                [input1[9], input2[9], input3[9], input4[9], input5[9], output6[9]]])

#oneLiner
neural_net = MLP.MLPRegressor(max_iter=10000).fit(X[:,:-1], X[:,-1])

#result
res = neural_net.predict([[sample1,sample2,sample3,sample4,sample5]])
print(res)[0]"""

#data: points in (art, design, engineering) - study field
X = np.array([  [artA, artB, artC, "art"],
                [desA, desB, desC, "design"],
                [engA, engB, engC, "engineering"]])

#oneLiner
Tree = TREE.tree.DecisionTreeClassifier().fit(X[:,:-1], X[:,-1])

#result and puzzle
researcher_0 = Tree.predict([[sample0A, sample0B, sample0C]])
print(researcher_0)[0]

researcher_1 = Tree.predict([[sample1A, sample1B, sample1C]])
print(researcher_1)[0]
# ---------- end oneliners_decision_tree_015 ----------

panel_4 = Panel(oneliners_decision_tree_015.out)  # disabled

number_slider_23 = Slider(2, range=0..10)  # disabled
number_slider_24 = Slider(0, range=0..10)  # disabled
number_slider_25 = Slider(6, range=0..10)  # disabled

# ---- group: art
# Decision-Tree Learning EXAMPLE
number_slider_26 = Slider(8, range=0..10)  # disabled
number_slider_27 = Slider(4, range=0..5)  # disabled
number_slider_28 = Slider(2, range=0..10)  # disabled

# ----
# GH Python Remote Node Setup
panel_5 = Panel("""numpy
scipy
numpy.linalg
matplotlib
matplotlib.pyplot
pandas
sklearn
sklearn.linear_model
sklearn.cluster
sklearn.neighbors
sklearn.neural_network
sklearn.tree
sklearn.svm
sklearn.ensemble""")
gh_python_remote = GHPythonRemote(location="C:\Users\Sculpture\.conda\envs\rhinoremote", run=Toggle(True), modules=panel_5)  # -> out, linked_modules, rpy, import_statements
panel_6 = Panel(gh_python_remote.import_statements)
# MACHINE LEARNING:
#  scikit-learn
panel_7 = Panel(gh_python_remote.linked_modules)

number_slider_29 = Slider(0.46, range=0..1)  # disabled
# The Code:
# How it works:
# The data describes some models
# The oneLiner creates a new decision-tree object
# and trains the model by using
# fit() function on the last column
# It has learned a featured pattern (high, med, low)
# The algorithm is nondeterministic
# This means different results might occur
# It is a bit random
# In summary, DT are an intuitive
# way of creating human-readable ML models
# Classification and Regression
# Next: let's look at a critical concept VARIANCE
number_slider_30 = Slider(0.73, range=0..1)  # disabled
series = Series(Start=number_slider_24, Step=number_slider_23, Count=number_slider_25)  # disabled
jitter_7 = Jitter(List=series, Jitter=number_slider_29, Seed=2)  # -> Values, Indices; disabled
jitter_8 = Jitter(List=series, Jitter=number_slider_30, Seed=2)  # -> Values, Indices; disabled
oneliners_decision_tree_example_016 = OneLiners_decisionTree_EXAMPLE_016(
    artA=number_slider_26,
    artB=number_slider_26,
    artC=number_slider_28,
    desA=number_slider_26,
    desB=number_slider_27,
    desC=number_slider_27,
    engA=number_slider_27,
    engB=number_slider_26,
    engC=number_slider_28,
    sample0A=series,
    sample0B=jitter_7.Values,
    sample0C=jitter_7.Values,
    sample1A=jitter_8.Values,
    sample1B=jitter_8.Values,
    sample1C=series)  # -> out, a; inputs artA: Int32, artB: Int32, artC: Int32, desA: Int32, desB: Int32, desC: Int32, engA: Int32, engB: Int32, engC: Int32, sample0A: Int32, sample0B: Int32, sample0C: Int32, sample1A: Int32, sample1B: Int32, sample1C: Int32; disabled
# ---------- oneliners_decision_tree_example_016: Python ----------
__author__ = "Sculpture"
__version__ = "2021.05.30"

import rhinoscriptsyntax as rs

#import and do all this JAZZ!
import rhinoscriptsyntax as rs
import scriptcontext as sc
import ghpythonremote

np = sc.sticky['numpy']
scipy = sc.sticky['scipy']
mpl = sc.sticky['matplotlib']
plt = mpl.pyplot
rpy = sc.sticky['rpy']
pandas = sc.sticky['pandas']
skl = sc.sticky['sklearn'] #machine linput5ing models
linm = sc.sticky['sklearn.linear_model']
cluster = sc.sticky['sklearn.cluster']
nb = sc.sticky['sklearn.neighbors']
MLP = sc.sticky['sklearn.neural_network']
TREE = sc.sticky['sklearn.tree']

"""
#data (size / cost)
X = np.array([  [input1[0], input2[0], input3[0], input4[0], input5[0], output6[0]],
                [input1[1], input2[1], input3[1], input4[1], input5[1], output6[1]],
                [input1[2], input2[2], input3[2], input4[2], input5[2], output6[2]],
                [input1[3], input2[3], input3[3], input4[3], input5[3], output6[3]],
                [input1[4], input2[4], input3[4], input4[4], input5[4], output6[4]],
                [input1[5], input2[5], input3[5], input4[5], input5[5], output6[5]],
                [input1[6], input2[6], input3[6], input4[6], input5[6], output6[6]],
                [input1[7], input2[7], input3[7], input4[7], input5[7], output6[7]],
                [input1[8], input2[8], input3[8], input4[8], input5[8], output6[8]],
                [input1[9], input2[9], input3[9], input4[9], input5[9], output6[9]]])

#oneLiner
neural_net = MLP.MLPRegressor(max_iter=10000).fit(X[:,:-1], X[:,-1])

#result
res = neural_net.predict([[sample1,sample2,sample3,sample4,sample5]])
print(res)[0]"""

#data: points in (art, design, engineering) - study field
X = np.array([  [artA, artB, artC, 4],
                [desA, desB, desC, 5],
                [engA, engB, engC, 6]])

#oneLiner
Tree = TREE.tree.DecisionTreeClassifier().fit(X[:,:-1], X[:,-1])

#result and puzzle
researcher_0 = Tree.predict([[sample0A, sample0B, sample0C]])
print(researcher_0)[0]

researcher_1 = Tree.predict([[sample1A, sample1B, sample1C]])
print(researcher_1)[0]
# ---------- end oneliners_decision_tree_example_016 ----------
# Data Visualization @ Wickerson Studios
panel_8 = Panel(oneliners_decision_tree_example_016.out)  # disabled

xz_plane = XZPlane(Origin=Point(0, 0, 0))
yz_plane = YZPlane(Origin=Point(0, 0, 0))  # disabled
xy_plane = XYPlane(Origin=Point(0, 0, 0))  # disabled

number_slider_31 = Slider(0.1, range=0..0.1)  # disabled
number_slider_32 = Slider(1, range=1..3)  # disabled

number = Number(flatten(oneliners_neuralnetworkanalysis_013.out))  # disabled
unit_x = UnitX(Factor=number)  # disabled
quad_sphere = QuadSphere(Base=PlaneXY(0, 0, 0), Radius=number_slider_3)  # disabled
move = Move(Geometry=quad_sphere, Motion=unit_x)  # -> Geometry, Transform; disabled
list_length = ListLength(List=number)  # -> flatten(Length); disabled
polar_array = PolarArray(Geometry=move.Geometry, Plane=xz_plane, Count=list_length, Angle=degrees(number))  # -> Geometry, Transform; disabled
number_slider_33 = Slider(0, range=0..5)  # disabled
md_slider = MDSlider(SliderMode=0, slider_value=Point(0.5, 0.5, 0.5), x_domain=Domain(0, 1), y_domain=Domain(0, 1), z_domain=Domain(0, 1))  # disabled
deconstruct_brep = DeconstructBrep(Brep=polar_array.Geometry)  # -> Faces, Edges, Vertices; disabled
list_item = ListItem(List=deconstruct_brep.Faces, Index=number_slider_33, Wrap=True)  # disabled
evaluate_surface = EvaluateSurface(Surface=reparameterize(list_item), Point=md_slider)  # -> Point, Normal, UDirection, VDirection, Frame; disabled
amplitude = Amplitude(Vector=evaluate_surface.Normal, Amplitude=number_slider_32)  # disabled
extrude = Extrude(Base=list_item, Direction=amplitude)  # -> flatten(Extrusion); disabled
mesh_pipe = MeshPipe(Polylines=list_item, NumberOfSides=4, Tolerance=0.1, Radius=number_slider_31, Cap=False, Join=False)  # disabled

dispatch = Dispatch(List=oneliners_decision_tree_example_016.out, DispatchPattern=[True, False])  # -> ListA, ListB; disabled
circle = Circle(Plane=PlaneXY(0, 0, 0), Radius=dispatch.ListB)  # disabled
circle_2 = Circle(Plane=PlaneXY(0, 0, 0), Radius=dispatch.ListA)  # disabled
panel_9 = Panel(dispatch.ListA)  # disabled
rectangle = Rectangle(Plane=PlaneXY(0, 0, 0), XSize=dispatch.ListA, YSize=dispatch.ListB, Radius=0)  # -> Rectangle, Length; disabled
rectangle_2 = Rectangle(Plane=PlaneXY(0, 0, 0), XSize=dispatch.ListB, YSize=dispatch.ListA, Radius=0)  # -> Rectangle, Length; disabled
rectangular_array = RectangularArray(Geometry=circle, Cell=rectangle_2.Rectangle, XCount=dispatch.ListB, YCount=dispatch.ListB)  # -> Geometry, Transform; disabled
panel_10 = Panel(dispatch.ListB)  # disabled
rectangular_array_2 = RectangularArray(Geometry=circle_2, Cell=rectangle.Rectangle, XCount=dispatch.ListA, YCount=dispatch.ListA)  # -> Geometry, Transform; disabled
shortest_list = ShortestList(ListListA=rectangular_array_2.Geometry, ListListB=rectangular_array.Geometry, TrimMode=2)  # -> graft(ListListA), graft(ListListB); disabled
unit_x_2 = UnitX(Factor=1)  # disabled
unit_y = UnitY(Factor=1)  # disabled
area = Area(Geometry=shortest_list.ListListA)  # -> Area, Centroid; disabled
rotate_3d = Rotate3D(Geometry=shortest_list.ListListA, Angle=1.570796327, Center=area.Centroid, Axis=[unit_x_2, unit_y])  # -> Geometry, Transform; disabled
curve = Curve(shortest_list.ListListA)  # disabled
multipipe = MultiPipe(Curves=[curve, rotate_3d.Geometry], NodeSize=0.5, EndOffset=1, StrutSize=1, Segment=0, KinkAngle=0.6, CubeFit=0)  # disabled

# ---- group: All that JAZZ
# Base Script
# Jazz
ghpython_script = GhPythonScript()  # -> out, a; disabled
# ---------- ghpython_script: Python ----------
__author__ = "Sculpture"
__version__ = "2021.05.30"

import rhinoscriptsyntax as rs

#import and do all this JAZZ!
import rhinoscriptsyntax as rs
import scriptcontext as sc
import ghpythonremote

np = sc.sticky['numpy']
scipy = sc.sticky['scipy']
mpl = sc.sticky['matplotlib']
plt = mpl.pyplot
rpy = sc.sticky['rpy']
pandas = sc.sticky['pandas']
skl = sc.sticky['sklearn'] #machine linput5ing models
linm = sc.sticky['sklearn.linear_model']
cluster = sc.sticky['sklearn.cluster']
nb = sc.sticky['sklearn.neighbors']
MLP = sc.sticky['sklearn.neural_network']
TREE = sc.sticky['sklearn.tree']
svm = sc.sticky['sklearn.svm']
ens = sc.sticky['sklearn.ensemble']
"""
#data (size / cost)
X = np.array([  [input1[0], input2[0], input3[0], input4[0], input5[0], output6[0]],
                [input1[1], input2[1], input3[1], input4[1], input5[1], output6[1]],
                [input1[2], input2[2], input3[2], input4[2], input5[2], output6[2]],
                [input1[3], input2[3], input3[3], input4[3], input5[3], output6[3]],
                [input1[4], input2[4], input3[4], input4[4], input5[4], output6[4]],
                [input1[5], input2[5], input3[5], input4[5], input5[5], output6[5]],
                [input1[6], input2[6], input3[6], input4[6], input5[6], output6[6]],
                [input1[7], input2[7], input3[7], input4[7], input5[7], output6[7]],
                [input1[8], input2[8], input3[8], input4[8], input5[8], output6[8]],
                [input1[9], input2[9], input3[9], input4[9], input5[9], output6[9]]])

#oneLiner
neural_net = MLP.MLPRegressor(max_iter=10000).fit(X[:,:-1], X[:,-1])

#result
res = neural_net.predict([[sample1,sample2,sample3,sample4,sample5]])
print(res)[0]"""
# ---------- end ghpython_script ----------

# ----
number_slider_34 = Slider(70, range=0..100)  # disabled
# 007
number_slider_35 = Slider(62, range=0..100)  # disabled
# Minimal Variance
# Notes:
# the Vs in Big Data:
# volume, velocity, variety, veracity, value
# Variance is other that measures the
# expected squared deviation of the data
# from its mean
# Good for weather forecasting and
# image processiong
# The Basics:
# gathers the patterns of the data in
# a generalized manner
# i.e. bias-variance trade-off
# high and low variance
# Think of low and high variance stocks
# var(X) = sum of x to X (x-averageX)**2
number_slider_36 = Slider(69, range=0..100)  # disabled
panel_11 = Panel("6")  # disabled
# Minimal Variance
random = Random(Range=number_slider_35, Number=panel_11, Seed=number_slider_35)  # -> flatten(Random); disabled
random_2 = Random(Range=number_slider_34, Number=panel_11, Seed=number_slider_34)  # -> flatten(Random); disabled
random_3 = Random(Range=number_slider_36, Number=panel_11, Seed=number_slider_36)  # -> flatten(Random); disabled
oneliners_minimalvariance_016 = OneLiners_minimalVariance_016(x=random, y=random_2, z=random_3)  # -> out, a; inputs x: list, y: list, z: list; disabled
# ---------- oneliners_minimalvariance_016: Python ----------
__author__ = "Sculpture"
__version__ = "2021.05.30"

import rhinoscriptsyntax as rs

#import and do all this JAZZ!
import rhinoscriptsyntax as rs
import scriptcontext as sc
import ghpythonremote

np = sc.sticky['numpy']
scipy = sc.sticky['scipy']
mpl = sc.sticky['matplotlib']
plt = mpl.pyplot
rpy = sc.sticky['rpy']
pandas = sc.sticky['pandas']
skl = sc.sticky['sklearn'] #machine linput5ing models
linm = sc.sticky['sklearn.linear_model']
cluster = sc.sticky['sklearn.cluster']
nb = sc.sticky['sklearn.neighbors']
MLP = sc.sticky['sklearn.neural_network']
TREE = sc.sticky['sklearn.tree']


#data
X = np.array([  [x[0], x[1], x[2], x[3], x[4], x[5]],
                [y[0], y[1], y[2], y[3], y[4], y[5]],
                [z[0], z[1], z[2],  z[3], z[4], z[5]]])

#oneLiner
#find the stock with the smallest variance
min_row = min([(i,np.var(X[i,:])) for i in range(len(X))], key=lambda x: x[1])

#result and Puzzle
print("Row with minimum variance: " + str(min_row[0]))
print("Variance: " + str(min_row[1]))

"""
var = np.var(X, axis=1)
min_row = (np.where(var==min(var)), min(var))
"""
# ---------- end oneliners_minimalvariance_016 ----------

number_slider_37 = Slider(70, range=0..100)  # disabled
# 008
number_slider_38 = Slider(62, range=0..100)  # disabled
# Basic Statistics
# Notes:
# i.e. Bayesian networks
# average, variance, standard deviation
# NumPy is the heart of Python
# data science, statistics, and linear algebra
# The Basics:
# How to create these along an axis
# These calculations are similar
# * the SD is simply the sq root of the variance
# Notice that np flattens the 2D array
# If you want to do this along an axis,
# specify keyword axis as an argument
# to the functions
number_slider_39 = Slider(69, range=0..100)  # disabled
panel_12 = Panel("6")  # disabled
# Basic Statistics
random_4 = Random(Range=number_slider_38, Number=panel_12, Seed=number_slider_38)  # disabled
random_5 = Random(Range=number_slider_37, Number=panel_12, Seed=number_slider_37)  # disabled
random_6 = Random(Range=number_slider_39, Number=panel_12, Seed=number_slider_39)  # disabled
oneliners_basicstatistics_018 = OneLiners_basicStatistics_018(x=random_4, y=random_5, z=random_6)  # -> out, a; inputs x: list, y: list, z: list; disabled
# ---------- oneliners_basicstatistics_018: Python ----------
__author__ = "Sculpture"
__version__ = "2021.05.30"

import rhinoscriptsyntax as rs

#import and do all this JAZZ!
import rhinoscriptsyntax as rs
import scriptcontext as sc
import ghpythonremote

np = sc.sticky['numpy']
scipy = sc.sticky['scipy']
mpl = sc.sticky['matplotlib']
plt = mpl.pyplot
rpy = sc.sticky['rpy']
pandas = sc.sticky['pandas']
skl = sc.sticky['sklearn'] #machine linput5ing models
linm = sc.sticky['sklearn.linear_model']
cluster = sc.sticky['sklearn.cluster']
nb = sc.sticky['sklearn.neighbors']
MLP = sc.sticky['sklearn.neural_network']
TREE = sc.sticky['sklearn.tree']


#data
X = np.array([  [x[0], x[1], x[2], x[3]],
                [y[0], y[1], y[2], y[3]],
                [z[0], z[1], z[2],  z[3]]])

print(np.average(X))

print(np.var(X))

print(np.std(X))
# ---------- end oneliners_basicstatistics_018 ----------

panel_13 = Panel(oneliners_minimalvariance_016.out)  # disabled

panel_14 = Panel(oneliners_basicstatistics_018.out)  # disabled

number_slider_40 = Slider(68, range=0..100)  # disabled
# The Code:
# How it works:
# use the min() function
# key argument (lambda) takes 2nd tuple value
# Use index row(i)
# Also you use NumPy var() function
# in combination with slicing to calculate
# the row variance
# See alternative non-oneLiner in editor
# Calculate var of np array x
# along the axis=1
# Then create a tuple value as
# the variance array minimal
# More readable
# Onto Basic Statistics!
number_slider_41 = Slider(56, range=0..100)  # disabled
number_slider_42 = Slider(41, range=0..100)  # disabled

panel_15 = Panel("6")  # disabled

# ----
# Minimal Variance EXAMPLE
random_7 = Random(Range=number_slider_40, Number=panel_15, Seed=number_slider_40)  # -> flatten(Random); disabled
random_8 = Random(Range=number_slider_42, Number=panel_15, Seed=number_slider_42)  # -> flatten(Random); disabled
random_9 = Random(Range=number_slider_41, Number=panel_15, Seed=number_slider_41)  # -> flatten(Random); disabled
oneliners_minimalvarianceexample_017 = OneLiners_minimalVarianceEXAMPLE_017(x=random_7, y=random_8, z=random_9)  # -> out, a; inputs x: list, y: list, z: list; disabled
# ---------- oneliners_minimalvarianceexample_017: Python ----------
__author__ = "Sculpture"
__version__ = "2021.05.30"

import rhinoscriptsyntax as rs

#import and do all this JAZZ!
import rhinoscriptsyntax as rs
import scriptcontext as sc
import ghpythonremote

np = sc.sticky['numpy']
scipy = sc.sticky['scipy']
mpl = sc.sticky['matplotlib']
plt = mpl.pyplot
rpy = sc.sticky['rpy']
pandas = sc.sticky['pandas']
skl = sc.sticky['sklearn'] #machine linput5ing models
linm = sc.sticky['sklearn.linear_model']
cluster = sc.sticky['sklearn.cluster']
nb = sc.sticky['sklearn.neighbors']
MLP = sc.sticky['sklearn.neural_network']
TREE = sc.sticky['sklearn.tree']


#data
X = np.array([  [x[0], x[1], x[2], x[3], x[4], x[5]],
                [y[0], y[1], y[2], y[3], y[4], y[5]],
                [z[0], z[1], z[2],  z[3], z[4], z[5]]])

#oneLiner
#find the stock with the smallest variance
min_row = min([(i,np.var(X[i,:])) for i in range(len(X))], key=lambda x: x[1])

#result and Puzzle
#print("Row with minimum variance: " + str(min_row[0]))
#print("Variance: " + str(min_row[1]))
print(min_row[1])
"""
var = np.var(X, axis=1)
min_row = (np.where(var==min(var)), min(var))
"""
# ---------- end oneliners_minimalvarianceexample_017 ----------

number_slider_43 = Slider(12, range=2..12)  # disabled
number_slider_44 = Slider(8, range=2..12)  # disabled
number_slider_45 = Slider(10, range=2..12)  # disabled
# The Code:
# How it works:
# the oneliner uses the axis keyword
# reduces the dimensionality to one
# Let's also look at a higher Dimensional Array
# The Code:
# This is required for many machine learning
# algorithms
number_slider_46 = Slider(24, range=0..100)  # disabled

# ----
# Basic Statistics Multi Dim Array  EXAMPLE
oneliners_basicstatisticsmultidimexample = OneLiners_basicStatisticsMultiDimEXAMPLE_020()  # -> out, a; inputs x: list, y: list, z: list; disabled
# ---------- oneliners_basicstatisticsmultidimexample: Python ----------
__author__ = "Sculpture"
__version__ = "2021.05.30"

import rhinoscriptsyntax as rs

#import and do all this JAZZ!
import rhinoscriptsyntax as rs
import scriptcontext as sc
import ghpythonremote

np = sc.sticky['numpy']
scipy = sc.sticky['scipy']
mpl = sc.sticky['matplotlib']
plt = mpl.pyplot
rpy = sc.sticky['rpy']
pandas = sc.sticky['pandas']
skl = sc.sticky['sklearn'] #machine linput5ing models
linm = sc.sticky['sklearn.linear_model']
cluster = sc.sticky['sklearn.cluster']
nb = sc.sticky['sklearn.neighbors']
MLP = sc.sticky['sklearn.neural_network']
TREE = sc.sticky['sklearn.tree']


#data
x = np.array([  [[1,2], [1,1], [2,3]],
                [[1,1], [2,1], [3,1]],
                [[1,0], [0,0], [3,1]]])
                
print(np.average(x, axis=2))
print(np.var(x, axis=2))
print(np.std(x, axis=2))
# ---------- end oneliners_basicstatisticsmultidimexample ----------
panel_16 = Panel(oneliners_basicstatisticsmultidimexample.out)  # disabled

panel_17 = Panel("6")  # disabled

# ----
# Basic Statistics EXAMPLE
random_10 = Random(Range=number_slider_43, Number=panel_17, Seed=number_slider_46)  # disabled
random_11 = Random(Range=number_slider_44, Number=panel_17, Seed=number_slider_46)  # disabled
random_12 = Random(Range=number_slider_45, Number=panel_17, Seed=number_slider_46)  # disabled
oneliners_basicstatisticsexample_019 = OneLiners_basicStatisticsEXAMPLE_019(x=random_10, y=random_11, z=random_12)  # -> out, a; inputs x: list, y: list, z: list; disabled
# ---------- oneliners_basicstatisticsexample_019: Python ----------
__author__ = "Sculpture"
__version__ = "2021.05.30"

import rhinoscriptsyntax as rs

#import and do all this JAZZ!
import rhinoscriptsyntax as rs
import scriptcontext as sc
import ghpythonremote

np = sc.sticky['numpy']
scipy = sc.sticky['scipy']
mpl = sc.sticky['matplotlib']
plt = mpl.pyplot
rpy = sc.sticky['rpy']
pandas = sc.sticky['pandas']
skl = sc.sticky['sklearn'] #machine linput5ing models
linm = sc.sticky['sklearn.linear_model']
cluster = sc.sticky['sklearn.cluster']
nb = sc.sticky['sklearn.neighbors']
MLP = sc.sticky['sklearn.neural_network']
TREE = sc.sticky['sklearn.tree']


#data
x = np.array([  [x[0], x[1], x[2], x[3]],
                [y[0], y[1], y[2], y[3]],
                [z[0], z[1], z[2], z[3]]])

#oneLiner
avg, var, std = np.average(x, axis=1), np.var(x, axis=1), np.std(x, axis=1)

#result and puzzle
print("Averages: " + str(avg))
print("Variances: " + str(var))
print("Standard Deviations: " + str(std))
# ---------- end oneliners_basicstatisticsexample_019 ----------
panel_18 = Panel(oneliners_basicstatisticsexample_019.out)  # disabled
oneliners_basicstatistics_ws_example_021 = OneLiners_basicStatistics_WS_EXAMPLE_021(x=random_10, y=random_11, z=random_12)  # -> out, a; inputs x: list, y: list, z: list; disabled
# ---------- oneliners_basicstatistics_ws_example_021: Python ----------
__author__ = "Sculpture"
__version__ = "2021.05.30"

import rhinoscriptsyntax as rs

#import and do all this JAZZ!
import rhinoscriptsyntax as rs
import scriptcontext as sc
import ghpythonremote

np = sc.sticky['numpy']
scipy = sc.sticky['scipy']
mpl = sc.sticky['matplotlib']
plt = mpl.pyplot
rpy = sc.sticky['rpy']
pandas = sc.sticky['pandas']
skl = sc.sticky['sklearn'] #machine linput5ing models
linm = sc.sticky['sklearn.linear_model']
cluster = sc.sticky['sklearn.cluster']
nb = sc.sticky['sklearn.neighbors']
MLP = sc.sticky['sklearn.neural_network']
TREE = sc.sticky['sklearn.tree']


#data
x = np.array([  [x[0], x[1], x[2], x[3]],
                [y[0], y[1], y[2], y[3]],
                [z[0], z[1], z[2], z[3]]])

#oneLiner
avg, var, std = np.average(x, axis=1), np.var(x, axis=1), np.std(x, axis=1)

#result and puzzle
for i in range(3):
    print(avg)[i]
    print(var)[i]
    print(std)[i]
# ---------- end oneliners_basicstatistics_ws_example_021 ----------
panel_19 = Panel(oneliners_basicstatistics_ws_example_021.out)  # disabled

panel_20 = Panel(oneliners_minimalvarianceexample_017.out)  # disabled

# ----
# Data Visualization @ Wickerson Studios
number_2 = Number(graft(random_9))  # disabled
number_3 = Number(graft(random_7))  # disabled
number_4 = Number(graft(random_8))  # disabled
number_5 = Number(panel_20)  # disabled
quad_sphere_2 = QuadSphere(Base=PlaneXY(0, 0, 0), Radius=number_5)  # disabled
division = Division(A=number_2, B=number_5)  # disabled
division_2 = Division(A=number_4, B=number_5)  # disabled
division_3 = Division(A=number_3, B=number_5)  # disabled
panel_21 = Panel(division)  # disabled
deconstruct_brep_2 = DeconstructBrep(Brep=quad_sphere_2)  # -> Faces, Edges, Vertices; disabled
construct_point = ConstructPoint(XCoordinate=division_3, YCoordinate=division_2, ZCoordinate=0)  # disabled
construct_point_2 = ConstructPoint(XCoordinate=division_2, YCoordinate=division, ZCoordinate=0)  # disabled
construct_point_3 = ConstructPoint(XCoordinate=division_3, YCoordinate=division, ZCoordinate=0)  # disabled
surface = Surface(deconstruct_brep_2.Faces)  # disabled
evaluate_surface_2 = EvaluateSurface(Surface=reparameterize(surface), Point=construct_point_2)  # -> flatten(Point), Normal, UDirection, VDirection, Frame; disabled
evaluate_surface_3 = EvaluateSurface(Surface=reparameterize(surface), Point=construct_point_3)  # -> flatten(Point), Normal, UDirection, VDirection, Frame; disabled
evaluate_surface_4 = EvaluateSurface(Surface=reparameterize(surface), Point=construct_point)  # -> flatten(Point), Normal, UDirection, VDirection, Frame; disabled
number_slider_47 = Slider(100, range=0..100)  # disabled
nurbs_curve = NurbsCurve(Vertices=evaluate_surface_4.Point, Degree=3, Periodic=False)  # -> Curve, Length, Domain; disabled
nurbs_curve_2 = NurbsCurve(Vertices=evaluate_surface_3.Point, Degree=3, Periodic=False)  # -> Curve, Length, Domain; disabled
nurbs_curve_3 = NurbsCurve(Vertices=evaluate_surface_2.Point, Degree=3, Periodic=False)  # -> Curve, Length, Domain; disabled
multipipe_2 = MultiPipe(
    Curves=graft([nurbs_curve.Curve, nurbs_curve_2.Curve, nurbs_curve_3.Curve]),
    NodeSize=number_slider_47,
    EndOffset=1,
    StrutSize=1,
    Segment=0,
    KinkAngle=0.6,
    CubeFit=0)  # disabled
cap_holes = CapHoles(Brep=multipipe_2)  # disabled
number_slider_48 = Slider(285, range=0..1000)  # disabled
explode_tree = ExplodeTree(Data=cap_holes)  # -> Branch0, Branch1, Branch2; disabled
geometry = Geometry(explode_tree.Branch0)  # disabled
geometry_2 = Geometry(explode_tree.Branch2)  # disabled
unit_x_3 = UnitX(Factor=number_slider_48)  # disabled
move_2 = Move(Geometry=geometry_2, Motion=expr("-x", unit_x_3))  # -> Geometry, Transform; disabled
move_3 = Move(Geometry=geometry, Motion=unit_x_3)  # -> Geometry, Transform; disabled
number_slider_49 = Slider(12, range=0..100)  # disabled
geometry_3 = Geometry(explode_tree.Branch1)  # disabled
geometry_4 = Geometry(quad_sphere_2)  # disabled
brep_brep = BrepBrep(BrepA=geometry_4, BrepB=geometry_3)  # -> Curves, Points; disabled
multipipe_3 = MultiPipe(Curves=brep_brep.Curves, NodeSize=number_slider_49, EndOffset=1, StrutSize=1, Segment=0, KinkAngle=0.6, CubeFit=0)  # disabled

# ----
# Data Visualization @ Wickerson Studios
number_6 = Number(graft(oneliners_basicstatistics_ws_example_021.out))  # disabled
explode_tree_2 = ExplodeTree(Data=number_6)  # -> Branch0, Branch1, Branch2, Branch3, Branch4, Branch5, Branch6, Branch7, Branch8; disabled
xy_plane_2 = XYPlane(Origin=Point(0, 0, 0))  # disabled
yz_plane_2 = YZPlane(Origin=Point(0, 0, 0))  # disabled
xz_plane_2 = XZPlane(Origin=Point(0, 0, 0))  # disabled
square = Square(Plane=xz_plane_2, Size=explode_tree_2.Branch6, ExtentX=explode_tree_2.Branch7, ExtentY=explode_tree_2.Branch8)  # -> Cells, Points; disabled
square_2 = Square(Plane=xy_plane_2, Size=explode_tree_2.Branch0, ExtentX=explode_tree_2.Branch1, ExtentY=explode_tree_2.Branch2)  # -> Cells, Points; disabled
square_3 = Square(Plane=yz_plane_2, Size=explode_tree_2.Branch3, ExtentX=explode_tree_2.Branch4, ExtentY=explode_tree_2.Branch5)  # -> Cells, Points; disabled
join_curves = JoinCurves(Curves=[square_2.Cells, square_3.Cells, square.Cells], Preserve=False)  # disabled
multipipe_4 = MultiPipe(Curves=join_curves, NodeSize=0.5, EndOffset=1, StrutSize=1, Segment=0, KinkAngle=0.6, CubeFit=0)  # disabled

# ----
# 009
number_slider_50 = Slider(8, range=0..10)  # disabled
number_slider_51 = Slider(6, range=0..10)  # disabled
# Support-Vector Machines Algorithm
# Notes:
# SVMs have robust classification performance
# They work with more than data items
# More dimensional features
# "curse of dimensionality"
# increases dimensionality means sparse data
# The Basic Idea:
# Classification devides data in one class from another
# The decision boundary is a low order line or
# a high order curve
# Linear classifier and nonlinear classifier
# But what is the best decision boundary?
# SVMs provide the answer
# the one with the most marginal safety
# maximize the error of margin
# SVM classifier finds this
# margins
number_slider_52 = Slider(10, range=0..10)  # disabled
panel_22 = Panel("3")  # disabled
# Support-Vector Machines Algorithm
random_13 = Random(Range=number_slider_50, Number=panel_22, Seed=2)  # disabled
random_14 = Random(Range=number_slider_50, Number=panel_22, Seed=number_slider_51)  # disabled
random_15 = Random(Range=number_slider_50, Number=panel_22, Seed=number_slider_52)  # disabled
oneliners_svmalgorithm_022 = OneLiners_SVMalgorithm_022(x=random_13, y=random_14, z=random_15)  # -> out, a; inputs x: list, y: list, z: list; disabled
# ---------- oneliners_svmalgorithm_022: Python ----------
__author__ = "Sculpture"
__version__ = "2021.05.30"

import rhinoscriptsyntax as rs

#import and do all this JAZZ!
import rhinoscriptsyntax as rs
import scriptcontext as sc
import ghpythonremote

np = sc.sticky['numpy']
scipy = sc.sticky['scipy']
mpl = sc.sticky['matplotlib']
plt = mpl.pyplot
rpy = sc.sticky['rpy']
pandas = sc.sticky['pandas']
skl = sc.sticky['sklearn'] #machine linput5ing models
linm = sc.sticky['sklearn.linear_model']
cluster = sc.sticky['sklearn.cluster']
nb = sc.sticky['sklearn.neighbors']
MLP = sc.sticky['sklearn.neural_network']
TREE = sc.sticky['sklearn.tree']
svm = sc.sticky['sklearn.svm']

#data
"""
X = np.array([  [2, 3, 5, "computer science"],
                [4, 7, 8, "computer science"],
                [3, 2, 6, "creative writing "],
                [4, 7, 5, "creative writing "], 
                [1, 1, 3, "art"], 
                [4, 5, 3, "art"]])
"""
X = np.array([  [x[0], x[1], x[2], "computer science"],
                [x[0], x[2], x[1], "computer science"],
                [y[0], y[1], y[2], "creative writing "],
                [y[2], y[1], y[0], "creative writing "], 
                [x[0], x[2], x[1], "art"], 
                [x[2], x[0], x[1], "art"]])

#oneLiner
svm = svm.SVC().fit(X[:,:-1], X[:,-1])

#result and puzzel
player_1 = svm.predict([[3, 3, 3]])
print(player_1)
# ---------- end oneliners_svmalgorithm_022 ----------
panel_23 = Panel(oneliners_svmalgorithm_022.out)  # disabled

# ----
# Classification with Random Forests
# 010
# Random Forests (ensemble)
# Notes:
# Ensemble Learning
# Great to meet a deadline
# A bit of everythin
# The Basics:
# Create a meta-classifier consisting of
# multiple types or instances of
# basic ML algorithms
# Ask all models to classify the input independently
# REturn the most common class
# as a meta-prediction
# Random Forests are a special type of ensemble
# Consists of many decision trees
# Randomly
oneliners_randomforestsensemble_024 = OneLiners_randomForestsEnsemble_024()  # -> out, a; disabled
# ---------- oneliners_randomforestsensemble_024: Python ----------
__author__ = "Sculpture"
__version__ = "2021.05.30"

import rhinoscriptsyntax as rs

#import and do all this JAZZ!
import rhinoscriptsyntax as rs
import scriptcontext as sc
import ghpythonremote

np = sc.sticky['numpy']
scipy = sc.sticky['scipy']
mpl = sc.sticky['matplotlib']
plt = mpl.pyplot
rpy = sc.sticky['rpy']
pandas = sc.sticky['pandas']
skl = sc.sticky['sklearn'] #machine linput5ing models
linm = sc.sticky['sklearn.linear_model']
cluster = sc.sticky['sklearn.cluster']
nb = sc.sticky['sklearn.neighbors']
MLP = sc.sticky['sklearn.neural_network']
TREE = sc.sticky['sklearn.tree']
svm = sc.sticky['sklearn.svm']
ens = sc.sticky['sklearn.ensemble']

#data

X = np.array([  [9, 5, 6, "computer science"],
                [5, 1, 5, "computer science"],
                [8, 8, 8, "computer science"],
                [1, 10, 7, "creative writing "],
                [1, 8, 1, "creative writing "], 
                [5, 7, 9, "art"], 
                [1, 1, 6, "art"]])

#oneLiner
Forest = ens.RandomForestClassifier(n_estimators=10, random_state=1).fit(X[:,:-1], X[:,-1])
#random_state=1 is optional to maintain same seed results each time

#result and puzzel
kids = Forest.predict([ [8, 6, 5],
                        [3, 7, 9],
                        [2, 2, 1]])

print(kids)
# ---------- end oneliners_randomforestsensemble_024 ----------
panel_24 = Panel(oneliners_randomforestsensemble_024.out)  # disabled

number_slider_53 = Slider(10, range=0..10)  # disabled
number_slider_54 = Slider(1010, range=0..1010)  # disabled
panel_25 = Panel("3")  # disabled

# ----
# Support-Vector Machines Algorithm EXAMPLE
panel_26 = Panel("12")  # disabled
integer_division = IntegerDivision(A=number_slider_54, B=number_slider_53)  # disabled
integer_division_2 = IntegerDivision(A=number_slider_54, B=panel_26)  # disabled
integer = Integer(integer_division)  # disabled
# The Code:
# How it works:
# one row per user and one column per feature
# Create a model with svm.SVC class
# call fit()
# Planes are used rather than one-Dim lines
# Then  call predict() function on new observations
# Summary: SVMs perform well in multi dim spaces
# when there are more features than training data
# margins of safety
# boundary cases
# Now onto Meta-algorithm for classification
# ensemble learning with random forests
integer_2 = Integer(integer_division_2)  # disabled
random_16 = Random(Range=number_slider_53, Number=panel_25, Seed=number_slider_54)  # disabled
random_17 = Random(Range=number_slider_53, Number=panel_25, Seed=integer)  # disabled
random_18 = Random(Range=number_slider_53, Number=panel_25, Seed=integer_2)  # disabled

number_slider_55 = Slider(1010, range=0..1010)  # disabled
number_slider_56 = Slider(10, range=0..10)  # disabled
panel_27 = Panel("3")  # disabled

number_slider_57 = Slider(9, range=0..10)  # disabled
number_slider_58 = Slider(8, range=0..10)  # disabled
number_slider_59 = Slider(4, range=0..10)  # disabled

# ----
# Data Visualization @ Wickerson Studios
oneliners_svmalgorithm_ws_example_023 = OneLiners_SVMalgorithm_WS_EXAMPLE_023(x=random_16, y=random_17, z=random_18, u=number_slider_58, v=number_slider_59, w=number_slider_57)  # -> graft(out), a; inputs x: list, y: list, z: list; disabled
# ---------- oneliners_svmalgorithm_ws_example_023: Python ----------
__author__ = "Sculpture"
__version__ = "2021.05.30"

import rhinoscriptsyntax as rs

#import and do all this JAZZ!
import rhinoscriptsyntax as rs
import scriptcontext as sc
import ghpythonremote

np = sc.sticky['numpy']
scipy = sc.sticky['scipy']
mpl = sc.sticky['matplotlib']
plt = mpl.pyplot
rpy = sc.sticky['rpy']
pandas = sc.sticky['pandas']
skl = sc.sticky['sklearn'] #machine linput5ing models
linm = sc.sticky['sklearn.linear_model']
cluster = sc.sticky['sklearn.cluster']
nb = sc.sticky['sklearn.neighbors']
MLP = sc.sticky['sklearn.neural_network']
TREE = sc.sticky['sklearn.tree']
svm = sc.sticky['sklearn.svm']

#data
"""
X = np.array([  [2, 3, 5, "computer science"],
                [4, 7, 8, "computer science"],
                [3, 2, 6, "creative writing "],
                [4, 7, 5, "creative writing "], 
                [1, 1, 3, "art"], 
                [4, 5, 3, "art"]])
"""
X = np.array([  [x[0], x[1], x[2], 3],
                [x[0], x[2], x[1], 4],
                [y[0], y[1], y[2], 5],
                [y[2], y[1], y[0], 6], 
                [x[0], x[2], x[1], 7], 
                [x[2], x[0], x[1], 8]])

#oneLiner
svm = svm.SVC().fit(X[:,:-1], X[:,-1])

#result and puzzel
for i in range(1):
    print(svm.predict([[u, v, w]]))[i]
    print(svm.predict([[v, u, w]]))[i]
    print(svm.predict([[w, u, v]]))[i]
    print(svm.predict([[u, w, v]]))[i]
    print(svm.predict([[v, w, u]]))[i]
    print(svm.predict([[w, v, u]]))[i]

#player_1 = svm.predict([[3, 3, 3]])
#print(player_1)
# ---------- end oneliners_svmalgorithm_ws_example_023 ----------
panel_28 = Panel(oneliners_svmalgorithm_ws_example_023.out)  # disabled
explode_tree_3 = ExplodeTree(Data=oneliners_svmalgorithm_ws_example_023.out)  # -> Branch0, Branch1, Branch2, Branch3, Branch4, Branch5; disabled
panel_29 = Panel([explode_tree_3.Branch0, explode_tree_3.Branch1, explode_tree_3.Branch2, explode_tree_3.Branch3, explode_tree_3.Branch4, explode_tree_3.Branch5])  # disabled
number_7 = Number(explode_tree_3.Branch0)  # disabled
number_8 = Number(explode_tree_3.Branch1)  # disabled
number_9 = Number(explode_tree_3.Branch2)  # disabled
number_10 = Number(explode_tree_3.Branch3)  # disabled
number_11 = Number(explode_tree_3.Branch4)  # disabled
number_12 = Number(explode_tree_3.Branch5)  # disabled

# ----
# Classification with Random Forests EXAMPLE
# The Code:
# How it works:
# After initializing the training data
# It create a random forest using the constructor
# class RandomForestClassifier
# with one parameter n_estimates
# Then call the fit() function
# Consist of all but the last column
# Use slicing to extract columns
# You can use multi-dim array
# Use can also set the seed with random_state=1
# The strength is that it can be done individually
# for each data value at runtime
panel_30 = Panel("12")  # disabled
integer_division_3 = IntegerDivision(A=number_slider_55, B=number_slider_56)  # disabled
integer_division_4 = IntegerDivision(A=number_slider_55, B=panel_30)  # disabled
integer_3 = Integer(integer_division_3)  # disabled
integer_4 = Integer(integer_division_4)  # disabled
random_19 = Random(Range=number_slider_56, Number=panel_27, Seed=number_slider_55)  # disabled
random_20 = Random(Range=number_slider_56, Number=panel_27, Seed=integer_3)  # disabled
random_21 = Random(Range=number_slider_56, Number=panel_27, Seed=integer_4)  # disabled
integer_5 = Integer(random_19)  # disabled
integer_6 = Integer(random_20)  # disabled
integer_7 = Integer(random_21)  # disabled

oneliners_randomforestsensembleexample_0 = OneLiners_randomForestsEnsembleEXAMPLE_025(x=integer_5, y=integer_6, z=integer_7)  # -> out, a; inputs x: list of Int32, y: list of Int32, z: list of Int32; disabled
# ---------- oneliners_randomforestsensembleexample_0: Python ----------
__author__ = "Sculpture"
__version__ = "2021.05.30"

import rhinoscriptsyntax as rs

#import and do all this JAZZ!
import rhinoscriptsyntax as rs
import scriptcontext as sc
import ghpythonremote

np = sc.sticky['numpy']
scipy = sc.sticky['scipy']
mpl = sc.sticky['matplotlib']
plt = mpl.pyplot
rpy = sc.sticky['rpy']
pandas = sc.sticky['pandas']
skl = sc.sticky['sklearn'] #machine linput5ing models
linm = sc.sticky['sklearn.linear_model']
cluster = sc.sticky['sklearn.cluster']
nb = sc.sticky['sklearn.neighbors']
MLP = sc.sticky['sklearn.neural_network']
TREE = sc.sticky['sklearn.tree']
svm = sc.sticky['sklearn.svm']
ens = sc.sticky['sklearn.ensemble']

#data
"""
X = np.array([  [9, 5, 6, 1],
                [5, 1, 5, 1],
                [8, 8, 8, 1],
                [1, 10, 7, 2],
                [1, 8, 1, 2], 
                [5, 7, 9, 3], 
                [1, 1, 6, 3]])
"""
X = np.array([  [x[0], x[1], x[2], 1],
                [x[0], x[2], x[1], 1],
                [y[0], y[1], y[2], 2],
                [y[2], y[1], y[0], 2], 
                [x[0], x[2], x[1], 3], 
                [x[2], x[0], x[1], 3]])

#oneLiner
Forest = ens.RandomForestClassifier(n_estimators=10).fit(X[:,:-1], X[:,-1])
#random_state=1 is optional to maintain same seed results each time
#Forest = ens.RandomForestClassifier(n_estimators=10, random_state=1).fit(X[:,:-1], X[:,-1])

#result and puzzel
kids = Forest.predict([ [8, 6, 5],
                        [3, 7, 9],
                        [2, 2, 1]])

for i in range(3):
    print(kids)[i]
# ---------- end oneliners_randomforestsensembleexample_0 ----------

panel_31 = Panel(oneliners_randomforestsensembleexample_0.out)  # disabled

# ----
# Data Visualization @ Wickerson Studios
square_4 = Square(
    Plane=PlaneXY(0, 0, 0),
    Size=oneliners_randomforestsensembleexample_0.out,
    ExtentX=oneliners_randomforestsensembleexample_0.out,
    ExtentY=oneliners_randomforestsensembleexample_0.out)  # -> Cells, Points; disabled
number_slider_60 = Slider(1.15, range=0..2)  # disabled
range_7 = Range(Domain=number_slider_60, Steps=10)  # disabled
pi = Pi(Factor=range_7)  # disabled
rotate_3d_2 = Rotate3D(Geometry=square_4.Cells, Angle=pi, Center=square_4.Points, Axis=Vector(0, 0, 1))  # -> Geometry, Transform; disabled
list_length_2 = ListLength(List=square_4.Cells)  # -> flatten(Length); disabled
unit_z = UnitZ(Factor=list_length_2)  # disabled
region_union = RegionUnion(Curves=flatten(rotate_3d_2.Geometry))  # disabled
panel_32 = Panel(region_union)  # disabled
extrude_2 = Extrude(Base=region_union, Direction=unit_z)  # disabled
clean_tree = CleanTree(RemoveNulls=True, RemoveInvalid=True, RemoveEmpty=False, Tree=extrude_2)  # disabled
cap_holes_2 = CapHoles(Brep=clean_tree)  # disabled
clean_tree_2 = CleanTree(RemoveNulls=True, RemoveInvalid=True, RemoveEmpty=False, Tree=cap_holes_2)  # disabled
panel_33 = Panel(clean_tree_2)  # disabled

unit_z_2 = UnitZ(Factor=number_7)  # disabled
radial = Radial(Plane=PlaneXY(0, 0, 0), Size=number_10, ExtentR=number_11, ExtentP=number_12)  # -> Cells, Points; disabled
move_4 = Move(Geometry=radial.Points, Motion=unit_z_2)  # -> flatten(Geometry), Transform; disabled
radial_2 = Radial(Plane=PlaneXY(0, 0, 0), Size=number_7, ExtentR=number_8, ExtentP=number_9)  # -> Cells, flatten(Points); disabled
list_length_3 = ListLength(List=move_4.Geometry)  # disabled
list_length_4 = ListLength(List=radial_2.Points)  # disabled
negative = Negative(Value=unit_z_2)  # disabled
expression = Expression(x=list_length_4, Expression="x-1")  # disabled
expression_2 = Expression(x=list_length_3, Expression="x-1")  # disabled
range_8 = Range(Domain=Domain(0, 1), Steps=expression_2)  # disabled
range_9 = Range(Domain=Domain(0, 1), Steps=expression)  # disabled
amplitude_2 = Amplitude(Vector=negative, Amplitude=range_8)  # disabled
amplitude_3 = Amplitude(Vector=radial_2.Points, Amplitude=range_9)  # disabled
shortest_list_2 = ShortestList(ListListA=amplitude_3, ListListB=amplitude_2, TrimMode=2)  # -> ListListA, ListListB; disabled
shortest_list_3 = ShortestList(ListListA=radial_2.Points, ListListB=move_4.Geometry, TrimMode=2)  # -> ListListA, ListListB; disabled
move_5 = Move(Geometry=shortest_list_3.ListListB, Motion=shortest_list_2.ListListB)  # -> Geometry, Transform; disabled
move_6 = Move(Geometry=shortest_list_3.ListListA, Motion=shortest_list_2.ListListA)  # -> Geometry, Transform; disabled
line = Line(StartPoint=move_6.Geometry, EndPoint=move_5.Geometry)  # disabled
# SUMMARY MACHINE LEARNING
# 10 basic ML algorithms
# regression
# KNNs
# neural networks
# classification algorithms
# like:
# logistic regression
# decision-trees
# SVMs
# random Forests
# and
# basic statistics
# of multidimensional data arrays
# K-Mean algorithm for unsupervised learning
#  to be a Machine learning Engineer
# check out excellent and free Coursera from Andrew Ng
# Now onto Regular Expressions
# Highly Technical!
unit_z_3 = UnitZ(Factor=number_12)  # disabled
negative_2 = Negative(Value=unit_z_3)  # disabled
panel_34 = Panel("1")  # disabled
panel_35 = Panel("2")  # disabled
panel_36 = Panel("0")  # disabled

point_on_curve = PointOnCurve(line, parameter=0.582)  # disabled
point_on_curve_2 = PointOnCurve(line, parameter=0.145)  # disabled

move_7 = Move(Geometry=point_on_curve_2, Motion=unit_z_3)  # -> Geometry, Transform; disabled
move_8 = Move(Geometry=point_on_curve, Motion=negative_2)  # -> Geometry, Transform; disabled
merge = Merge(Data1=graft(move_6.Geometry), Data2=graft(move_7.Geometry), Data3=graft(move_8.Geometry), Data4=move_5.Geometry)  # disabled
clean_tree_3 = CleanTree(RemoveNulls=panel_34, RemoveInvalid=panel_34, RemoveEmpty=panel_34, Tree=merge)  # disabled
nurbs_curve_4 = NurbsCurve(Vertices=clean_tree_3, Degree=panel_35, Periodic=False)  # -> flatten(Curve), Length, Domain; disabled
cull_index = CullIndex(List=nurbs_curve_4.Curve, Indices=panel_36, Wrap=True)  # disabled
pipe = Pipe(Curve=cull_index, Radius=1, Caps=panel_35)  # disabled

# ==== cluster GHPythonRemote: Connects the Grasshopper Python component to an external Python instance.
python = PythonScript()  # -> gh_parent_doc_dir
# ---------- python: Python ----------
from os import path

gh_parent_doc_dir = path.abspath(path.dirname(ghenv.Component.OnPingDocument().Owner.OnPingDocument().FilePath))
# ---------- end python ----------
# GH to python remote example.
# Pierre Cuvilliers, 2017-2018
# Released under the MIT license
# github.com/pilcru/ghpythonremote
# Runs and connects to an external python engine, and
# assigns imported modules to scriptcontext.sticky variables.
# 
# Arguments:
#       code (str): Path to the GH_to_python_sticky.py code file.
#       location (str): Path to a python executable, or to a folder
#             containing `python.exe`, or the name of a conda-created
#             virtual environment prefixed by `conda://` (`conda://env_name`).
#             If empty, finds python from your windows %PATH%.
#       run (boolean): Creates the connection, and imports new
#             modules, when turned to True. Kills the connection,
#             and deletes the references to the imports, when turned
#             to False.
#       modules (str list): List of module names to import in the
#             remote python. They will be added to the
#             scriptcontext.sticky dictionary, allowing them to be
#             reused from other python components in the same
#             Grasshopper document. Submodules (for example
#             `numpy.linalg` have to be added explicitly to this list
#             to be available later.
#       log_level (str from ['NOTSET', 'DEBUG', 'INFO', 'WARNING', 'ERROR', 'CRITICAL']):
#             Logging level to use for the local IronPython and the
#             remote python instance.
#       working_dir (str): Working directory for the remote python
#             instance.
# 
# Returns:
#       out (str): Console output with DEBUG information.
#       linked_modules (str list): list of imported module names.
#       rpy (rpyc connection object): The object representing the
#             remote Python interpreter.
location = ClusterInput()  # location (str): Path to a python executable, or to a folder containing `python.exe`, or the name of a conda-created virtual environment prefixed by `conda://` (`conda://env_name`). If empty, finds python from your windows %PATH%.
run = ClusterInput()  # run (boolean): Creates the connection, and imports new modules, when turned to True. Kills the connection,and deletes the references to the imports, when turned to False.
modules = ClusterInput()  # modules (str list): List of module names to import in the remote python. They will be added to the scriptcontext.sticky dictionary, allowing them to be reused from other python components in the same Grasshopper document. Submodules (for example `numpy.linalg` have to be added explicitly to this list to be available later.
list = ValueList({"CRITICAL", "ERROR", "WARNING", "INFO", "DEBUG", "NOTSET"}, selected="DEBUG")
panel = Panel(python)
ghpythonremote = GHPythonRemote(location=location, run=run, modules=modules, log_level=list, working_dir=panel)  # -> out, linked_modules, rpy; inputs run: Boolean, modules: list
# ---------- ghpythonremote: Python ----------
import inspect
import logging
from os import path
import sys
from time import sleep

import scriptcontext

import ghpythonremote
from ghpythonremote.connectors import GrasshopperToPythonRemote

local_log_level = getattr(logging, log_level, logging.WARNING)
logger = logging.getLogger("ghpythonremote")
logger.setLevel(local_log_level)
ch = logging.StreamHandler()
ch.setLevel(local_log_level)
formatter = logging.Formatter("%(levelname)s: %(name)s:\n%(message)s")
ch.setFormatter(formatter)
logger.handlers = []
logger.addHandler(ch)
logger = logging.getLogger("ghpythonremote.GH_to_python")

ROOT = path.abspath(path.dirname(inspect.getfile(ghpythonremote)))
rpyc_server_py = path.join(ROOT, "pythonservice.py")

# Set connection to CLOSED if this is the first run
# and initialize set of linked modules
try:
    remote_python_status
except NameError:
    remote_python_status = "CLOSED"
    lkd_modules = set()

# Wait for connection to connect or terminate
timer = 0
while remote_python_status == "CONNECTING" or remote_python_status == "CLOSING":
    sleep(1)
    timer += 1
    if timer == 10:
        try:
            gh2py_manager.__exit__(*sys.exc_info())
        except Exception:
            pass
        remote_python_status = "CLOSED"
        lkd_modules = set()
        raise RuntimeError(
            "Connection left in an inconsistent state and not returning. Reset "
            "everything."
        )

if run:
    if not remote_python_status == "OPEN":
        remote_python_status = "CONNECTING"
        gh2py_manager = GrasshopperToPythonRemote(
            rpyc_server_py,
            location=location,
            timeout=10,
            port=None,
            log_level=log_level,
            working_dir=working_dir,
        )
        gh2py = gh2py_manager.__enter__()
        remote_python_status = "OPEN"

    # Stuff that we can reach
    rpymod = gh2py.py_remote_modules  # A getter function for a named python module
    rpy = gh2py.connection  # Represents the remote instance root object
    scriptcontext.sticky["rpy"] = rpy
    # Add modules
    for mod in modules:
        try:
            scriptcontext.sticky[mod] = rpymod(mod)
            lkd_modules.add(mod)
        except ImportError:
            gh2py_manager.__exit__(*sys.exc_info())
            raise

elif not remote_python_status == "CLOSED":
    remote_python_status = "CLOSING"
    # Remove linked modules
    for mod in lkd_modules:
        del scriptcontext.sticky[mod]
    del scriptcontext.sticky["rpy"]
    gh2py_manager.__exit__(*sys.exc_info())
    lkd_modules = set()
    remote_python_status = "CLOSED"

# Change variable name because ghpython resets outputs to None before each run
linked_modules = lkd_modules

logger.info("GH to python connection is {}".format(remote_python_status))
# ---------- end ghpythonremote ----------
out = ClusterOutput(ghpythonremote.out)  # Console output.
linked_modules = ClusterOutput(ghpythonremote.linked_modules)  # Names of modules that were successfully added to the scriptcontext.sticky dictionary.
rpy = ClusterOutput(ghpythonremote.rpy)  # The object representing the remote python instance
python_2 = PythonScript(module_names=ghpythonremote.linked_modules)  # -> import_statements; inputs module_names: list
# ---------- python_2: Python ----------
import_statements = ["import scriptcontext as sc"]
for module_name in module_names:
    import_statements.append("{0} = sc.sticky['{0}']".format(module_name))

if len(module_names) == 0:
    import_statements = []
# ---------- end python_2 ----------
import_statements = ClusterOutput(python_2)  # Useful import statements to use the imported modules in your scripts.
