# Grasshopper definition booleans_003.gh (Grasshopper 1.0.7)
# plug-ins: Bifocals

geometry = Geometry([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])
pipe = Pipe(Curve=reparameterize(geometry), Radius=Slider(0.3, range=0..1), Caps=2)
dispatch = Dispatch(List=flatten(pipe), DispatchPattern=[True, False])  # -> ListA, ListB
geometry_2 = Geometry(dispatch.ListA)
# oneLiners_Basic
number_slider = Slider(2, range=0..5)
oneliner_squares = OneLiner_squares(x=number_slider, y=Slider(3, range=0..5))  # -> out, squares; inputs x: Int32, y: Int32
# ---------- oneliner_squares: Python ----------
__author__ = "Sculpture"
__version__ = "2021.05.23"

import rhinoscriptsyntax as rs

#before
squares = []
        
for i in range(10):
    squares.append(i**x) 
        
#after oneliner
print([i**y for i in range(10)])
# ---------- end oneliner_squares ----------
panel = Panel(oneliner_squares.out)
panel_2 = Panel(oneliner_squares.squares)
oneliner_datastructures = OneLiner_dataStructures(x=Slider(3, range=0..10), y=Slider(5, range=0..10))  # -> out, add, minus, times, divide, divideDown, modulus, negative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; inputs x: Int32, y: Int32
# ---------- oneliner_datastructures: Python ----------
__author__ = "Sculpture"
__version__ = "2021.05.23"

import rhinoscriptsyntax as rs

add = x + y
minus = x - y
times = x * y
divide = x / y
divideDown = x // y
modulus = x % y
negative = -x
castInt = int(3.9)
castFloat = float(x) #strange, works in output but not in castFloat output
print(x)
print(float(x))

exponent = x ** y
# ---------- end oneliner_datastructures ----------
panel_3 = Panel(oneliner_datastructures.negative)
panel_4 = Panel(oneliner_datastructures.castFloat)
panel_5 = Panel(oneliner_datastructures.out)
panel_6 = Panel(oneliner_datastructures.add)
panel_7 = Panel(oneliner_datastructures.times)
panel_8 = Panel(oneliner_datastructures.divideDown)
panel_9 = Panel(oneliner_datastructures.minus)
panel_10 = Panel(oneliner_datastructures.modulus)
panel_11 = Panel(oneliner_datastructures.castInt)
panel_12 = Panel(oneliner_datastructures.exponent)
panel_13 = Panel(oneliner_datastructures.divide)
number_slider_2 = Slider(5, range=0..10)
number_slider_3 = Slider(3, range=0..10)
oneliner_booleans_003 = OneLiner_booleans_003(x=Toggle(False), y=Toggle(True))  # -> out, a, b; inputs x: Boolean, y: Boolean
# ---------- oneliner_booleans_003: Python ----------
__author__ = "Sculpture"
__version__ = "2021.05.24"

import rhinoscriptsyntax as rs

#order of precedence not, and, or
a = x and not y
b = not x and y or x

# if condition evaluates to False
if None or 0 or 0.0 or '' or [] or {} or set():
    print("Dead Code") #Not Reached
else:
    print("yeah")
# ---------- end oneliner_booleans_003 ----------
oneliner_booleans_002 = OneLiner_booleans_002(x=number_slider_3, y=number_slider_2, c=Toggle(False), d=Toggle(False))  # -> out, a, b, e, f, g; inputs x: Int32, y: Int32, c: Boolean, d: Boolean
# ---------- oneliner_booleans_002: Python ----------
__author__ = "Sculpture"
__version__ = "2021.05.24"

import rhinoscriptsyntax as rs

a = x < y
b = x > y

#c, d = True, False

e = (c or d) == True
f = (c and d) == False
g = (not d) == True

print(e)
print(f)
print(g)
# ---------- end oneliner_booleans_002 ----------
oneliner_booleans = OneLiner_booleans(x=number_slider_3, y=number_slider_2)  # -> out, a, b, e, f, g; inputs x: Int32, y: Int32
# ---------- oneliner_booleans: Python ----------
__author__ = "Sculpture"
__version__ = "2021.05.24"

import rhinoscriptsyntax as rs

a = x < y
b = x > y

c, d = True, False

e = (c or d) == True
f = (c and d) == False
g = (not d) == True

print(e)
print(f)
print(g)
# ---------- end oneliner_booleans ----------
panel_14 = Panel(oneliner_booleans.out)
panel_15 = Panel([oneliner_booleans.a, oneliner_booleans.b])
panel_16 = Panel([oneliner_booleans.e, oneliner_booleans.f, oneliner_booleans.g])
panel_17 = Panel([oneliner_booleans_002.a, oneliner_booleans_002.b])
panel_18 = Panel(oneliner_booleans_002.out)
panel_19 = Panel([oneliner_booleans_002.e, oneliner_booleans_002.f, oneliner_booleans_002.g])
panel_20 = Panel(oneliner_booleans_003.out)
panel_21 = Panel(oneliner_booleans_003.a)
panel_22 = Panel(oneliner_booleans_003.b)
