# Grasshopper definition dataStructures_002.gh (Grasshopper 1.0.7)
# plug-ins: Bifocals

geometry = Geometry([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])
pipe = Pipe(Curve=reparameterize(geometry), Radius=Slider(0.3, range=0..1), Caps=2)
dispatch = Dispatch(List=flatten(pipe), DispatchPattern=[True, False])  # -> ListA, ListB
geometry_2 = Geometry(dispatch.ListA)
# oneLiners_Basic
number_slider = Slider(2, range=0..5)
oneliner_squares = OneLiner_squares(x=number_slider, y=Slider(3, range=0..5))  # -> out, squares; inputs x: Int32, y: Int32
# ---------- oneliner_squares: Python ----------
__author__ = "Sculpture"
__version__ = "2021.05.23"

import rhinoscriptsyntax as rs

#before
squares = []
        
for i in range(10):
    squares.append(i**x) 
        
#after oneliner
print([i**y for i in range(10)])
# ---------- end oneliner_squares ----------
oneliner_datastructures = OneLiner_dataStructures(x=Slider(3, range=0..10), y=Slider(5, range=0..10))  # -> out, add, minus, times, divide, divideDown, modulus, negative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; inputs x: Int32, y: Int32
# ---------- oneliner_datastructures: Python ----------
__author__ = "Sculpture"
__version__ = "2021.05.23"

import rhinoscriptsyntax as rs

add = x + y
minus = x - y
times = x * y
divide = x / y
divideDown = x // y
modulus = x % y
negative = -x
castInt = int(3.9)
castFloat = float(x) #strange, works in output but not in castFloat output
print(x)
print(float(x))

exponent = x ** y
# ---------- end oneliner_datastructures ----------
panel = Panel(oneliner_squares.out)
panel_2 = Panel(oneliner_squares.squares)
panel_3 = Panel(oneliner_datastructures.castFloat)
panel_4 = Panel(oneliner_datastructures.out)
panel_5 = Panel(oneliner_datastructures.add)
panel_6 = Panel(oneliner_datastructures.times)
panel_7 = Panel(oneliner_datastructures.divideDown)
panel_8 = Panel(oneliner_datastructures.negative)
panel_9 = Panel(oneliner_datastructures.minus)
panel_10 = Panel(oneliner_datastructures.modulus)
panel_11 = Panel(oneliner_datastructures.castInt)
panel_12 = Panel(oneliner_datastructures.divide)
panel_13 = Panel(oneliner_datastructures.exponent)
