# Grasshopper definition INTERMEDIATE_ADVANCED__NeuralNetworks_EXAMPLE_014.gh (Grasshopper 1.0.7)
# Copyright: © 2017-2018 Pierre Cuvilliers, Caitlin Mueller, Massachusetts Institute of Technology
# plug-ins: Bifocals, Fologram For Grasshopper Utilities

# ----
# Branch
# Managment
# Script
number_slider = Slider(7, range=0..10)
oneliners_intadvanced_branchmanagment_00 = OneLiners_intAdvanced_branchManagment_001(
    numPaths=Slider(5, range=0..10),
    startBranch=Slider(3, range=0..10),
    stopBranch=number_slider,
    stepBranch=Slider(3, range=0..10),
    numItems=Slider(6, range=0..10))  # -> out, nest, paths, a, b; inputs numPaths: Int32, startBranch: Int32, stopBranch: Int32, numItems: Int32
# ---------- oneliners_intadvanced_branchmanagment_00: Python ----------
##################################################
import random
import Grasshopper.Kernel.Data.GH_Path as ghpath
import Grasshopper.DataTree as datatree 
import System
import ghpythonlib.components as ghc
import rhinoscriptsyntax as rs
import Rhino.Geometry as rg
##################################################

nest = datatree[System.Object]() #the tree
paths = datatree[System.Object]()
for Alpha_path in range(numPaths): # numPaths Alpha paths
    for Beta_branch in range(random.randrange(startBranch,stopBranch,stepBranch)): #each gets random number of beta branchs
        paths.Add( (ghpath(Alpha_path,Beta_branch)),ghpath(Alpha_path))#add full_path name to Alph path
        for item in range(numItems):# each path has (numItems) numbers
            nest.Add(item, ghpath(Alpha_path,Beta_branch)) # assign number to given path

#how to call all Beta Branchs from Alpha path (zero) ??
for path in paths.Branch(0):
    print path
    print nest.Branch(ghpath(path))

a = nest
b = paths
# ---------- end oneliners_intadvanced_branchmanagment_00 ----------
panel = Panel(oneliners_intadvanced_branchmanagment_00.out)
panel_2 = Panel(oneliners_intadvanced_branchmanagment_00.paths)
viewer = ParamViewer(oneliners_intadvanced_branchmanagment_00.nest)

# ----
# GH Python Remote Node Setup
panel_3 = Panel("""numpy
scipy
numpy.linalg
matplotlib
matplotlib.pyplot
pandas
sklearn
sklearn.linear_model
sklearn.cluster
sklearn.neighbors
sklearn.neural_network""")
# ghPython oneLiners_Intermediate_Advanced
panel_4 = Panel("C:\Users\Sculpture\.conda\envs\rhinoremote")
gh_python_remote = GHPythonRemote(location=panel_4, run=Toggle(True), modules=panel_3)  # -> out, linked_modules, rpy, import_statements
panel_5 = Panel(gh_python_remote.linked_modules)
panel_6 = Panel(gh_python_remote.import_statements)

# ----
# 005
number_slider_2 = Slider(10, range=1..10)
number_slider_3 = Slider(10, range=1..10)
number_slider_4 = Slider(4, range=1..4)

# ----
# Neural Networks
# Analysis, EXAMPLE_2
range = Range(Domain=number_slider_3, Steps=number_slider_3)
range_2 = Range(Domain=number_slider_4, Steps=number_slider_3)
range_3 = Range(Domain=number_slider_4, Steps=number_slider_3)
range_4 = Range(Domain=Slider(8, range=1..8), Steps=number_slider_3)
range_5 = Range(Domain=Slider(10, range=1..10), Steps=number_slider_3)
range_6 = Range(Domain=Slider(30, range=1..30), Steps=number_slider_3)
jitter = Jitter(List=range, Jitter=1, Seed=number_slider_2)  # -> Values, Indices
jitter_2 = Jitter(List=range_2, Jitter=1, Seed=number_slider_2)  # -> Values, Indices
jitter_3 = Jitter(List=range_3, Jitter=1, Seed=number_slider_2)  # -> Values, Indices
jitter_4 = Jitter(List=range_4, Jitter=1, Seed=number_slider_2)  # -> Values, Indices
jitter_5 = Jitter(List=range_5, Jitter=1, Seed=number_slider_2)  # -> Values, Indices
jitter_6 = Jitter(List=range_6, Jitter=1, Seed=number_slider_2)  # -> Values, Indices
oneliners_neuralnetworkanalysis_013 = OneLiners_neuralNetworkAnalysis_013(
    input1=jitter.Values,
    input2=jitter_2.Values,
    input3=jitter_3.Values,
    input4=jitter_4.Values,
    input5=jitter_5.Values,
    output6=jitter_6.Values,
    sample1=jitter.Values,
    sample2=jitter_2.Values,
    sample3=jitter_3.Values,
    sample4=jitter_4.Values,
    sample5=jitter_5.Values)  # -> out, a; inputs input1: list of Int32, input2: list of Int32, input3: list of Int32, input4: list of Int32, input5: list of Int32, output6: list of Int32, sample1: Int32, sample3: Int32, sample4: Int32
# ---------- oneliners_neuralnetworkanalysis_013: Python ----------
__author__ = "Sculpture"
__version__ = "2021.05.30"

import rhinoscriptsyntax as rs

#import and do all this JAZZ!
import rhinoscriptsyntax as rs
import scriptcontext as sc
import ghpythonremote

np = sc.sticky['numpy']
scipy = sc.sticky['scipy']
mpl = sc.sticky['matplotlib']
plt = mpl.pyplot
rpy = sc.sticky['rpy']
pandas = sc.sticky['pandas']
skl = sc.sticky['sklearn'] #machine linput5ing models
linm = sc.sticky['sklearn.linear_model']
cluster = sc.sticky['sklearn.cluster']
nb = sc.sticky['sklearn.neighbors']
MLP = sc.sticky['sklearn.neural_network']

#data (size / cost)
X = np.array([  [input1[0], input2[0], input3[0], input4[0], input5[0], output6[0]],
                [input1[1], input2[1], input3[1], input4[1], input5[1], output6[1]],
                [input1[2], input2[2], input3[2], input4[2], input5[2], output6[2]],
                [input1[3], input2[3], input3[3], input4[3], input5[3], output6[3]],
                [input1[4], input2[4], input3[4], input4[4], input5[4], output6[4]],
                [input1[5], input2[5], input3[5], input4[5], input5[5], output6[5]],
                [input1[6], input2[6], input3[6], input4[6], input5[6], output6[6]],
                [input1[7], input2[7], input3[7], input4[7], input5[7], output6[7]],
                [input1[8], input2[8], input3[8], input4[8], input5[8], output6[8]],
                [input1[9], input2[9], input3[9], input4[9], input5[9], output6[9]]])

#oneLiner
neural_net = MLP.MLPRegressor(max_iter=10000).fit(X[:,:-1], X[:,-1])

#result
res = neural_net.predict([[sample1,sample2,sample3,sample4,sample5]])
print(res)[0]
# ---------- end oneliners_neuralnetworkanalysis_013 ----------
panel_7 = Panel(oneliners_neuralnetworkanalysis_013.out)

# ---- group: All that JAZZ
# MACHINE LEARNING:
#  scikit-learn
# Base Script
# Jazz
ghpython_script = GhPythonScript()  # -> out, a
# ---------- ghpython_script: Python ----------
__author__ = "Sculpture"
__version__ = "2021.05.30"

import rhinoscriptsyntax as rs

#import and do all this JAZZ!
import rhinoscriptsyntax as rs
import scriptcontext as sc
import ghpythonremote

np = sc.sticky['numpy']
scipy = sc.sticky['scipy']
mpl = sc.sticky['matplotlib']
plt = mpl.pyplot
rpy = sc.sticky['rpy']
pandas = sc.sticky['pandas']
skl = sc.sticky['sklearn']
linm = sc.sticky['sklearn.linear_model']

"""
EXAMPLE with LinearRegression() function
#data (Apple stock prices)
apple = np.array([155, 156, 157])
n = len(apple)
#oneLiner
model = linm.LinearRegression().fit(np.arange(n).reshape((n,1)), apple)
#result
print(model.predict([[3],[4]]))
"""
# ---------- end ghpython_script ----------

# ----
number = Number(flatten(oneliners_neuralnetworkanalysis_013.out))
unit_x = UnitX(Factor=number)
quad_sphere = QuadSphere(Base=PlaneXY(0, 0, 0), Radius=number_slider_3)
move = Move(Geometry=quad_sphere, Motion=unit_x)  # -> Geometry, Transform
xz_plane = XZPlane(Origin=Point(0, 0, 0))
yz_plane = YZPlane(Origin=Point(0, 0, 0))
xy_plane = XYPlane(Origin=Point(0, 0, 0))
list_length = ListLength(List=number)  # -> flatten(Length)
polar_array = PolarArray(Geometry=move.Geometry, Plane=xy_plane, Count=list_length, Angle=degrees(number))  # -> Geometry, Transform
md_slider = MDSlider(SliderMode=0, slider_value=Point(0.5, 0.5, 0.5), x_domain=Domain(0, 1), y_domain=Domain(0, 1), z_domain=Domain(0, 1))
deconstruct_brep = DeconstructBrep(Brep=polar_array.Geometry)  # -> Faces, Edges, Vertices
list_item = ListItem(List=deconstruct_brep.Faces, Index=Slider(0, range=0..5), Wrap=True)
evaluate_surface = EvaluateSurface(Surface=reparameterize(list_item), Point=md_slider)  # -> Point, Normal, UDirection, VDirection, Frame
amplitude = Amplitude(Vector=evaluate_surface.Normal, Amplitude=Slider(1, range=1..3))
extrude = Extrude(Base=list_item, Direction=amplitude)  # -> flatten(Extrusion); disabled
mesh_pipe = MeshPipe(Polylines=list_item, NumberOfSides=4, Tolerance=0.1, Radius=Slider(0.1, range=0..0.1), Cap=False, Join=False)

# ==== cluster GHPythonRemote: Connects the Grasshopper Python component to an external Python instance.
python = PythonScript()  # -> gh_parent_doc_dir
# ---------- python: Python ----------
from os import path

gh_parent_doc_dir = path.abspath(path.dirname(ghenv.Component.OnPingDocument().Owner.OnPingDocument().FilePath))
# ---------- end python ----------
# GH to python remote example.
# Pierre Cuvilliers, 2017-2018
# Released under the MIT license
# github.com/pilcru/ghpythonremote
# Runs and connects to an external python engine, and
# assigns imported modules to scriptcontext.sticky variables.
# 
# Arguments:
#       code (str): Path to the GH_to_python_sticky.py code file.
#       location (str): Path to a python executable, or to a folder
#             containing `python.exe`, or the name of a conda-created
#             virtual environment prefixed by `conda://` (`conda://env_name`).
#             If empty, finds python from your windows %PATH%.
#       run (boolean): Creates the connection, and imports new
#             modules, when turned to True. Kills the connection,
#             and deletes the references to the imports, when turned
#             to False.
#       modules (str list): List of module names to import in the
#             remote python. They will be added to the
#             scriptcontext.sticky dictionary, allowing them to be
#             reused from other python components in the same
#             Grasshopper document. Submodules (for example
#             `numpy.linalg` have to be added explicitly to this list
#             to be available later.
#       log_level (str from ['NOTSET', 'DEBUG', 'INFO', 'WARNING', 'ERROR', 'CRITICAL']):
#             Logging level to use for the local IronPython and the
#             remote python instance.
#       working_dir (str): Working directory for the remote python
#             instance.
# 
# Returns:
#       out (str): Console output with DEBUG information.
#       linked_modules (str list): list of imported module names.
#       rpy (rpyc connection object): The object representing the
#             remote Python interpreter.
location = ClusterInput()  # location (str): Path to a python executable, or to a folder containing `python.exe`, or the name of a conda-created virtual environment prefixed by `conda://` (`conda://env_name`). If empty, finds python from your windows %PATH%.
run = ClusterInput()  # run (boolean): Creates the connection, and imports new modules, when turned to True. Kills the connection,and deletes the references to the imports, when turned to False.
modules = ClusterInput()  # modules (str list): List of module names to import in the remote python. They will be added to the scriptcontext.sticky dictionary, allowing them to be reused from other python components in the same Grasshopper document. Submodules (for example `numpy.linalg` have to be added explicitly to this list to be available later.
list = ValueList({"CRITICAL", "ERROR", "WARNING", "INFO", "DEBUG", "NOTSET"}, selected="DEBUG")
panel = Panel(python)
ghpythonremote = GHPythonRemote(location=location, run=run, modules=modules, log_level=list, working_dir=panel)  # -> out, linked_modules, rpy; inputs run: Boolean, modules: list
# ---------- ghpythonremote: Python ----------
import inspect
import logging
from os import path
import sys
from time import sleep

import scriptcontext

import ghpythonremote
from ghpythonremote.connectors import GrasshopperToPythonRemote

local_log_level = getattr(logging, log_level, logging.WARNING)
logger = logging.getLogger("ghpythonremote")
logger.setLevel(local_log_level)
ch = logging.StreamHandler()
ch.setLevel(local_log_level)
formatter = logging.Formatter("%(levelname)s: %(name)s:\n%(message)s")
ch.setFormatter(formatter)
logger.handlers = []
logger.addHandler(ch)
logger = logging.getLogger("ghpythonremote.GH_to_python")

ROOT = path.abspath(path.dirname(inspect.getfile(ghpythonremote)))
rpyc_server_py = path.join(ROOT, "pythonservice.py")

# Set connection to CLOSED if this is the first run
# and initialize set of linked modules
try:
    remote_python_status
except NameError:
    remote_python_status = "CLOSED"
    lkd_modules = set()

# Wait for connection to connect or terminate
timer = 0
while remote_python_status == "CONNECTING" or remote_python_status == "CLOSING":
    sleep(1)
    timer += 1
    if timer == 10:
        try:
            gh2py_manager.__exit__(*sys.exc_info())
        except Exception:
            pass
        remote_python_status = "CLOSED"
        lkd_modules = set()
        raise RuntimeError(
            "Connection left in an inconsistent state and not returning. Reset "
            "everything."
        )

if run:
    if not remote_python_status == "OPEN":
        remote_python_status = "CONNECTING"
        gh2py_manager = GrasshopperToPythonRemote(
            rpyc_server_py,
            location=location,
            timeout=10,
            port=None,
            log_level=log_level,
            working_dir=working_dir,
        )
        gh2py = gh2py_manager.__enter__()
        remote_python_status = "OPEN"

    # Stuff that we can reach
    rpymod = gh2py.py_remote_modules  # A getter function for a named python module
    rpy = gh2py.connection  # Represents the remote instance root object
    scriptcontext.sticky["rpy"] = rpy
    # Add modules
    for mod in modules:
        try:
            scriptcontext.sticky[mod] = rpymod(mod)
            lkd_modules.add(mod)
        except ImportError:
            gh2py_manager.__exit__(*sys.exc_info())
            raise

elif not remote_python_status == "CLOSED":
    remote_python_status = "CLOSING"
    # Remove linked modules
    for mod in lkd_modules:
        del scriptcontext.sticky[mod]
    del scriptcontext.sticky["rpy"]
    gh2py_manager.__exit__(*sys.exc_info())
    lkd_modules = set()
    remote_python_status = "CLOSED"

# Change variable name because ghpython resets outputs to None before each run
linked_modules = lkd_modules

logger.info("GH to python connection is {}".format(remote_python_status))
# ---------- end ghpythonremote ----------
out = ClusterOutput(ghpythonremote.out)  # Console output.
linked_modules = ClusterOutput(ghpythonremote.linked_modules)  # Names of modules that were successfully added to the scriptcontext.sticky dictionary.
rpy = ClusterOutput(ghpythonremote.rpy)  # The object representing the remote python instance
python_2 = PythonScript(module_names=ghpythonremote.linked_modules)  # -> import_statements; inputs module_names: list
# ---------- python_2: Python ----------
import_statements = ["import scriptcontext as sc"]
for module_name in module_names:
    import_statements.append("{0} = sc.sticky['{0}']".format(module_name))

if len(module_names) == 0:
    import_statements = []
# ---------- end python_2 ----------
import_statements = ClusterOutput(python_2)  # Useful import statements to use the imported modules in your scripts.
