# Grasshopper definition INTERMEDIATE_ADVANCED__branchManagment_001.gh (Grasshopper 1.0.7)
# Copyright: © 2017-2018 Pierre Cuvilliers, Caitlin Mueller, Massachusetts Institute of Technology
# plug-ins: Bifocals

# ----
# Branch Managment Script
number_slider = Slider(3, range=0..10)
oneliners_intadvanced_branchmanagment_00 = OneLiners_intAdvanced_branchManagment_001(
    numPaths=number_slider,
    startBranch=Slider(1, range=0..10),
    stopBranch=Slider(5, range=0..10),
    stepBranch=Slider(1, range=0..10),
    numItems=Slider(6, range=0..10))  # -> out, nest, paths; inputs numPaths: Int32, startBranch: Int32, stopBranch: Int32, numItems: Int32
# ---------- oneliners_intadvanced_branchmanagment_00: Python ----------
##################################################
import random
import Grasshopper.Kernel.Data.GH_Path as ghpath
import Grasshopper.DataTree as datatree 
import System
import ghpythonlib.components as ghc
import rhinoscriptsyntax as rs
import Rhino.Geometry as rg
##################################################

nest = datatree[System.Object]() #the tree
paths = datatree[System.Object]()
for Alpha_path in range(numPaths): # 3 Alpha paths
    for Beta_branch in range(random.randrange(startBranch,stopBranch,stepBranch)): #each gets random number of beta branchs
        paths.Add( (ghpath(Alpha_path,Beta_branch)),ghpath(Alpha_path))#ad full_path name to Alph path
        for item in range(numItems):# each path has (numItems) numbers
            nest.Add(item, ghpath(Alpha_path,Beta_branch)) # assign number to given path

#how to call all Beta Branchs from Alpha path (zero) ??
for path in paths.Branch(0):
    print path
    print nest.Branch(ghpath(path))

a = nest
b = paths
# ---------- end oneliners_intadvanced_branchmanagment_00 ----------
panel = Panel(oneliners_intadvanced_branchmanagment_00.paths)
panel_2 = Panel(oneliners_intadvanced_branchmanagment_00.out)
# oneLiners_Intermediate_Advanced
viewer = ParamViewer(oneliners_intadvanced_branchmanagment_00.nest)

# ----
# GH Python Remote Node Setup
panel_3 = Panel("""numpy
scipy
numpy.linalg
matplotlib
matplotlib.pyplot
pandas
sklearn
sklearn.linear_model""")
# GH Python Remote
# Node Setup
panel_4 = Panel("C:\Users\Sculpture\.conda\envs\rhinoremote")
gh_python_remote = GHPythonRemote(location=panel_4, run=Toggle(True), modules=panel_3)  # -> out, linked_modules, rpy, import_statements
panel_5 = Panel(gh_python_remote.import_statements)
panel_6 = Panel(gh_python_remote.linked_modules)

number_slider_2 = Slider(100, range=-100..100)
# MACHINE LEARNING:
#  scikit-learn
ghpython_script = GhPythonScript()  # -> out, a
# ---------- ghpython_script: Python ----------
__author__ = "Sculpture"
__version__ = "2021.05.30"

import rhinoscriptsyntax as rs

#import and do all this JAZZ!
import rhinoscriptsyntax as rs
import scriptcontext as sc
import ghpythonremote

np = sc.sticky['numpy']
scipy = sc.sticky['scipy']
mpl = sc.sticky['matplotlib']
plt = mpl.pyplot
rpy = sc.sticky['rpy']
pandas = sc.sticky['pandas']
skl = sc.sticky['sklearn']
linm = sc.sticky['sklearn.linear_model']

#data (Apple stock prices)
apple = np.array([155, 156, 157])
n = len(apple)

#oneLiner
model = linm.LinearRegression().fit(np.arange(n).reshape((n,1)), apple)

#result
print(model.predict([[3],[4]]))
#print(type(model.predict([[3],[4]])))
# ---------- end ghpython_script ----------

# ---- group: All that JAZZ
# Base Script Jazz
ghpython_script_2 = GhPythonScript()  # -> out, a
# ---------- ghpython_script_2: Python ----------
__author__ = "Sculpture"
__version__ = "2021.05.30"

import rhinoscriptsyntax as rs

#import and do all this JAZZ!
import rhinoscriptsyntax as rs
import scriptcontext as sc
import ghpythonremote

np = sc.sticky['numpy']
scipy = sc.sticky['scipy']
mpl = sc.sticky['matplotlib']
plt = mpl.pyplot
rpy = sc.sticky['rpy']
pandas = sc.sticky['pandas']
skl = sc.sticky['sklearn']
linm = sc.sticky['sklearn.linear_model']

"""
EXAMPLE with LinearRegression() function
#data (Apple stock prices)
apple = np.array([155, 156, 157])
n = len(apple)
#oneLiner
model = linm.LinearRegression().fit(np.arange(n).reshape((n,1)), apple)
#result
print(model.predict([[3],[4]]))
"""
# ---------- end ghpython_script_2 ----------

# ----
negative = Negative(Value=number_slider_2)
panel_7 = Panel(ghpython_script.out)
ghpython_script_3 = GhPythonScript(apple=ghpython_script.out, x=number_slider_2, y=negative)  # -> out, a
# ---------- ghpython_script_3: Python ----------
__author__ = "Sculpture"
__version__ = "2021.05.30"

import rhinoscriptsyntax as rs

#import and do all this JAZZ!
import rhinoscriptsyntax as rs
import scriptcontext as sc
import ghpythonremote

np = sc.sticky['numpy']
scipy = sc.sticky['scipy']
mpl = sc.sticky['matplotlib']
plt = mpl.pyplot
rpy = sc.sticky['rpy']
pandas = sc.sticky['pandas']
skl = sc.sticky['sklearn']
linm = sc.sticky['sklearn.linear_model']

#data (Apple stock prices)
apple = np.array([155, 156, 157])
n = len(apple)

#oneLiner
model = linm.LinearRegression().fit(np.arange(n).reshape((n, 1)), apple)

#result
print(model.predict([[x],[y]]))
print(type(model.predict([[x],[y]])))

#access data
print(model.predict([[x],[y]]))[0]
print(model.predict([[x],[y]]))[1]
print(type((model.predict([[x],[y]]))[0]))
print(type((model.predict([[x],[y]]))[1]))

#try something like this
"""
someList = x.Branch(1)    #List[Object]
pythonList = list(someList)

or 

something like this...

import Rhino
#import grasshopper classes
import clr
clr.AddReference("Grasshopper")
from Grasshopper.Kernel.Data import GH_Path
from Grasshopper import DataTree

newlist = {}
newlist = x[:][:]
print newlist
print newlist[:][:]
A = newlist[:][:]

or 

a = []

for path in x.Paths:

    one_list = x.Branch(path)
    print(path)

    first_item = one_list[0]

    a.append(first_item)
"""
# ---------- end ghpython_script_3 ----------
panel_8 = Panel(ghpython_script_3.out)

# ----
# use data
panel_9 = Panel("2")
list_item = ListItem(List=ghpython_script_3.out, Index=panel_9, Wrap=True)  # -> Item, Item1, Item2
circle = Circle(Plane=PlaneXY(0, 0, 0), Radius=[list_item.Item, list_item.Item1])
panel_10 = Panel([list_item.Item, list_item.Item1])

# ==== cluster GHPythonRemote: Connects the Grasshopper Python component to an external Python instance.
python = PythonScript()  # -> gh_parent_doc_dir
# ---------- python: Python ----------
from os import path

gh_parent_doc_dir = path.abspath(path.dirname(ghenv.Component.OnPingDocument().Owner.OnPingDocument().FilePath))
# ---------- end python ----------
# GH to python remote example.
# Pierre Cuvilliers, 2017-2018
# Released under the MIT license
# github.com/pilcru/ghpythonremote
# Runs and connects to an external python engine, and
# assigns imported modules to scriptcontext.sticky variables.
# 
# Arguments:
#       code (str): Path to the GH_to_python_sticky.py code file.
#       location (str): Path to a python executable, or to a folder
#             containing `python.exe`, or the name of a conda-created
#             virtual environment prefixed by `conda://` (`conda://env_name`).
#             If empty, finds python from your windows %PATH%.
#       run (boolean): Creates the connection, and imports new
#             modules, when turned to True. Kills the connection,
#             and deletes the references to the imports, when turned
#             to False.
#       modules (str list): List of module names to import in the
#             remote python. They will be added to the
#             scriptcontext.sticky dictionary, allowing them to be
#             reused from other python components in the same
#             Grasshopper document. Submodules (for example
#             `numpy.linalg` have to be added explicitly to this list
#             to be available later.
#       log_level (str from ['NOTSET', 'DEBUG', 'INFO', 'WARNING', 'ERROR', 'CRITICAL']):
#             Logging level to use for the local IronPython and the
#             remote python instance.
#       working_dir (str): Working directory for the remote python
#             instance.
# 
# Returns:
#       out (str): Console output with DEBUG information.
#       linked_modules (str list): list of imported module names.
#       rpy (rpyc connection object): The object representing the
#             remote Python interpreter.
location = ClusterInput()  # location (str): Path to a python executable, or to a folder containing `python.exe`, or the name of a conda-created virtual environment prefixed by `conda://` (`conda://env_name`). If empty, finds python from your windows %PATH%.
run = ClusterInput()  # run (boolean): Creates the connection, and imports new modules, when turned to True. Kills the connection,and deletes the references to the imports, when turned to False.
modules = ClusterInput()  # modules (str list): List of module names to import in the remote python. They will be added to the scriptcontext.sticky dictionary, allowing them to be reused from other python components in the same Grasshopper document. Submodules (for example `numpy.linalg` have to be added explicitly to this list to be available later.
list = ValueList({"CRITICAL", "ERROR", "WARNING", "INFO", "DEBUG", "NOTSET"}, selected="DEBUG")
panel = Panel(python)
ghpythonremote = GHPythonRemote(location=location, run=run, modules=modules, log_level=list, working_dir=panel)  # -> out, linked_modules, rpy; inputs run: Boolean, modules: list
# ---------- ghpythonremote: Python ----------
import inspect
import logging
from os import path
import sys
from time import sleep

import scriptcontext

import ghpythonremote
from ghpythonremote.connectors import GrasshopperToPythonRemote

local_log_level = getattr(logging, log_level, logging.WARNING)
logger = logging.getLogger("ghpythonremote")
logger.setLevel(local_log_level)
ch = logging.StreamHandler()
ch.setLevel(local_log_level)
formatter = logging.Formatter("%(levelname)s: %(name)s:\n%(message)s")
ch.setFormatter(formatter)
logger.handlers = []
logger.addHandler(ch)
logger = logging.getLogger("ghpythonremote.GH_to_python")

ROOT = path.abspath(path.dirname(inspect.getfile(ghpythonremote)))
rpyc_server_py = path.join(ROOT, "pythonservice.py")

# Set connection to CLOSED if this is the first run
# and initialize set of linked modules
try:
    remote_python_status
except NameError:
    remote_python_status = "CLOSED"
    lkd_modules = set()

# Wait for connection to connect or terminate
timer = 0
while remote_python_status == "CONNECTING" or remote_python_status == "CLOSING":
    sleep(1)
    timer += 1
    if timer == 10:
        try:
            gh2py_manager.__exit__(*sys.exc_info())
        except Exception:
            pass
        remote_python_status = "CLOSED"
        lkd_modules = set()
        raise RuntimeError(
            "Connection left in an inconsistent state and not returning. Reset "
            "everything."
        )

if run:
    if not remote_python_status == "OPEN":
        remote_python_status = "CONNECTING"
        gh2py_manager = GrasshopperToPythonRemote(
            rpyc_server_py,
            location=location,
            timeout=10,
            port=None,
            log_level=log_level,
            working_dir=working_dir,
        )
        gh2py = gh2py_manager.__enter__()
        remote_python_status = "OPEN"

    # Stuff that we can reach
    rpymod = gh2py.py_remote_modules  # A getter function for a named python module
    rpy = gh2py.connection  # Represents the remote instance root object
    scriptcontext.sticky["rpy"] = rpy
    # Add modules
    for mod in modules:
        try:
            scriptcontext.sticky[mod] = rpymod(mod)
            lkd_modules.add(mod)
        except ImportError:
            gh2py_manager.__exit__(*sys.exc_info())
            raise

elif not remote_python_status == "CLOSED":
    remote_python_status = "CLOSING"
    # Remove linked modules
    for mod in lkd_modules:
        del scriptcontext.sticky[mod]
    del scriptcontext.sticky["rpy"]
    gh2py_manager.__exit__(*sys.exc_info())
    lkd_modules = set()
    remote_python_status = "CLOSED"

# Change variable name because ghpython resets outputs to None before each run
linked_modules = lkd_modules

logger.info("GH to python connection is {}".format(remote_python_status))
# ---------- end ghpythonremote ----------
out = ClusterOutput(ghpythonremote.out)  # Console output.
linked_modules = ClusterOutput(ghpythonremote.linked_modules)  # Names of modules that were successfully added to the scriptcontext.sticky dictionary.
rpy = ClusterOutput(ghpythonremote.rpy)  # The object representing the remote python instance
python_2 = PythonScript(module_names=ghpythonremote.linked_modules)  # -> import_statements; inputs module_names: list
# ---------- python_2: Python ----------
import_statements = ["import scriptcontext as sc"]
for module_name in module_names:
    import_statements.append("{0} = sc.sticky['{0}']".format(module_name))

if len(module_names) == 0:
    import_statements = []
# ---------- end python_2 ----------
import_statements = ClusterOutput(python_2)  # Useful import statements to use the imported modules in your scripts.
