# Grasshopper definition INTERMEDIATE_ADVANCED__decision-TreeLearning_EXAMPLE_016.gh (Grasshopper 1.0.7)
# Copyright: © 2017-2018 Pierre Cuvilliers, Caitlin Mueller, Massachusetts Institute of Technology
# plug-ins: Bifocals, Fologram For Grasshopper Utilities, Kangaroo2 Components

# ----
# Branch
# Managment
# Script
number_slider = Slider(5, range=0..10)  # disabled
number_slider_2 = Slider(3, range=0..10)  # disabled
number_slider_3 = Slider(7, range=0..10)  # disabled
number_slider_4 = Slider(3, range=0..10)  # disabled
number_slider_5 = Slider(6, range=0..10)  # disabled
oneliners_intadvanced_branchmanagment_00 = OneLiners_intAdvanced_branchManagment_001(
    numPaths=number_slider,
    startBranch=number_slider_2,
    stopBranch=number_slider_3,
    stepBranch=number_slider_4,
    numItems=number_slider_5)  # -> out, nest, paths, a, b; inputs numPaths: Int32, startBranch: Int32, stopBranch: Int32, numItems: Int32; disabled
# ---------- oneliners_intadvanced_branchmanagment_00: Python ----------
##################################################
import random
import Grasshopper.Kernel.Data.GH_Path as ghpath
import Grasshopper.DataTree as datatree 
import System
import ghpythonlib.components as ghc
import rhinoscriptsyntax as rs
import Rhino.Geometry as rg
##################################################

nest = datatree[System.Object]() #the tree
paths = datatree[System.Object]()
for Alpha_path in range(numPaths): # numPaths Alpha paths
    for Beta_branch in range(random.randrange(startBranch,stopBranch,stepBranch)): #each gets random number of beta branchs
        paths.Add( (ghpath(Alpha_path,Beta_branch)),ghpath(Alpha_path))#add full_path name to Alph path
        for item in range(numItems):# each path has (numItems) numbers
            nest.Add(item, ghpath(Alpha_path,Beta_branch)) # assign number to given path

#how to call all Beta Branchs from Alpha path (zero) ??
for path in paths.Branch(0):
    print path
    print nest.Branch(ghpath(path))

a = nest
b = paths
# ---------- end oneliners_intadvanced_branchmanagment_00 ----------
panel = Panel(oneliners_intadvanced_branchmanagment_00.out)  # disabled
panel_2 = Panel(oneliners_intadvanced_branchmanagment_00.paths)  # disabled
viewer = ParamViewer(oneliners_intadvanced_branchmanagment_00.nest)  # disabled

# ----
# GH Python Remote Node Setup
panel_3 = Panel("""numpy
scipy
numpy.linalg
matplotlib
matplotlib.pyplot
pandas
sklearn
sklearn.linear_model
sklearn.cluster
sklearn.neighbors
sklearn.neural_network
sklearn.tree""")
# ghPython oneLiners_Intermediate_Advanced
panel_4 = Panel("C:\Users\Sculpture\.conda\envs\rhinoremote")
gh_python_remote = GHPythonRemote(location=panel_4, run=Toggle(True), modules=panel_3)  # -> out, linked_modules, rpy, import_statements
panel_5 = Panel(gh_python_remote.import_statements)
panel_6 = Panel(gh_python_remote.linked_modules)

# ----
# 005
number_slider_6 = Slider(10, range=1..10)  # disabled
number_slider_7 = Slider(10, range=1..10)  # disabled
number_slider_8 = Slider(4, range=1..4)  # disabled
number_slider_9 = Slider(8, range=1..8)  # disabled
number_slider_10 = Slider(10, range=1..10)  # disabled
# 006
number_slider_11 = Slider(30, range=1..30)  # disabled

# ---- group: sample_0
number_slider_12 = Slider(10, range=0..10)
number_slider_13 = Slider(5, range=0..10)
number_slider_14 = Slider(2, range=0..10)

# ---- group: art
# Decision-Tree Learning
number_slider_15 = Slider(10, range=0..10)
number_slider_16 = Slider(6, range=0..10)
number_slider_17 = Slider(2, range=0..10)

# ---- group: des
number_slider_18 = Slider(5, range=0..10)
number_slider_19 = Slider(10, range=0..10)
number_slider_20 = Slider(0, range=0..10)

# ---- group: eng
number_slider_21 = Slider(10, range=0..10)
number_slider_22 = Slider(0, range=0..10)
number_slider_23 = Slider(6, range=0..10)

# ---- group: sample_1
number_slider_24 = Slider(1, range=0..10)
number_slider_25 = Slider(9, range=0..10)
# Decision-Tree Learning
# Notes:
# These are human-readable
# Great for communicating with non-ML peons
# The Basics:
# Opens new breanches and make desicions
# in a flowchart kind of way
# Good for classification problems
# You finally reach a leaf node of the tree
# a node with no children
# This is the recommended class based
# on your feature selection
# First question carries the most weight
# These is a pruning process
number_slider_26 = Slider(10, range=0..10)

# ----
# Neural Networks
# Analysis, EXAMPLE_2
range = Range(Domain=number_slider_7, Steps=number_slider_7)  # disabled
range_2 = Range(Domain=number_slider_8, Steps=number_slider_7)  # disabled
range_3 = Range(Domain=number_slider_8, Steps=number_slider_7)  # disabled
range_4 = Range(Domain=number_slider_9, Steps=number_slider_7)  # disabled
range_5 = Range(Domain=number_slider_10, Steps=number_slider_7)  # disabled
range_6 = Range(Domain=number_slider_11, Steps=number_slider_7)  # disabled
jitter = Jitter(List=range, Jitter=1, Seed=number_slider_6)  # -> Values, Indices; disabled
jitter_2 = Jitter(List=range_2, Jitter=1, Seed=number_slider_6)  # -> Values, Indices; disabled
jitter_3 = Jitter(List=range_3, Jitter=1, Seed=number_slider_6)  # -> Values, Indices; disabled
jitter_4 = Jitter(List=range_4, Jitter=1, Seed=number_slider_6)  # -> Values, Indices; disabled
jitter_5 = Jitter(List=range_5, Jitter=1, Seed=number_slider_6)  # -> Values, Indices; disabled
jitter_6 = Jitter(List=range_6, Jitter=1, Seed=number_slider_6)  # -> Values, Indices; disabled
oneliners_neuralnetworkanalysis_013 = OneLiners_neuralNetworkAnalysis_013(
    input1=jitter.Values,
    input2=jitter_2.Values,
    input3=jitter_3.Values,
    input4=jitter_4.Values,
    input5=jitter_5.Values,
    output6=jitter_6.Values,
    sample1=jitter.Values,
    sample2=jitter_2.Values,
    sample3=jitter_3.Values,
    sample4=jitter_4.Values,
    sample5=jitter_5.Values)  # -> out, a; inputs input1: list of Int32, input2: list of Int32, input3: list of Int32, input4: list of Int32, input5: list of Int32, output6: list of Int32, sample1: Int32, sample3: Int32, sample4: Int32; disabled
# ---------- oneliners_neuralnetworkanalysis_013: Python ----------
__author__ = "Sculpture"
__version__ = "2021.05.30"

import rhinoscriptsyntax as rs

#import and do all this JAZZ!
import rhinoscriptsyntax as rs
import scriptcontext as sc
import ghpythonremote

np = sc.sticky['numpy']
scipy = sc.sticky['scipy']
mpl = sc.sticky['matplotlib']
plt = mpl.pyplot
rpy = sc.sticky['rpy']
pandas = sc.sticky['pandas']
skl = sc.sticky['sklearn'] #machine linput5ing models
linm = sc.sticky['sklearn.linear_model']
cluster = sc.sticky['sklearn.cluster']
nb = sc.sticky['sklearn.neighbors']
MLP = sc.sticky['sklearn.neural_network']

#data (size / cost)
X = np.array([  [input1[0], input2[0], input3[0], input4[0], input5[0], output6[0]],
                [input1[1], input2[1], input3[1], input4[1], input5[1], output6[1]],
                [input1[2], input2[2], input3[2], input4[2], input5[2], output6[2]],
                [input1[3], input2[3], input3[3], input4[3], input5[3], output6[3]],
                [input1[4], input2[4], input3[4], input4[4], input5[4], output6[4]],
                [input1[5], input2[5], input3[5], input4[5], input5[5], output6[5]],
                [input1[6], input2[6], input3[6], input4[6], input5[6], output6[6]],
                [input1[7], input2[7], input3[7], input4[7], input5[7], output6[7]],
                [input1[8], input2[8], input3[8], input4[8], input5[8], output6[8]],
                [input1[9], input2[9], input3[9], input4[9], input5[9], output6[9]]])

#oneLiner
neural_net = MLP.MLPRegressor(max_iter=10000).fit(X[:,:-1], X[:,-1])

#result
res = neural_net.predict([[sample1,sample2,sample3,sample4,sample5]])
print(res)[0]
# ---------- end oneliners_neuralnetworkanalysis_013 ----------
panel_7 = Panel(oneliners_neuralnetworkanalysis_013.out)  # disabled

oneliners_decision_tree_015 = OneLiners_decisionTree_015(
    artA=number_slider_15,
    artB=number_slider_16,
    artC=number_slider_17,
    desA=number_slider_18,
    desB=number_slider_19,
    desC=number_slider_20,
    engA=number_slider_22,
    engB=number_slider_23,
    engC=number_slider_21,
    sample0A=number_slider_12,
    sample0B=number_slider_13,
    sample0C=number_slider_14,
    sample1A=number_slider_24,
    sample1B=number_slider_25,
    sample1C=number_slider_26)  # -> out, a; inputs artA: Int32, artB: Int32, artC: Int32, desA: Int32, desB: Int32, desC: Int32, engA: Int32, engB: Int32, engC: Int32, sample0A: Int32, sample0B: Int32, sample0C: Int32, sample1A: Int32, sample1B: Int32, sample1C: Int32
# ---------- oneliners_decision_tree_015: Python ----------
__author__ = "Sculpture"
__version__ = "2021.05.30"

import rhinoscriptsyntax as rs

#import and do all this JAZZ!
import rhinoscriptsyntax as rs
import scriptcontext as sc
import ghpythonremote

np = sc.sticky['numpy']
scipy = sc.sticky['scipy']
mpl = sc.sticky['matplotlib']
plt = mpl.pyplot
rpy = sc.sticky['rpy']
pandas = sc.sticky['pandas']
skl = sc.sticky['sklearn'] #machine linput5ing models
linm = sc.sticky['sklearn.linear_model']
cluster = sc.sticky['sklearn.cluster']
nb = sc.sticky['sklearn.neighbors']
MLP = sc.sticky['sklearn.neural_network']
TREE = sc.sticky['sklearn.tree']

"""
#data (size / cost)
X = np.array([  [input1[0], input2[0], input3[0], input4[0], input5[0], output6[0]],
                [input1[1], input2[1], input3[1], input4[1], input5[1], output6[1]],
                [input1[2], input2[2], input3[2], input4[2], input5[2], output6[2]],
                [input1[3], input2[3], input3[3], input4[3], input5[3], output6[3]],
                [input1[4], input2[4], input3[4], input4[4], input5[4], output6[4]],
                [input1[5], input2[5], input3[5], input4[5], input5[5], output6[5]],
                [input1[6], input2[6], input3[6], input4[6], input5[6], output6[6]],
                [input1[7], input2[7], input3[7], input4[7], input5[7], output6[7]],
                [input1[8], input2[8], input3[8], input4[8], input5[8], output6[8]],
                [input1[9], input2[9], input3[9], input4[9], input5[9], output6[9]]])

#oneLiner
neural_net = MLP.MLPRegressor(max_iter=10000).fit(X[:,:-1], X[:,-1])

#result
res = neural_net.predict([[sample1,sample2,sample3,sample4,sample5]])
print(res)[0]"""

#data: points in (art, design, engineering) - study field
X = np.array([  [artA, artB, artC, "art"],
                [desA, desB, desC, "design"],
                [engA, engB, engC, "engineering"]])

#oneLiner
Tree = TREE.tree.DecisionTreeClassifier().fit(X[:,:-1], X[:,-1])

#result and puzzle
researcher_0 = Tree.predict([[sample0A, sample0B, sample0C]])
print(researcher_0)[0]

researcher_1 = Tree.predict([[sample1A, sample1B, sample1C]])
print(researcher_1)[0]
# ---------- end oneliners_decision_tree_015 ----------

# ----
# The Code:
# How it works:
# The data describes some models
# The oneLiner creates a new decision-tree object
# and trains the model by using
# fit() function on the last column
# It has learned a featured pattern (high, med, low)
# The algorithm is nondeterministic
# This means different results might occur
# It is a bit random
# In summary, DT are an intuitive
# way of creating human-readable ML models
# Classification and Regression
# Next: let's look at a critical concept VARIANCE
panel_8 = Panel(oneliners_decision_tree_015.out)

# ---- group: All that JAZZ
# MACHINE LEARNING:
#  scikit-learn
# Base Script
# Jazz
ghpython_script = GhPythonScript()  # -> out, a; disabled
# ---------- ghpython_script: Python ----------
__author__ = "Sculpture"
__version__ = "2021.05.30"

import rhinoscriptsyntax as rs

#import and do all this JAZZ!
import rhinoscriptsyntax as rs
import scriptcontext as sc
import ghpythonremote

np = sc.sticky['numpy']
scipy = sc.sticky['scipy']
mpl = sc.sticky['matplotlib']
plt = mpl.pyplot
rpy = sc.sticky['rpy']
pandas = sc.sticky['pandas']
skl = sc.sticky['sklearn'] #machine linput5ing models
linm = sc.sticky['sklearn.linear_model']
cluster = sc.sticky['sklearn.cluster']
nb = sc.sticky['sklearn.neighbors']
MLP = sc.sticky['sklearn.neural_network']
"""
#data (size / cost)
X = np.array([  [input1[0], input2[0], input3[0], input4[0], input5[0], output6[0]],
                [input1[1], input2[1], input3[1], input4[1], input5[1], output6[1]],
                [input1[2], input2[2], input3[2], input4[2], input5[2], output6[2]],
                [input1[3], input2[3], input3[3], input4[3], input5[3], output6[3]],
                [input1[4], input2[4], input3[4], input4[4], input5[4], output6[4]],
                [input1[5], input2[5], input3[5], input4[5], input5[5], output6[5]],
                [input1[6], input2[6], input3[6], input4[6], input5[6], output6[6]],
                [input1[7], input2[7], input3[7], input4[7], input5[7], output6[7]],
                [input1[8], input2[8], input3[8], input4[8], input5[8], output6[8]],
                [input1[9], input2[9], input3[9], input4[9], input5[9], output6[9]]])

#oneLiner
neural_net = MLP.MLPRegressor(max_iter=10000).fit(X[:,:-1], X[:,-1])

#result
res = neural_net.predict([[sample1,sample2,sample3,sample4,sample5]])
print(res)[0]"""
# ---------- end ghpython_script ----------

# ----
xz_plane = XZPlane(Origin=Point(0, 0, 0))  # disabled
yz_plane = YZPlane(Origin=Point(0, 0, 0))  # disabled
xy_plane = XYPlane(Origin=Point(0, 0, 0))  # disabled

number_slider_27 = Slider(0.1, range=0..0.1)  # disabled
number_slider_28 = Slider(1, range=1..3)  # disabled

number = Number(flatten(oneliners_neuralnetworkanalysis_013.out))  # disabled
unit_x = UnitX(Factor=number)  # disabled
quad_sphere = QuadSphere(Base=PlaneXY(0, 0, 0), Radius=number_slider_7)  # disabled
move = Move(Geometry=quad_sphere, Motion=unit_x)  # -> Geometry, Transform; disabled
list_length = ListLength(List=number)  # -> flatten(Length); disabled
polar_array = PolarArray(Geometry=move.Geometry, Plane=xy_plane, Count=list_length, Angle=degrees(number))  # -> Geometry, Transform; disabled
number_slider_29 = Slider(0, range=0..5)  # disabled
md_slider = MDSlider(SliderMode=0, slider_value=Point(0.5, 0.5, 0.5), x_domain=Domain(0, 1), y_domain=Domain(0, 1), z_domain=Domain(0, 1))  # disabled
deconstruct_brep = DeconstructBrep(Brep=polar_array.Geometry)  # -> Faces, Edges, Vertices; disabled
list_item = ListItem(List=deconstruct_brep.Faces, Index=number_slider_29, Wrap=True)  # disabled
evaluate_surface = EvaluateSurface(Surface=reparameterize(list_item), Point=md_slider)  # -> Point, Normal, UDirection, VDirection, Frame; disabled
amplitude = Amplitude(Vector=evaluate_surface.Normal, Amplitude=number_slider_28)  # disabled
mesh_pipe = MeshPipe(Polylines=list_item, NumberOfSides=4, Tolerance=0.1, Radius=number_slider_27, Cap=False, Join=False)  # disabled
extrude = Extrude(Base=list_item, Direction=amplitude)  # -> flatten(Extrusion); disabled

# ---- group: art
# Decision-Tree Learning EXAMPLE
number_slider_30 = Slider(8, range=0..10)
number_slider_31 = Slider(4, range=0..5)
number_slider_32 = Slider(2, range=0..10)

# ----
series = Series(Start=Slider(0, range=0..10), Step=Slider(2, range=0..10), Count=Slider(6, range=0..10))
jitter_7 = Jitter(List=series, Jitter=Slider(0.46, range=0..1), Seed=2)  # -> Values, Indices
jitter_8 = Jitter(List=series, Jitter=Slider(0.73, range=0..1), Seed=2)  # -> Values, Indices
oneliners_decision_tree_example_016 = OneLiners_decisionTree_EXAMPLE_016(
    artA=number_slider_30,
    artB=number_slider_30,
    artC=number_slider_32,
    desA=number_slider_30,
    desB=number_slider_31,
    desC=number_slider_31,
    engA=number_slider_31,
    engB=number_slider_30,
    engC=number_slider_32,
    sample0A=series,
    sample0B=jitter_7.Values,
    sample0C=jitter_7.Values,
    sample1A=jitter_8.Values,
    sample1B=jitter_8.Values,
    sample1C=series)  # -> out, a; inputs artA: Int32, artB: Int32, artC: Int32, desA: Int32, desB: Int32, desC: Int32, engA: Int32, engB: Int32, engC: Int32, sample0A: Int32, sample0B: Int32, sample0C: Int32, sample1A: Int32, sample1B: Int32, sample1C: Int32
# ---------- oneliners_decision_tree_example_016: Python ----------
__author__ = "Sculpture"
__version__ = "2021.05.30"

import rhinoscriptsyntax as rs

#import and do all this JAZZ!
import rhinoscriptsyntax as rs
import scriptcontext as sc
import ghpythonremote

np = sc.sticky['numpy']
scipy = sc.sticky['scipy']
mpl = sc.sticky['matplotlib']
plt = mpl.pyplot
rpy = sc.sticky['rpy']
pandas = sc.sticky['pandas']
skl = sc.sticky['sklearn'] #machine linput5ing models
linm = sc.sticky['sklearn.linear_model']
cluster = sc.sticky['sklearn.cluster']
nb = sc.sticky['sklearn.neighbors']
MLP = sc.sticky['sklearn.neural_network']
TREE = sc.sticky['sklearn.tree']

"""
#data (size / cost)
X = np.array([  [input1[0], input2[0], input3[0], input4[0], input5[0], output6[0]],
                [input1[1], input2[1], input3[1], input4[1], input5[1], output6[1]],
                [input1[2], input2[2], input3[2], input4[2], input5[2], output6[2]],
                [input1[3], input2[3], input3[3], input4[3], input5[3], output6[3]],
                [input1[4], input2[4], input3[4], input4[4], input5[4], output6[4]],
                [input1[5], input2[5], input3[5], input4[5], input5[5], output6[5]],
                [input1[6], input2[6], input3[6], input4[6], input5[6], output6[6]],
                [input1[7], input2[7], input3[7], input4[7], input5[7], output6[7]],
                [input1[8], input2[8], input3[8], input4[8], input5[8], output6[8]],
                [input1[9], input2[9], input3[9], input4[9], input5[9], output6[9]]])

#oneLiner
neural_net = MLP.MLPRegressor(max_iter=10000).fit(X[:,:-1], X[:,-1])

#result
res = neural_net.predict([[sample1,sample2,sample3,sample4,sample5]])
print(res)[0]"""

#data: points in (art, design, engineering) - study field
X = np.array([  [artA, artB, artC, 4],
                [desA, desB, desC, 5],
                [engA, engB, engC, 6]])

#oneLiner
Tree = TREE.tree.DecisionTreeClassifier().fit(X[:,:-1], X[:,-1])

#result and puzzle
researcher_0 = Tree.predict([[sample0A, sample0B, sample0C]])
print(researcher_0)[0]

researcher_1 = Tree.predict([[sample1A, sample1B, sample1C]])
print(researcher_1)[0]
# ---------- end oneliners_decision_tree_example_016 ----------
# Data Visualization @ Wickerson Studios
panel_9 = Panel(oneliners_decision_tree_example_016.out)

dispatch = Dispatch(List=oneliners_decision_tree_example_016.out, DispatchPattern=[True, False])  # -> ListA, ListB
circle = Circle(Plane=PlaneXY(0, 0, 0), Radius=dispatch.ListB)
circle_2 = Circle(Plane=PlaneXY(0, 0, 0), Radius=dispatch.ListA)
panel_10 = Panel(dispatch.ListA)
rectangle = Rectangle(Plane=PlaneXY(0, 0, 0), XSize=dispatch.ListA, YSize=dispatch.ListB, Radius=0)  # -> Rectangle, Length
rectangle_2 = Rectangle(Plane=PlaneXY(0, 0, 0), XSize=dispatch.ListB, YSize=dispatch.ListA, Radius=0)  # -> Rectangle, Length
rectangular_array = RectangularArray(Geometry=circle, Cell=rectangle_2.Rectangle, XCount=dispatch.ListB, YCount=dispatch.ListB)  # -> Geometry, Transform
panel_11 = Panel(dispatch.ListB)
rectangular_array_2 = RectangularArray(Geometry=circle_2, Cell=rectangle.Rectangle, XCount=dispatch.ListA, YCount=dispatch.ListA)  # -> Geometry, Transform
shortest_list = ShortestList(ListA=rectangular_array_2.Geometry, ListB=rectangular_array.Geometry, TrimMode=2)  # -> graft(ListA), graft(ListB)
unit_x_2 = UnitX(Factor=1)
unit_y = UnitY(Factor=1)
area = Area(Geometry=shortest_list.ListA)  # -> Area, Centroid
rotate_3d = Rotate3D(Geometry=shortest_list.ListA, Angle=1.570796327, Center=area.Centroid, Axis=[unit_x_2, unit_y])  # -> Geometry, Transform
curve = Curve(shortest_list.ListA)
multipipe = MultiPipe(Curves=[curve, rotate_3d.Geometry], NodeSize=0.5, EndOffset=1, StrutSize=1, Segment=0, KinkAngle=0.6, CubeFit=0)

# ==== cluster GHPythonRemote: Connects the Grasshopper Python component to an external Python instance.
python = PythonScript()  # -> gh_parent_doc_dir
# ---------- python: Python ----------
from os import path

gh_parent_doc_dir = path.abspath(path.dirname(ghenv.Component.OnPingDocument().Owner.OnPingDocument().FilePath))
# ---------- end python ----------
# GH to python remote example.
# Pierre Cuvilliers, 2017-2018
# Released under the MIT license
# github.com/pilcru/ghpythonremote
# Runs and connects to an external python engine, and
# assigns imported modules to scriptcontext.sticky variables.
# 
# Arguments:
#       code (str): Path to the GH_to_python_sticky.py code file.
#       location (str): Path to a python executable, or to a folder
#             containing `python.exe`, or the name of a conda-created
#             virtual environment prefixed by `conda://` (`conda://env_name`).
#             If empty, finds python from your windows %PATH%.
#       run (boolean): Creates the connection, and imports new
#             modules, when turned to True. Kills the connection,
#             and deletes the references to the imports, when turned
#             to False.
#       modules (str list): List of module names to import in the
#             remote python. They will be added to the
#             scriptcontext.sticky dictionary, allowing them to be
#             reused from other python components in the same
#             Grasshopper document. Submodules (for example
#             `numpy.linalg` have to be added explicitly to this list
#             to be available later.
#       log_level (str from ['NOTSET', 'DEBUG', 'INFO', 'WARNING', 'ERROR', 'CRITICAL']):
#             Logging level to use for the local IronPython and the
#             remote python instance.
#       working_dir (str): Working directory for the remote python
#             instance.
# 
# Returns:
#       out (str): Console output with DEBUG information.
#       linked_modules (str list): list of imported module names.
#       rpy (rpyc connection object): The object representing the
#             remote Python interpreter.
location = ClusterInput()  # location (str): Path to a python executable, or to a folder containing `python.exe`, or the name of a conda-created virtual environment prefixed by `conda://` (`conda://env_name`). If empty, finds python from your windows %PATH%.
run = ClusterInput()  # run (boolean): Creates the connection, and imports new modules, when turned to True. Kills the connection,and deletes the references to the imports, when turned to False.
modules = ClusterInput()  # modules (str list): List of module names to import in the remote python. They will be added to the scriptcontext.sticky dictionary, allowing them to be reused from other python components in the same Grasshopper document. Submodules (for example `numpy.linalg` have to be added explicitly to this list to be available later.
list = ValueList({"CRITICAL", "ERROR", "WARNING", "INFO", "DEBUG", "NOTSET"}, selected="DEBUG")
panel = Panel(python)
ghpythonremote = GHPythonRemote(location=location, run=run, modules=modules, log_level=list, working_dir=panel)  # -> out, linked_modules, rpy; inputs run: Boolean, modules: list
# ---------- ghpythonremote: Python ----------
import inspect
import logging
from os import path
import sys
from time import sleep

import scriptcontext

import ghpythonremote
from ghpythonremote.connectors import GrasshopperToPythonRemote

local_log_level = getattr(logging, log_level, logging.WARNING)
logger = logging.getLogger("ghpythonremote")
logger.setLevel(local_log_level)
ch = logging.StreamHandler()
ch.setLevel(local_log_level)
formatter = logging.Formatter("%(levelname)s: %(name)s:\n%(message)s")
ch.setFormatter(formatter)
logger.handlers = []
logger.addHandler(ch)
logger = logging.getLogger("ghpythonremote.GH_to_python")

ROOT = path.abspath(path.dirname(inspect.getfile(ghpythonremote)))
rpyc_server_py = path.join(ROOT, "pythonservice.py")

# Set connection to CLOSED if this is the first run
# and initialize set of linked modules
try:
    remote_python_status
except NameError:
    remote_python_status = "CLOSED"
    lkd_modules = set()

# Wait for connection to connect or terminate
timer = 0
while remote_python_status == "CONNECTING" or remote_python_status == "CLOSING":
    sleep(1)
    timer += 1
    if timer == 10:
        try:
            gh2py_manager.__exit__(*sys.exc_info())
        except Exception:
            pass
        remote_python_status = "CLOSED"
        lkd_modules = set()
        raise RuntimeError(
            "Connection left in an inconsistent state and not returning. Reset "
            "everything."
        )

if run:
    if not remote_python_status == "OPEN":
        remote_python_status = "CONNECTING"
        gh2py_manager = GrasshopperToPythonRemote(
            rpyc_server_py,
            location=location,
            timeout=10,
            port=None,
            log_level=log_level,
            working_dir=working_dir,
        )
        gh2py = gh2py_manager.__enter__()
        remote_python_status = "OPEN"

    # Stuff that we can reach
    rpymod = gh2py.py_remote_modules  # A getter function for a named python module
    rpy = gh2py.connection  # Represents the remote instance root object
    scriptcontext.sticky["rpy"] = rpy
    # Add modules
    for mod in modules:
        try:
            scriptcontext.sticky[mod] = rpymod(mod)
            lkd_modules.add(mod)
        except ImportError:
            gh2py_manager.__exit__(*sys.exc_info())
            raise

elif not remote_python_status == "CLOSED":
    remote_python_status = "CLOSING"
    # Remove linked modules
    for mod in lkd_modules:
        del scriptcontext.sticky[mod]
    del scriptcontext.sticky["rpy"]
    gh2py_manager.__exit__(*sys.exc_info())
    lkd_modules = set()
    remote_python_status = "CLOSED"

# Change variable name because ghpython resets outputs to None before each run
linked_modules = lkd_modules

logger.info("GH to python connection is {}".format(remote_python_status))
# ---------- end ghpythonremote ----------
out = ClusterOutput(ghpythonremote.out)  # Console output.
linked_modules = ClusterOutput(ghpythonremote.linked_modules)  # Names of modules that were successfully added to the scriptcontext.sticky dictionary.
rpy = ClusterOutput(ghpythonremote.rpy)  # The object representing the remote python instance
python_2 = PythonScript(module_names=ghpythonremote.linked_modules)  # -> import_statements; inputs module_names: list
# ---------- python_2: Python ----------
import_statements = ["import scriptcontext as sc"]
for module_name in module_names:
    import_statements.append("{0} = sc.sticky['{0}']".format(module_name))

if len(module_names) == 0:
    import_statements = []
# ---------- end python_2 ----------
import_statements = ClusterOutput(python_2)  # Useful import statements to use the imported modules in your scripts.
