# Grasshopper definition squares_001.gh (Grasshopper 1.0.7)
# plug-ins: Bifocals

geometry = Geometry([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])
pipe = Pipe(Curve=reparameterize(geometry), Radius=Slider(0.3, range=0..1), Caps=2)
dispatch = Dispatch(List=flatten(pipe), DispatchPattern=[True, False])  # -> ListA, ListB
geometry_2 = Geometry(dispatch.ListA)
# oneLiners_Basic
number_slider = Slider(1, range=0..10)
oneliner_squares = OneLiner_squares(x=Slider(2, range=0..10), y=Slider(4, range=0..10))  # -> out, squares; inputs x: Int32, y: Int32
# ---------- oneliner_squares: Python ----------
__author__ = "Sculpture"
__version__ = "2021.05.23"

import rhinoscriptsyntax as rs

#before
squares = []
        
for i in range(10):
    squares.append(i**x) 
        
#after oneliner
print([i**y for i in range(10)])
# ---------- end oneliner_squares ----------

# ---- group: oneliner_squares
oneliner_squares_2 = GhPythonScript(x=number_slider, y=Slider(3, range=0..10))  # -> out, squares; inputs x: Int32, y: Int32; same code as oneliner_squares

# ----
panel = Panel(oneliner_squares_2.out)
panel_2 = Panel(oneliner_squares_2.squares)
panel_3 = Panel(oneliner_squares.squares)
panel_4 = Panel(oneliner_squares.out)
